vi "Function_2.gvi"   [LabVIEW NXG 5.0.0]
panel controls:
  "Unsorted Array 1": f64[]
  "Unsorted Array 2": f64[]
panel indicators:
  "Sorted Array 1": f64[]
  "Sorted Array 2": f64[]
diagram:
  for {
    w1 = each element of $"Unsorted Array 1"
    w2 = each element of $"Unsorted Array 2"
    Build Cluster(w1, w2) -> w4
    append w4 to w3
  }
  Sort 1D Array(array=w3) -> (sorted array=w5)
  for {
    w6 = each element of w5
    Property Node(instance in=w6) -> ("Element 1"=w9, "Element 2"=w10)
    append w9 to w7
    append w10 to w8
  }
  $"Sorted Array 1" <- w7
  $"Sorted Array 2" <- w8
