vi "Initialize app subroutine.gvi"   [LabVIEW NXG 5.0.0]
inputs:
  "Error In": error
  "Instrument Control Mega Cluster In": "Instrument Control Mega Cluster.gtype"
  "Misc Data Mega Cluster In": "Misc Data Mega Cluster.gtype"
outputs:
  "Error Out": error
  "Instrument Control Mega Cluster Out": "Instrument Control Mega Cluster.gtype"
  "Misc Data Mega Cluster Out": "Misc Data Mega Cluster.gtype"
types:
  "Instrument Coms Info.gtype" = cluster{"Arduino Coms Info": "Arduino Detection cluster control.gtype", "Photodetector Names": string[], "Keythley Address": "VISA Instr", "Photodetector Detected?": bool, "Thorlabs Motors Detected?": bool, "Keithley Detected?": bool, "Thorlabs Motors Serial Number": "Thorlabs Motors Serial Number In.gtype", "Photodetector IVI session": "Ivi IviDefault", "Flame ID": string, "Flame Detected?": bool, "Flame Wrapper ID": u64}
  "Debugging Cluster.gtype" = cluster{"Debugging mode?": bool, "Initialize App": bool, "Insturment Debugging": "Insturment Debugging Cluster.gtype"}
  "Instrument Control Mega Cluster.gtype" = cluster{"Instruments Coms Info": "Instrument Coms Info.gtype", "Debugging Cluster": "Debugging Cluster.gtype"}
  "Full Reference Cluster.gtype" = cluster{"Enum Reference Cluster": "Enum Control Reference Cluster.gtype", "Boolean Reference Cluster": "Boolean Control Reference Cluster.gtype", "Numeric Reference Cluster": "Numeric Control Reference Cluster.gtype", "Numeric Cluster Reference Cluster": "Numeric Cluster Reference Cluster.gtype", "Path Reference Cluster": "Path Reference Cluster.gtype", "Cluster Reference Cluster": "Cluster Reference Cluster.gtype", "XZ Stage Controls Reference Cluster": "XZ Stage Controls Reference Cluster.gtype"}
  "Cell Naming Cluster.gtype" = cluster{"Cell Label": string, "Sample Prefix": string, "Author Initials": string, "Current Date": string, "Batch Name": string}
  T1 = cluster{"X Coordinate (mm)": f64, "Z Coordinate (mm)": f64}
  T2 = cluster{"X Coordinate (mm)": f64, "Z Coordinate (mm)": f64, "Vertical Spacing (mm)": f64}
  "XZ All Position Cluster.gtype" = cluster{"Diffusor Coordinates": T1, "Photodetector Coordinates": T1, "Cell R.01 Coordinates": T2}
  T3 = cluster{"Thorlabs Motor Serial Number File Path": path, "Default Data Saving Location": path}
  "Misc Data Mega Cluster.gtype" = cluster{"Full Reference Cluster": "Full Reference Cluster.gtype", "Cell Naming Cluster": "Cell Naming Cluster.gtype", "All XZ Position Cluster": "XZ All Position Cluster.gtype", "All Paths": T3}
uses:
  Rainbow Measurement Setup::Main Functions::Instruction Queue::Current State::FGV Current State.gvi
  Rainbow Measurement Setup::Main Functions::Initialize App::Instruction Extractor Initialize.gvi
  Rainbow Measurement Setup::Side Functions::Instrument Control::Thorlabs Motors::Detection::Thorlabs Serial Number Check.gvi
  Rainbow Measurement Setup::Main Functions::Initialize App::Reset Disabled Controls Subroutine.gvi
  Rainbow Measurement Setup::Main Functions::Initialize App::Reset Clusters Subroutine.gvi
  Rainbow Measurement Setup::Main Functions::Initialize App::Reset Global Variables Subroutine.gvi
  Rainbow Measurement Setup::Main Functions::Initialize App::Initialize Detect Insturments SbRt.gvi
  Rainbow Measurement Setup::Side Functions::Global Abort::FGV Global Abort.gvi
diagram:
  Property Node(instance in=$"Instrument Control Mega Cluster In") -> ("Debugging Cluster:Debugging mode?"=w1, "Debugging Cluster:Initialize App"=w2)
  Logical And(w1, not w2) -> w3
  # This is the Initialization Subroutine, its main job is to reset the values of controls, reset functional global variables, scan for instruments
  # and read configuration files among other things.
  case (w3) {
    frame True {
      w4 = $"Error In"
      w5 = $"Instrument Control Mega Cluster In"
      w6 = $"Misc Data Mega Cluster In"
    }
    frame False {
      case ($"Error In") {
        frame Error, Default {
          w4 = $"Error In"
          w5 = $"Instrument Control Mega Cluster In"
          w6 = $"Misc Data Mega Cluster In"
        }
        frame No Error {
          call "FGV Current State.gvi"(Current State Instructions="Set Current State", Current State="Initialize App", Error In=$"Error In") -> (Error Out=w7)
          call "Instruction Extractor Initialize.gvi"(Initialize app subroutine states="Reset Disabled/Enabled Controls", Error In=w7) -> (Initialize app States array=w8, SubStates Output Array=w9, Error Out=w10)
          s1 = w10  # shift register
          s2 = $"Instrument Control Mega Cluster In"  # shift register
          s3 = $"Misc Data Mega Cluster In"  # shift register
          for {
            w11 = each element of w8
            w12 = each element of w9
            call "FGV Current State.gvi"(Current State Instructions="Set Current Substate", Current Substate=w12, Error In=s1) -> (Error Out=w13)
            case (w11) {
              frame "Read Configuration Files" {
                call "Thorlabs Serial Number Check.gvi"(Instrument Control Mega Cluster In=s2, Misc Data Mega Cluster In=s3, Error In=w13) -> (Instrument Control Mega Cluster Out=w15, Misc Data Mega Cluster Out=w16, Error Out=w14)
              }
              frame "Reset Disabled/Enabled Controls", Default {
                call "Reset Disabled Controls Subroutine.gvi"(Misc Data Mega Cluster In=s3, Error In=w13) -> (Misc Data Mega Cluster Out=w16, Error Out=w14)
                w15 = s2
              }
              frame "Reset Doubles" {
                w14 = w13
                w15 = s2
                w16 = s3
              }
              frame "Reset Booleans" {
                w14 = w13
                w15 = s2
                w16 = s3
              }
              frame "Reset Clusters" {
                call "Reset Clusters Subroutine.gvi"(Misc Data Mega Cluster In=s3, Error In=w13) -> (Misc Data Mega Cluster Out=w16, Error Out=w14)
                w15 = s2
              }
              frame "Reset Strings" {
                w14 = w13
                w15 = s2
                w16 = s3
              }
              frame "Reset Global Variables" {
                call "Reset Global Variables Subroutine.gvi"(Misc Data Mega Cluster In=s3, Error In=w13) -> (Error Out=w14)
                w15 = s2
                w16 = s3
              }
              frame "Detect Instruments" {
                call "Initialize Detect Insturments SbRt.gvi"(Instrument Control Mega Cluster In=s2, Error In=w13) -> (Instrument Control Mega Cluster Out=w15, Error Out=w14)
                w16 = s3
              }
            }
            call "FGV Global Abort.gvi"(Global Abort Instructions="Read Current State", Error In=w14) -> (Global Abort Out=w17, Error Out=w18)
            next s1 = w18
            next s2 = w15
            next s3 = w16
            stop if w17
          }
          w4 = s1
          w5 = s2
          w6 = s3
        }
      }
    }
  }
  $"Instrument Control Mega Cluster Out" <- w5
  $"Misc Data Mega Cluster Out" <- w6
  $"Error Out" <- w4
