vi "Reset Global Variables Subroutine.gvi"   [LabVIEW NXG 5.0.0]
inputs:
  "Error In": error
outputs:
  "Error Out": error
uses:
  Rainbow Measurement Setup::Side Functions::Global Abort::FGV Global Abort.gvi
  Rainbow Measurement Setup::Side Functions::Instrument Control::Arduino::XZ Stage Arduino::Low Level::XZ Stage Homed FGV.gvi
  Rainbow Measurement Setup::Main Functions::Rainbow Measurement::Light Power Calibration::Light Power Operation FGV.gvi
  Rainbow Measurement Setup::Side Functions::Instrument Control::Thorlabs Motors::Dividing Wavelength Control::Dividing Wavelength Calibration Data FGV.gvi
  Rainbow Measurement Setup::Side Functions::Utilities::Progress Handling::Progress FGV.gvi
  Rainbow Measurement Setup::Main Functions::Rainbow Measurement::Light Power Calibration::Light Calibration Live Parameters FGV.gvi
  Rainbow Measurement Setup::Side Functions::Sample Naming::Sample Prefix FGV.gvi
  Rainbow Measurement Setup::Main Functions::Rainbow Measurement::Cell Single Rainbow Measurement::SRM Live Parameters::SRM Sweep Live Parameters FGV.gvi
  Rainbow Measurement Setup::Side Functions::Messages And Prompts::FGV Cancel Prompts until Finished Routine.gvi
  Rainbow Measurement Setup::Side Functions::Instrument Control::Keithley::FGV Keithley timeout.gvi
  Rainbow Measurement Setup::Main Functions::Rainbow Measurement::Cell Single Rainbow Measurement::SRM Operation FGV.gvi
  Rainbow Measurement Setup::Main Functions::Rainbow Measurement::Single Multiple Measurement Utilities::FGV Last Measurement Type.gvi
diagram:
  # This SubVI Resets all the Global Variables
  case ($"Error In") {
    frame Error, Default {
      w1 = $"Error In"
    }
    frame No Error {
      call "FGV Global Abort.gvi"(Global Abort Instructions="Reset State", Error In=$"Error In") -> (Error Out=w2)
      call "XZ Stage Homed FGV.gvi"(FGV Instructions="Reset State", Error In=w2) -> (Error Out=w3)
      call "Light Power Operation FGV.gvi"(FGV Instructions="Reset State", Error In=w3) -> (Error Out=w4)
      call "Dividing Wavelength Calibration Data FGV.gvi"(Div Wavelength FGV Instructions="Load Data", Error In=w4) -> (Error Out=w5)
      call "Progress FGV.gvi"(FGV Instructions="Reset State", Error In=w5) -> (Error Out=w6)
      call "Light Calibration Live Parameters FGV.gvi"(FGV Instructions="Reset State", Error In=w6) -> (Error Out=w7)
      call "Sample Prefix FGV.gvi"(FGV Instructions="Reset State", Error In=w7) -> (Error Out=w8)
      call "SRM Sweep Live Parameters FGV.gvi"(FGV Instructions="Reset State", Error In=w8) -> (Error Out=w9)
      call "FGV Cancel Prompts until Finished Routine.gvi"(Error In=w9, FGV Instructions="Reset State") -> (Error Out=w10)
      call "FGV Keithley timeout.gvi"(FGV Instructions="Reset State", Error In=w10) -> (Error Out=w11)
      call "SRM Operation FGV.gvi"(FGV Instructions="Reset State", Error In=w11) -> (Error Out=w12)
      call "FGV Last Measurement Type.gvi"(FGV Instructions="Reset State", Error In=w12) -> (Error Out=w1)
    }
  }
  $"Error Out" <- w1
