vi "Modify Measurement TXT File.gvi"   [LabVIEW NXG 5.0.0]
inputs:
  "Error In": error
  "Default Data Saving Location": path
  "Cell Naming Cluster": "Cell Naming Cluster.gtype", required
  "Modify File Operation": "Modify File Operation.gtype" = "Save TXT", required
  "Data To Save": f64[][]
outputs:
  "Error Out": error
  "Loaded Data": f64[][]
  "Folder to save all data": path
panel controls:
  "Measurement File Type": "Measurement File Type.gtype" = "Single Cell Rainbow"
types:
  "Cell Naming Cluster.gtype" = cluster{"Cell Label": string, "Sample Prefix": string, "Author Initials": string, "Current Date": string, "Batch Name": string}
  "Modify File Operation.gtype" = enum{"Save TXT", "Load TXT"}
  "Measurement File Type.gtype" = enum{"Single Cell Rainbow", "Multiple Cell Rainbow", "Light Calibration Power", "Light Calibration Spectral Density", "Light Calibration Power Density", "Light Calibration Beam Spectrum"}
uses:
  Rainbow Measurement Setup::Side Functions::Path Manipulation::Path Check & Generation.gvi
  Rainbow Measurement Setup::Side Functions::Path Manipulation::Path Already Exists prompt.gvi
  Rainbow Measurement Setup::Side Functions::Path Manipulation::Measurement File Header Generator.gvi
  Rainbow Measurement Setup::Side Functions::Path Manipulation::Header info merger.gvi
  Rainbow Measurement Setup::Side Functions::Path Manipulation::Rename Window.gvi
  NI::G Core::Error::Clear Error Cluster.gvi
  Rainbow Measurement Setup::Side Functions::Utilities::Header Extractor.gvi
diagram:
  case ($"Error In") {
    frame Error, Default {
      w1 = $"Error In"
    }
    frame No Error {
      case ($"Modify File Operation") {
        frame "Save TXT" {
          call "Path Check & Generation.gvi"(Default Data Saving Location=$"Default Data Saving Location", Cell Naming Cluster=$"Cell Naming Cluster", Error In=$"Error In", Measurement File Type=$"Measurement File Type") -> (Folder to save data=w2, File path=w3, Error Out=w4)
          call "Path Already Exists prompt.gvi"(Path to Check=w3, Error In=w4) -> (Existing File Instruction out=w5, Error Out=w6)
          call "Measurement File Header Generator.gvi"(Measurement File Type=$"Measurement File Type", Error In=w6) -> (Header Items=w7, Error Out=w8)
          case (w5) {
            frame "Replace" {
              Open Or Create Or Replace File(error in=w8, file path (use dialog)=w3, operation (0:open)="replace or create") -> (error out=w9, refnum out=w10)
              Array To Spreadsheet String(array=$"Data To Save", format string="%g") -> (spreadsheet string=w11)
              call "Header info merger.gvi"(Column info array=w7, Spreadsheet String=w11, Error In=w9) -> (Spreadsheet String With Header=w12, Error Out=w13)
              Write To Text File(error in=w13, file (use dialog)=w10, text=w12) -> (error out=w14, refnum out=w15)
              Close File(error in=w14, refnum=w15) -> (error out=w1)
            }
            frame "Rename", Default {
              Strip Path(path=w3) -> (name=w16, stripped path=w17)
              call "Rename Window.gvi"(Original Filename=w16, Error In=w8) -> (Output=w18, Error Out=w19)
              Build Path(base path=w17, name or relative path=w18) -> (appended path=w20)
              Open Or Create Or Replace File(error in=w19, file path (use dialog)=w20, operation (0:open)="replace or create") -> (error out=w21, refnum out=w22)
              Array To Spreadsheet String(array=$"Data To Save", format string="%g") -> (spreadsheet string=w23)
              call "Header info merger.gvi"(Column info array=w7, Spreadsheet String=w23, Error In=w21) -> (Spreadsheet String With Header=w24, Error Out=w25)
              Write To Text File(error in=w25, file (use dialog)=w22, text=w24) -> (error out=w26, refnum out=w27)
              Close File(error in=w26, refnum=w27) -> (error out=w1)
            }
            frame "Do not save" {
              w1 = w8
            }
          }
          $"Folder to save all data" <- w2
        }
        frame "Load TXT", Default {
          Open Or Create Or Replace File(error in=$"Error In", operation (0:open)="open", prompt="Choose or enter path of the file you want to load...") -> (cancelled=w28, error out=w29, refnum out=w30)
          case (w28) {
            frame True {
              call "Clear Error Cluster.gvi"(error in=w29) -> (error out=w1)
              w31 = f64[][] []
            }
            frame False {
              Read From Text File(error in=w29, file (use dialog)=w30) -> (error out=w32, refnum out=w33, text=w34)
              Close File(error in=w32, refnum=w33) -> (error out=w35)
              call "Header Extractor.gvi"(Spreadsheet String=w34, Error In=w35) -> (Spreadsheet string without header=w36, Error Out=w1)
              Spreadsheet String To Array(format string="%f", spreadsheet string=w36) -> (array=w31)
            }
          }
          $"Loaded Data" <- w31
        }
      }
    }
  }
  $"Error Out" <- w1
