vi "Beam Power Density Full Scan Subroutine.gvi"   [LabVIEW NXG 5.0.0]
inputs:
  "Beam Power Density Full Scan Data Array In": "Beam Power Density Full Scan Data Cluster.gtype"[]
  "Instrument Coms Info In": "Instrument Coms Info.gtype"
  "XZ Coordinate Array In": "XZ Coordinate Array.gtype"
  "XZ Scan Parameters In": "XZ Scan Parameters.gtype" = {"X Scan Range (mm)"=1, "Z Scan Range (mm)"=1, "X Steps"=3, "Z Steps"=3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}
  "Rainbow Sweep Parameters Array": "Rainbow Sweep Parameters.gtype"[]
  "Error In": error
outputs:
  "Beam Power Density Full Scan Data Array Out": "Beam Power Density Full Scan Data Cluster.gtype"[]
  "Instrument Coms Info Out": "Instrument Coms Info.gtype"
  "Error Out": error
types:
  "XZ Coordinate Cluster.gtype" = cluster{"X Coordinate (mm)": f64, "Z Coordinate (mm)": f64, "Coordinate Gcode": string, "Beam Power (W)": f64}
  "XZ Coordinate Array.gtype" = "XZ Coordinate Cluster.gtype"[]
  T1 = cluster{"Element 1": "VISA Instr", "Element 2": string}
  "Arduino Detection cluster control.gtype" = cluster{"XZ Stage Arduino Address": "VISA Instr", "XZ Stage Arduino Detected?": bool, "Multiplexer Arduino Detected?": bool, "Multiplexer Arduino Address": "VISA Instr", "Arduinos List": T1[], "XZ Stage Log": string, "Multiplexer Log": string}
  "Thorlabs Motors Serial Number In.gtype" = cluster{"Thorlabs Blue Motor": string, "Thorlabs Red Motor": string}
  "Instrument Coms Info.gtype" = cluster{"Arduino Coms Info": "Arduino Detection cluster control.gtype", "Photodetector Names": string[], "Keythley Address": "VISA Instr", "Photodetector Detected?": bool, "Thorlabs Motors Detected?": bool, "Keithley Detected?": bool, "Thorlabs Motors Serial Number": "Thorlabs Motors Serial Number In.gtype", "Photodetector IVI session": "Ivi IviDefault"}
  "XZ Scan Parameters.gtype" = cluster{"X Scan Range (mm)": f64, "Z Scan Range (mm)": f64, "X Steps": f64, "Z Steps": f64, "Center Coordinate X": f64, "Center Coordinate Z": f64, "Z Step size": f64, "X Step size": f64, "Total Steps": f64, "Z Starting Point": f64, "X Starting Point": f64, "Z End Point": f64, "X End Point": f64}
  "Rainbow Sweep Types.gtype" = enum{"Red Sweep Closing", "Red Sweep Opening", "Blue Sweep Closing", "Blue Sweep Opening"}
  "Rainbow Sweep Parameters.gtype" = cluster{"Dividing Wavelength Array": f64[], "Rainbow Sweep Types": "Rainbow Sweep Types.gtype"}
  "Beam Power Density Single Sweep Data Cluster.gtype" = cluster{"Beam Power Density": f64[][], "Dividing Wavelength": f64, "XZ Array": "XZ Coordinate Array.gtype"}
  "Beam Power Density Full Scan Data Cluster.gtype" = cluster{"Beam Power Density Single Sweep Data Array": "Beam Power Density Single Sweep Data Cluster.gtype"[], "Rainbow Sweep Types": "Rainbow Sweep Types.gtype"}
uses:
  Rainbow Measurement Setup::Main Functions::One Time Calibrations::Beam Power Density::Single Scan Subroutine.gvi
  Rainbow Measurement Setup::Main Functions::One Time Calibrations::XZ Array To Intensity Graph.gvi
  Rainbow Measurement Setup::Side Functions::Global Abort::FGV Global Abort.gvi
diagram:
  # This SubVI Loops through the Rainbow Sweep Parameters Array and performs a Beam Power Density Scan for each type of sweep present in the array.
  # For each type of sweep it also performs a scan for each dividing wavelength and stores the resulting beam power density within a sub array of the Beam
  # Power density full scan data array that holds all the measurements performed for each type of sweep. The resulting data is structured as follows:
  # -Beam Power Density Full Scan Data Array (Array with different types of sweeps, red closing blue closing...)
  # 	-Type Of sweep
  # 	-Beam Power density Data Single Sweep Array (Array with all the Beam Power Density maps at each dividing wavelength)
  # 		-Beam Power Density map
  # 		-Specific dividing wavelength of that map
  # 		-XZ Array to have all the coordinates and beam power more accessible
  #
  # I know it's complicated :')
  case ($"Error In") {
    frame Error, Default {
      w1 = $"Error In"
      w2 = $"Beam Power Density Full Scan Data Array In"
      w3 = $"Instrument Coms Info In"
    }
    frame No Error {
      s1 = $"Instrument Coms Info In"  # shift register
      s2 = $"Error In"  # shift register
      s3 = $"Beam Power Density Full Scan Data Array In"  # shift register
      for (iteration -> i1) {
        w4 = each element of $"Rainbow Sweep Parameters Array"
        Array Index(array=s3) -> (out0[i1]=w5)
        Property Node(instance in=w5) -> ("Beam Power Density Single Sweep Data Array"=w6, instance out=w7)
        Property Node(instance in=w4) -> ("Dividing Wavelength Array"=w8, "Rainbow Sweep Types"=w9)
        s4 = s1  # shift register
        s5 = s2  # shift register
        s6 = w6  # shift register
        for (iteration -> i2) (after i1) {
          w10 = each element of w8
          call "Single Scan Subroutine.gvi"(Instrument Address Output Cluster In=s4, XZ Coordinate Array In=$"XZ Coordinate Array In", Error In=s5) -> (Instrument Address Output Cluster Out=w11, XZ Coordinate Array Out=w12, Error Out=w13)
          Array Index(array=s6) -> (out0[i2]=w14)
          call "XZ Array To Intensity Graph.gvi"(XZ Array=w12, XZ Scan Parameters In=$"XZ Scan Parameters In", Error In=w13) -> (Beam Power Density=w15, Error Out=w16)
          Property Node(instance in=w14, "Beam Power Density"=w15, "Dividing Wavelength"=w10, "XZ Array"=w12) -> (instance out=w17)
          Insert Into Array(inArray=s6, new=w17) -> w18
          call "FGV Global Abort.gvi"(Global Abort Instructions="Read Current State", Error In=w16) -> (Local Abort Out=w19, Global Abort Out=w20, Error Out=w21)
          Logical Or(w19, w20) -> w22
          next s4 = w11
          next s5 = w21
          next s6 = w18
          stop if w22
        }
        Property Node(instance in=w7, "Beam Power Density Single Sweep Data Array"=s6, "Rainbow Sweep Types"=w9) -> (instance out=w23)
        Insert Into Array(inArray=s3, index0=i1, new=w23) -> w24
        next s1 = s4
        next s2 = s5
        next s3 = w24
        stop if w22
      }
      w1 = s2
      w2 = s3
      w3 = s1
    }
  }
  $"Beam Power Density Full Scan Data Array Out" <- w2
  $"Instrument Coms Info Out" <- w3
  $"Error Out" <- w1
