vi "Beam Spectrum Calibration Subroutine.gvi"   [LabVIEW NXG 5.0.0]
inputs:
  "Error In": error
outputs:
  "Error Out": error
panel controls:
  "Stand Alone?": bool
  "Instrument Coms Info In": "Instrument Coms Info.gtype"
  "Beam Spectrum Calibration Parameters": "Beam Spectrum Calibration Parameters.gtype"
  "Rainbow Sweep Param Selector": "Rainbow Sweep Param Selector.gtype" = {0, 1100, 300, 1, 1, 0}
panel indicators:
  "Full Beam Multispectral Data Array": "Full Beam Multispectral Data.gtype"[]
types:
  T1 = cluster{"Element 1": "VISA Instr", "Element 2": string}
  "Arduino Detection cluster control.gtype" = cluster{"XZ Stage Arduino Address": "VISA Instr", "XZ Stage Arduino Detected?": bool, "Multiplexer Arduino Detected?": bool, "Multiplexer Arduino Address": "VISA Instr", "Arduinos List": T1[], "XZ Stage Log": string, "Multiplexer Log": string}
  "Thorlabs Motors Serial Number In.gtype" = cluster{"Thorlabs Blue Motor": string, "Thorlabs Red Motor": string, "Blue Motor Homed?": bool, "Red Motor Homed?": bool}
  "Instrument Coms Info.gtype" = cluster{"Arduino Coms Info": "Arduino Detection cluster control.gtype", "Photodetector Names": string[], "Keythley Address": "VISA Instr", "Photodetector Detected?": bool, "Thorlabs Motors Detected?": bool, "Keithley Detected?": bool, "Thorlabs Motors Serial Number": "Thorlabs Motors Serial Number In.gtype", "Photodetector IVI session": "Ivi IviDefault"}
  "Beam Spectrum Calibration Parameters.gtype" = cluster{"Min Position (mm)": f64, "Max Position (mm)": f64, "Position step size (mm)": f64}
  "Raibow Sweep Selector.gtype" = enum{"Red Sweep", "Blue Sweep", "Full Sweep Red First", "Full Sweep Blue First"}
  "Rainbow Sweep Type Selector.gtype" = cluster{"Red Sweep Mode": enum{"Red Sweep Closing", "Red Sweep Opening"}, "Blue Sweep Mode": enum{"Blue Sweep Opening", "Blue Sweep Closing"}}
  "Rainbow Sweep Param Selector.gtype" = cluster{"Raibow Sweep Selector": "Raibow Sweep Selector.gtype", "Max Wavelength (nm)": f64, "Min Wavelength (nm)": f64, "Wavelength Step (nm)": f64, "Rainbow Sweep Types": "Rainbow Sweep Type Selector.gtype"}
  "Beam Spectrum Data.gtype" = cluster{"Beam Spectrum": cluster{"Wavelength": f64[], "Counts": f64[]}, "Blue Motor Position (mm)": f64, "Red Motor Position (mm)": f64}
  "Rainbow Sweep Types.gtype" = enum{"Red Sweep Closing", "Red Sweep Opening", "Blue Sweep Closing", "Blue Sweep Opening"}
  "Full Beam Multispectral Data.gtype" = cluster{"Beam Spectrum Data Array": "Beam Spectrum Data.gtype"[], "Rainbow Sweep Types": "Rainbow Sweep Types.gtype"}
uses:
  Rainbow Measurement Setup::Main Functions::One Time Calibrations::Beam Power Density::Specific Detect Instruments Subroutine.gvi
  Rainbow Measurement Setup::Side Functions::Instrument Control::Arduino::XZ Stage Arduino::Low Level::XZ Stage Initialize.gvi
  Rainbow Measurement Setup::Side Functions::Instrument Control::Arduino::XZ Stage Arduino::XZ Stage Home Sequence.gvi
  LabView_NXG_Thorlabs_PM100::Examples::Photodetector initialization Sequence with prompt.gvi
  Rainbow Measurement Setup::Main Functions::One Time Calibrations::Beam Spectrum::Beam Spectrum Rainbow Sweep Subroutine.gvi
diagram:
  w1 = $"Stand Alone?"
  w2 = $"Beam Spectrum Calibration Parameters"
  w3 = $"Rainbow Sweep Param Selector"
  # Falta comunicar amb el flame :') DRAMA
  case ($"Error In") {
    frame Error, Default {
      w4 = $"Error In"
      w5 = _
    }
    frame No Error {
      s1 = $"Error In"  # shift register
      s2 = uninitialised  # shift register
      s3 = $"Instrument Coms Info In"  # shift register
      s4 = uninitialised  # shift register
      while {
        case ("Start App") {
          frame "Start App", Default {
            Select(s=w1, t="Detect Instruments", f="Initialize Instruments") -> w6
            w7 = _
            w8 = _
            w9 = _
          }
          frame "Detect Instruments" {
            call "Specific Detect Instruments Subroutine.gvi"(Instrument Coms Info In=s3, Error In=s1, Instruments To Detect Array=["Photodetector", "Arduinos", "Thorlabs Motors"]) -> (Instrument Coms Info Out=w8, Error Out=w7)
            w6 = "Initialize Instruments"
            w9 = _
          }
          frame "Initialize Instruments" {
            Property Node(instance in=s3) -> ("Arduino Coms Info:XZ Stage Arduino Address"=w10, instance out=w11)
            call "XZ Stage Initialize.gvi"(XZ Carriage Arduino Adress In=w10, Error In=s1) -> (XZ Carriage Arduino Visa Session Out=w12, XZ Carriage Arduino Log=w13, Error Out=w14)
            call "XZ Stage Home Sequence.gvi"(XZ Carriage Arduino Open Visa Session In=w12, XZ Carriage Arduino Log In=w13, Error In=w14) -> (XZ Carriage Arduino Log Out=w15, Error Out=w16)
            call "Photodetector initialization Sequence with prompt.gvi"(Error In=w16) -> (Photodetector IVI session=w17, Error Out=w7)
            Property Node(instance in=w11, "Photodetector IVI session"=w17, "Arduino Coms Info:XZ Stage Log"=w15) -> (instance out=w8)
            w6 = "Rainbow Sweep"
            w9 = _
          }
          frame "Rainbow Sweep" {
            call "Beam Spectrum Rainbow Sweep Subroutine.gvi"(Instrument Coms Info In=s3, Beam Spectrum Calibration Parameters=w2, Rainbow Sweep Param Selector=w3, Error In=s1) -> (Instrument Coms Info Out=w8, Full Beam Multispectral Data Array=w9, Error Out=w7)
            w6 = _
          }
        }
        next s1 = w7
        next s2 = w6
        next s3 = w8
        next s4 = w9
        stop if _
      }
      w4 = _
      w5 = s4
    }
  }
  $"Error Out" <- w4
  $"Full Beam Multispectral Data Array" <- w5
