vi "Dividing Wavelength Calculator.gvi"   [LabVIEW NXG 5.0.0]
inputs:
  "Error In": error
  "Full MSpot Multispectral Data Array In": "Full MSpot Multispectral Data.gtype"[]
  "Dividing Wavelength Threshold": f64
outputs:
  "Error Out": error
  "Full MSpot Multispectral Data Array Out": "Full MSpot Multispectral Data.gtype"[]
panel indicators:
  "Dividing Wavelength Graph": cluster{"Element 1": f64[], "Element 2": f64[]}[]
types:
  "MSpot Spectrum Data.gtype" = cluster{"M Spot Spectrum": cluster{"Wavelength": f64[], "Counts": f64[]}, "Blue Motor Position (mm)": f64, "Red Motor Position (mm)": f64, "Dividing Wavelength (nm)": f64}
  "Rainbow Sweep Types.gtype" = enum{"Red Sweep Closing", "Red Sweep Opening", "Blue Sweep Closing", "Blue Sweep Opening"}
  "Full MSpot Multispectral Data.gtype" = cluster{"MSpot Spectrum Data Array": "MSpot Spectrum Data.gtype"[], "Rainbow Sweep Types": "Rainbow Sweep Types.gtype"}
  "Dividing Wavelength Calibration Data.gtype" = cluster{"Dividing Wavelength (nm) Array": f64[], "Blue Motor Position (mm) Array": f64[], "Red Motor Position (mm) Array": f64[]}
uses:
  Rainbow Measurement Setup::Main Functions::One Time Calibrations::MSpot Spectrum::Dividing Wavelength Calculations::Spectra Operator.gvi
  NI::Analysis::Interpolation::Hermite Interpolation 1D.gvi
  Rainbow Measurement Setup::Side Functions::Instrument Control::Thorlabs Motors::Dividing Wavelength Control::Dividing Wavelength Calibration Data FGV.gvi
diagram:
  # This SubVI Takes the Input Data Array from the MSpot spectra calibration
  # and divides the spectra to extract the difference and then smoothes out the
  # peaks to extract the dividing wavelength. To do so it searches for the first value that
  # is below or above a certain threshold either from one end of the array in the case
  # of the red sweeps or from the other end in the case of the blue sweeps.
  case ($"Error In") {
    frame Error, Default {
      w1 = $"Error In"
      w2 = $"Full MSpot Multispectral Data Array In"
    }
    frame No Error {
      s1 = $"Error In"  # shift register
      for {
        w3 = each element of $"Full MSpot Multispectral Data Array In"
        call "Spectra Operator.gvi"(Full MSpot Multispectral Data=w3, Error In=s1, Spectra Operator control="Divide Spectra") -> (Operated Data=w4, Error Out=w5)
        call "Spectra Operator.gvi"(Full MSpot Multispectral Data=w4, Error In=w5, Spectra Operator control="Smooth Peaks") -> (Operated Data=w6, Error Out=w7)
        Property Node(instance in=w3) -> ("MSpot Spectrum Data Array"=w8, "Rainbow Sweep Types"=w9, instance out=w10)
        Property Node(instance in=w6) -> ("MSpot Spectrum Data Array"=w11)
        # Interpolate for a ton of positions
        for {
          w12 = each element of w11
          w13 = each element of w8
          Property Node(instance in=w12) -> ("M Spot Spectrum"=w17, "Blue Motor Position (mm)"=w18, "Red Motor Position (mm)"=w19)
          Property Node(instance in=w17) -> ("Wavelength"=w20, "Counts"=w21)
          case (w9) {
            frame "Red Sweep Opening" {
              # Find Dividing wavelength
              for {
                w24 = each element of w20
                w25 = each element of w21
                Is Less(x=w25, y=$"Dividing Wavelength Threshold") -> w26
                w22 = w24 if w26
              }
              w23 = w18
            }
            frame "Blue Sweep Closing" {
              for {
                w27 = each element of w20
                w28 = each element of w21
                Is Less(x=w28, y=$"Dividing Wavelength Threshold") -> w29
                w22 = w27 if w29
                stop if w29
              }
              w23 = w19
            }
            frame "Blue Sweep Opening" {
              for {
                w30 = each element of w20
                w31 = each element of w21
                Is Less(x=w31, y=$"Dividing Wavelength Threshold") -> w32
                w22 = w30 if w32
                stop if w32
              }
              w23 = w19
            }
            frame "Red Sweep Closing" {
              for {
                w33 = each element of w20
                w34 = each element of w21
                Is Less(x=w34, y=$"Dividing Wavelength Threshold") -> w35
                w22 = w33 if w35
              }
              w23 = w18
            }
          }
          Property Node(instance in=w13) -> (instance out=w36)
          Property Node(instance in=w36, "Dividing Wavelength (nm)"=w22) -> (instance out=w37)
          append w37 to w14
          append w23 to w15
          append w22 to w16
        }
        Property Node(instance in=w10, "MSpot Spectrum Data Array"=w14) -> ("Rainbow Sweep Types"=w38, instance out=w39)
        for (N = 5000) (iteration -> i1) {
          To Double Precision Float(number=i1) -> w41
          Multiply(w41, 0.01) -> w42
          append w42 to w40
        }
        call "Hermite Interpolation 1D.gvi"(y=w16, x=w15, xi=w40) -> (yi=w43, xi used=w44)
        for {
          w45 = each element of w43
          w46 = each element of w44
          # Erase the unuseful points
          Is Greater Than 0(x=w45) -> w49
          append w45 to w47 if w49
          append w46 to w48 if w49
        }
        case (w38) {
          frame "Red Sweep Opening" {
            w51 = "Dividing Wavelength Calibration Data.gtype" {all zero or empty}
            Property Node(instance in=w51, "Dividing Wavelength (nm) Array"=w47, "Blue Motor Position (mm) Array"=w48) -> (instance out=w50)
          }
          frame "Blue Sweep Closing" {
            w52 = "Dividing Wavelength Calibration Data.gtype" {all zero or empty}
            Property Node(instance in=w52, "Dividing Wavelength (nm) Array"=w47, "Red Motor Position (mm) Array"=w48) -> (instance out=w50)
          }
          frame "Blue Sweep Opening" {
            w53 = "Dividing Wavelength Calibration Data.gtype" {all zero or empty}
            Property Node(instance in=w53, "Dividing Wavelength (nm) Array"=w47, "Red Motor Position (mm) Array"=w48) -> (instance out=w50)
          }
          frame "Red Sweep Closing" {
            w54 = "Dividing Wavelength Calibration Data.gtype" {all zero or empty}
            Property Node(instance in=w54, "Dividing Wavelength (nm) Array"=w47, "Blue Motor Position (mm) Array"=w48) -> (instance out=w50)
          }
        }
        call "Dividing Wavelength Calibration Data FGV.gvi"(Div Wavelength FGV Instructions="Acquire New Data", Div Wavelength New Data In=w50, Error In=w7) -> (Error Out=w55)
        Build Cluster(w15, w16) -> w56
        Build Cluster(w48, w47) -> w57
        Build Array(w56, w57) -> w58
        $"Dividing Wavelength Graph" <- w58
        append w39 to w2
        next s1 = w55
      }
      w1 = s1
    }
  }
  $"Full MSpot Multispectral Data Array Out" <- w2
  $"Error Out" <- w1
