vi "Spectra Operator.gvi"   [LabVIEW NXG 5.0.0]
inputs:
  "Error In": error
  "Full MSpot Multispectral Data": "Full MSpot Multispectral Data.gtype"
  "Spectra Operator control": "Spectra Operator control.gtype" = "Divide Spectra", required
outputs:
  "Error Out": error
  "Operated Data": "Full MSpot Multispectral Data.gtype"
types:
  "MSpot Spectrum Data.gtype" = cluster{"M Spot Spectrum": cluster{"Wavelength": f64[], "Counts": f64[]}, "Blue Motor Position (mm)": f64, "Red Motor Position (mm)": f64, "Dividing Wavelength (nm)": f64}
  "Rainbow Sweep Types.gtype" = enum{"Red Sweep Closing", "Red Sweep Opening", "Blue Sweep Closing", "Blue Sweep Opening"}
  "Full MSpot Multispectral Data.gtype" = cluster{"MSpot Spectrum Data Array": "MSpot Spectrum Data.gtype"[], "Rainbow Sweep Types": "Rainbow Sweep Types.gtype"}
  "Spectra Operator control.gtype" = enum{"Divide Spectra", "Erase Peaks"}
uses:
  NI::Analysis::IntegralDifferentiation::Derivative x(t).gvi
  NI::Analysis::Filtering::Butterworth Bandpass Filter (DBL).gvi
  Rainbow Measurement Setup::Main Functions::One Time Calibrations::MSpot Spectrum::Dividing Wavelength Calculations::Spectra Peak Eraser.gvi
diagram:
  # This SubVI takes the "blank spectrum" of each type of sweep and substracts it to all the spectrums to have a normalized spectrum.
  case ($"Error In") {
    frame Error, Default {
      w1 = $"Error In"
      w2 = $"Full MSpot Multispectral Data"
    }
    frame No Error {
      case ($"Spectra Operator control") {
        frame "Divide Spectra" {
          Property Node(instance in=$"Full MSpot Multispectral Data") -> ("MSpot Spectrum Data Array"=w3, "Rainbow Sweep Types"=w4, instance out=w5)
          case (w4) {
            frame "Red Sweep Opening" {
              Array Size(array=w3) -> (size(s)=w7)
              Decrement(x=w7) -> w8
              Array Index(array=w3) -> (out0[w8]=w6)
            }
            frame "Blue Sweep Opening" {
              Array Size(array=w3) -> (size(s)=w9)
              Decrement(x=w9) -> w10
              Array Index(array=w3) -> (out0[w10]=w6)
            }
            frame "Blue Sweep Closing" {
              Array Index(array=w3) -> (out0[0]=w6)
            }
            frame "Red Sweep Closing", Default {
              Array Index(array=w3) -> (out0[0]=w6)
            }
          }
          for {
            w11 = each element of w3
            Property Node(instance in=w11) -> ("M Spot Spectrum"=w13, instance out=w14)
            Property Node(instance in=w13) -> ("Counts"=w15, "Wavelength"=w16, instance out=w17)
            Property Node(instance in=w6) -> ("M Spot Spectrum"=w18)
            Property Node(instance in=w18) -> ("Counts"=w19)
            Divide(x=w15, y=w19) -> w20
            Property Node(instance in=w17, "Wavelength"=w16, "Counts"=w20) -> (instance out=w21)
            Property Node(instance in=w14, "M Spot Spectrum"=w21) -> (instance out=w22)
            append w22 to w12
          }
          Property Node(instance in=w5, "MSpot Spectrum Data Array"=w12) -> (instance out=w2)
          w1 = $"Error In"
        }
        frame "Erase Peaks", Default {
          Property Node(instance in=$"Full MSpot Multispectral Data") -> ("MSpot Spectrum Data Array"=w23, instance out=w24)
          s1 = $"Error In"  # shift register
          for {
            w25 = each element of w23
            Property Node(instance in=w25) -> ("M Spot Spectrum"=w27, instance out=w28)
            Property Node(instance in=w27) -> ("Wavelength"=w29, "Counts"=w30, instance out=w31)
            call "Derivative x(t).gvi"(x(t)=w30) -> (dx(t)/dt=w32)
            Absolute Value(x=w32) -> w33
            call "Butterworth Bandpass Filter (DBL).gvi"(signal=w33, low cutoff frequency=0.0001, high cutoff frequency=0.04) -> (filtered signal=w34)
            Multiply(w34, 10) -> w35
            In Range And Coerce(lower limit=0, upper limit=1, x=w35) -> (coerced(x)=w36)
            call "Spectra Peak Eraser.gvi"(Wavelength Array=w29, Derivative to erase points=w36, Division Points=w30, Error In=s1) -> (Wavelength Without Peaks=w37, Counts Without Peaks=w38, Error Out=w39)
            Property Node(instance in=w31, "Wavelength"=w37, "Counts"=w38) -> (instance out=w40)
            Property Node(instance in=w28, "M Spot Spectrum"=w40) -> (instance out=w41)
            append w41 to w26
            next s1 = w39
          }
          Property Node(instance in=w24, "MSpot Spectrum Data Array"=w26) -> (instance out=w2)
          w1 = s1
        }
      }
    }
  }
  $"Operated Data" <- w2
  $"Error Out" <- w1
