vi "MSpot Load Prompt.gvi"   [LabVIEW NXG 5.0.0]
inputs:
  "Found Any File?": bool
  "Input": bool
outputs:
  "Output": "MSpot Spectrum Calibration State Machine Instructions.gtype"
types:
  "MSpot Spectrum Calibration State Machine Instructions.gtype" = enum{"Start App", "Detect Instruments", "Initialize Instruments", "Rainbow Sweep", "Close Coms", "Load Calibration", "Check Graphs", "Save Graphs", "Stop App"}
diagram:
  case ($"Found Any File?") {
    frame False, Default {
      Select(s=$Input, t="Detect Instruments", f="Initialize Instruments") -> w2
      w3 = """I could not find any calibration file
on the Extra installers\Calibration_Files\Div_Wav_Spectra\
folder. Do you want to perform a new calibration?"""
      Two Button Dialog(F button name ("Cancel")="Nah, I'm feeling lazy", T button name ("OK")="Okay, let's do it", message=w3) -> (T Button?=w4)
      Select(s=w4, t=w2, f="Stop App") -> w1
    }
    frame True {
      w1 = "Check Graphs"
    }
  }
  $Output <- w1
