vi "MSpot Spectra file handling.gvi"   [LabVIEW NXG 5.0.0]
inputs:
  "Error In": error
  "Full MSpot Multispectral Data Array In": "Full MSpot Multispectral Data.gtype"[]
  "Modify File Operation": "Modify File Operation.gtype" = "Save TXT"
outputs:
  "Error Out": error
  "Full MSpot Multispectral Data Array Out": "Full MSpot Multispectral Data.gtype"[]
  "Found Any File?": bool
types:
  "MSpot Spectrum Data.gtype" = cluster{"M Spot Spectrum": cluster{"Wavelength": f64[], "Counts": f64[]}, "Blue Motor Position (mm)": f64, "Red Motor Position (mm)": f64, "Dividing Wavelength (nm)": f64}
  "Rainbow Sweep Types.gtype" = enum{"Red Sweep Closing", "Red Sweep Opening", "Blue Sweep Closing", "Blue Sweep Opening"}
  "Full MSpot Multispectral Data.gtype" = cluster{"MSpot Spectrum Data Array": "MSpot Spectrum Data.gtype"[], "Rainbow Sweep Types": "Rainbow Sweep Types.gtype"}
  "Modify File Operation.gtype" = enum{"Save TXT", "Load TXT"}
uses:
  Rainbow Measurement Setup::Main Functions::One Time Calibrations::MSpot Spectrum::Dividing Wavelength Calculations::Spectra Operator.gvi
  Rainbow Measurement Setup::Main Functions::One Time Calibrations::MSpot Spectrum::File Handling::MSpot Folder Scan.gvi
  Rainbow Measurement Setup::Main Functions::One Time Calibrations::MSpot Spectrum::File Handling::Folder Scan Sweep type.gvi
  Rainbow Measurement Setup::Main Functions::One Time Calibrations::MSpot Spectrum::File Handling::File number Sorter.gvi
  Rainbow Measurement Setup::Main Functions::One Time Calibrations::MSpot Spectrum::File Handling::MSpot Data Extractor.gvi
  Rainbow Measurement Setup::Main Functions::One Time Calibrations::MSpot Spectrum::File Handling::MSpot Folder Check.gvi
  Rainbow Measurement Setup::Side Functions::Sample Naming::txt Extension adder.gvi
  Rainbow Measurement Setup::Main Functions::Modify TXT file::Modify Measurement TXT File.gvi
diagram:
  # This subVI Handles the Saving of all the MSpot Spectra Calibration Files
  case ($"Error In") {
    frame Error, Default {
      w1 = $"Error In"
      w2 = $"Full MSpot Multispectral Data Array In"
      w3 = default
    }
    frame No Error {
      disable {
        frame Disabled {
          w4 = $"Full MSpot Multispectral Data Array In"
          w5 = $"Error In"
        }
        frame Enabled {
          s1 = $"Error In"  # shift register
          for {
            w6 = each element of $"Full MSpot Multispectral Data Array In"
            call "Spectra Operator.gvi"(Full MSpot Multispectral Data=w6, Error In=s1, Spectra Operator control="Divide Spectra") -> (Operated Data=w7, Error Out=w8)
            call "Spectra Operator.gvi"(Full MSpot Multispectral Data=w7, Error In=w8, Spectra Operator control="Erase Peaks") -> (Operated Data=w9, Error Out=w10)
            append w9 to w4
            next s1 = w10
          }
          w5 = s1
        }
      }
      case ($"Modify File Operation") {
        frame "Load TXT" {
          call "MSpot Folder Scan.gvi"(Error In=w5) -> (Folder Path=w11, Folder Names=w12, Error Out=w13)
          s2 = w13  # shift register
          s3 = "Full MSpot Multispectral Data.gtype"[] []  # shift register
          s4 = 0  # shift register
          for {
            w14 = each element of w12
            call "Folder Scan Sweep type.gvi"(Folder Name In=w14, Error In=s2) -> (Foldername Out=w16, Sweep Type=w17, Is folder sweep type?=w18, Error Out=w19)
            case (w18) {
              frame False, Default {
                w20 = s4
                w21 = s3
                w22 = w19
                w23 = default
              }
              frame True {
                Increment(x=s4) -> w20
                Array Index(array=s3) -> (out0[s4]=w24)
                Build Path(base path=w11, name or relative path=w16) -> (appended path=w25)
                List Folder(error in=w19, path=w25) -> (error out=w26, file names=w27, path out=w28)
                call "File number Sorter.gvi"(Sweep Type=w17, File Names=w27, Error In=w26) -> (Sorted Files Array=w29, Error Out=w30)
                s5 = w30  # shift register
                s6 = "MSpot Spectrum Data.gtype"[] []  # shift register
                s7 = 0  # shift register
                for {
                  w31 = each element of w29
                  Build Path(base path=w28, name or relative path=w31) -> (appended path=w33)
                  Search And Replace String(input string=w31, search string="MSpot_Spectrum_Calibration") -> (number of replacements=w34)
                  Is Not Equal To 0(x=w34) -> w35
                  call "MSpot Data Extractor.gvi"(Filepath to load=w33, Sub Array Index In=s7, M Spot Spectrum Sub Array In=s6, Modify file operation=$"Modify File Operation", Calibration file?=w35, Error In=s5) -> (Sub Array Index Out=w36, M Spot Spectrum Sub Array Out=w37, File Found?=w38, Error Out=w39)
                  append w38 to w32
                  next s5 = w39
                  next s6 = w37
                  next s7 = w36
                }
                Property Node(instance in=w24, "MSpot Spectrum Data Array"=s6, "Rainbow Sweep Types"=w17) -> (instance out=w40)
                Insert Into Array(inArray=s3, new=w40) -> w21
                Or Array Elements(Boolean array=w32) -> (logical OR=w23)
                w22 = s5
              }
            }
            append w23 to w15
            next s2 = w22
            next s3 = w21
            next s4 = w20
          }
          Or Array Elements(Boolean array=w15) -> (logical OR=w3)
          w1 = s2
          w2 = s3
        }
        frame "Save TXT", Default {
          s8 = w5  # shift register
          for {
            w41 = each element of w4
            Property Node(instance in=w41) -> ("MSpot Spectrum Data Array"=w42, "Rainbow Sweep Types"=w43)
            disable {
              frame Disabled { }
              frame Enabled {
                Reverse 1D Array(array=w42) -> (reversed array=w44)
              }
            }
            call "MSpot Folder Check.gvi"(Rainbow Sweep Types=w43, Error In=s8, Create New Folders?=TRUE) -> (Folder Out=w45, Error Out=w46)
            s9 = w46  # shift register
            for (iteration -> i1) {
              w47 = each element of w44
              Property Node(instance in=w47) -> ("M Spot Spectrum"=w48, "Blue Motor Position (mm)"=w49, "Red Motor Position (mm)"=w50)
              Format Into String(w49) -> w51
              Format Into String(w50) -> w52
              Concatenate Strings("Blue Motor Position (mm): ", w51, "\t", "Red Motor Position (mm): ", w52) -> w53
              disable {
                frame Enabled {
                  Number To Decimal String(number=i1, width (-)=3) -> (decimal integer string=w55)
                  Concatenate Strings(w55, "MSpot_Spectrum_Calibration_Position_") -> w54
                }
                frame Disabled {
                  w54 = "MSpot_Spectrum_Calibration_Position_"
                }
              }
              Format Into String(initString=w54, w49) -> w56
              Concatenate Strings(w56, "_") -> w57
              Format Into String(initString=w57, w50) -> w58
              call "txt Extension adder.gvi"(Name without .txt=w58, Error In=s9) -> (Name with .txt=w59, Error Out=w60)
              Property Node(instance in=w48) -> ("Wavelength"=w61, "Counts"=w62)
              Build Array(w61, w62) -> w63
              Transpose 2D Array(2D array=w63) -> (transposed array=w64)
              Build Path(base path=w45, name or relative path=w59) -> (appended path=w65)
              call "Modify Measurement TXT File.gvi"(Filename to load/save=w65, Variable Header Info=w53, Modify File Operation=$"Modify File Operation", Data To Save=w64, Error In=w60, Measurement File Type="Light Calibration Dividing Wavelength Spectrum") -> (Error Out=w66)
              next s9 = w66
            }
            next s8 = s9
          }
          w1 = s8
          w2 = w4
          w3 = default
        }
      }
    }
  }
  $"Full MSpot Multispectral Data Array Out" <- w2
  $"Found Any File?" <- w3
  $"Error Out" <- w1
