vi "MSpot Calibration Operation Translator.gvi"   [LabVIEW NXG 5.0.0]
inputs:
  "Error In": error
  "Check Dividing Wavelength Calibration": bool
  "New Dividing Wavelength Calibration": bool
  "Load Dividing Wavelength Calibration": bool
outputs:
  "Error Out": error
  "Desired Operation": "Calibration Operation Control.gtype"
types:
  "Calibration Operation Control.gtype" = enum{"Check Calibration", "Load Calibration", "New Calibration"}
diagram:
  # This SubVI Checks which button has been pressed and
  # decides the operation that needs to be done.
  # If more than one button was pressed it prompts the user
  # to not press so many buttons at the same time
  case ($"Error In") {
    frame Error, Default {
      w1 = $"Error In"
      w2 = "Check Calibration"
    }
    frame No Error {
      Logical And($"Check Dividing Wavelength Calibration", $"New Dividing Wavelength Calibration") -> w3
      Logical And($"New Dividing Wavelength Calibration", $"Load Dividing Wavelength Calibration") -> w4
      Logical And($"Check Dividing Wavelength Calibration", $"Load Dividing Wavelength Calibration") -> w5
      Logical Or(w3, w4, w5) -> w6
      case (w6) {
        frame False, Default {
          Select(s=$"Load Dividing Wavelength Calibration", t="Load Calibration", f="Check Calibration") -> w7
          Select(s=$"New Dividing Wavelength Calibration", t="New Calibration", f=w7) -> w2
        }
        frame True {
          w8 = "Please do not Press all the buttons\nat once, otherwise I do not know what\nyou want me to do first :("
          w9 = "Oh, sorry I will press them\none by one, while waiting for\nyou to finish."
          One Button Dialog(button name ("OK")=w9, message=w8)
          w2 = "Check Calibration"
        }
      }
      w1 = $"Error In"
    }
  }
  $"Error Out" <- w1
  $"Desired Operation" <- w2
