vi "MSpot Spectrum Rainbow Sweep Subroutine.gvi"   [LabVIEW NXG 5.0.0]
inputs:
  "Instrument Control Mega Cluster In": "Instrument Control Mega Cluster.gtype"
  "MSpot Mega Cluster In": "MSpot Mega Cluster.gtype"
  "Error In": error
outputs:
  "Instrument Control Mega Cluster Out": "Instrument Control Mega Cluster.gtype"
  "MSpot Mega Cluster Out": "MSpot Mega Cluster.gtype"
  "Error Out": error
types:
  "Instrument Coms Info.gtype" = cluster{"Arduino Coms Info": "Arduino Detection cluster control.gtype", "Photodetector Names": string[], "Keythley Address": "VISA Instr", "Photodetector Detected?": bool, "Thorlabs Motors Detected?": bool, "Keithley Detected?": bool, "Thorlabs Motors Serial Number": "Thorlabs Motors Serial Number In.gtype", "Photodetector IVI session": "Ivi IviDefault", "Flame ID": string, "Flame Detected?": bool, "Flame Wrapper ID": u64}
  "Debugging Cluster.gtype" = cluster{"Debugging mode?": bool, "Initialize App": bool, "Insturment Debugging": "Insturment Debugging Cluster.gtype"}
  "Instrument Control Mega Cluster.gtype" = cluster{"Instruments Coms Info": "Instrument Coms Info.gtype", "Debugging Cluster": "Debugging Cluster.gtype"}
  "Raibow Sweep Selector.gtype" = enum{"Red Sweep", "Blue Sweep", "Full Sweep Red First", "Full Sweep Blue First"}
  "Rainbow Sweep Param Selector.gtype" = cluster{"Raibow Sweep Selector": "Raibow Sweep Selector.gtype", "Max Wavelength (nm)": f64, "Min Wavelength (nm)": f64, "Wavelength Step (nm)": f64, "Rainbow Sweep Type Selector": "Rainbow Sweep Type Selector.gtype"}
  "MSpot Spectrum Calibration Parameters.gtype" = cluster{"Min Position (mm)": f64, "Max Position (mm)": f64, "Position step size (mm)": f64, "Manual Spectra?": bool, "Flame Integration Time (us)": f64, "Flame Scans to Average": u32}
  "Rainbow Sweep Types.gtype" = enum{"Red Sweep Closing", "Red Sweep Opening", "Blue Sweep Closing", "Blue Sweep Opening"}
  "Full MSpot Multispectral Data.gtype" = cluster{"MSpot Spectrum Data Array": "MSpot Spectrum Data.gtype"[], "Rainbow Sweep Types": "Rainbow Sweep Types.gtype"}
  "MSpot Mega Cluster.gtype" = cluster{"Rainbow Sweep Parameters MSpot": "Rainbow Sweep Param Selector.gtype", "MSpot Sperctrum Calibration Parameters": "MSpot Spectrum Calibration Parameters.gtype", "Full Beam Multispectral Data Array": "Full MSpot Multispectral Data.gtype"[]}
  "MSpot Spectrum Data.gtype" = cluster{"M Spot Spectrum": cluster{"Wavelength": f64[], "Counts": f64[]}, "Blue Motor Position (mm)": f64, "Red Motor Position (mm)": f64, "Dividing Wavelength (nm)": f64}
uses:
  Rainbow Measurement Setup::Main Functions::One Time Calibrations::MSpot Spectrum::MSpot Step Calculator.gvi
  Rainbow Measurement Setup::Side Functions::Rainbow Sweep::Rainbow Sweep Type Extractor.gvi
  Rainbow Measurement Setup::Side Functions::Instrument Control::Thorlabs Motors::Movement::KCube Initialize and Home.gvi
  Rainbow Measurement Setup::Main Functions::One Time Calibrations::MSpot Spectrum::MSpot parameter Extractor.gvi
  Rainbow Measurement Setup::Side Functions::Global Abort::FGV Global Abort.gvi
  Rainbow Measurement Setup::Side Functions::Instrument Control::Thorlabs Motors::Movement::KCube Motor Single Move to Position.gvi
  Rainbow Measurement Setup::Side Functions::Instrument Control::Flame Spectrometer::Flame Set Scans to Average.gvi
  Rainbow Measurement Setup::Side Functions::Instrument Control::Flame Spectrometer::Flame Set Integration Time.gvi
  Rainbow Measurement Setup::Side Functions::Instrument Control::Flame Spectrometer::Flame Get Spectra.gvi
  Rainbow Measurement Setup::Side Functions::Instrument Control::Thorlabs Motors::Movement::KCube Motors Close.gvi
diagram:
  # This SubVI Performs a scan of the spectrum of the beam and then moves the blade motors to perform a full scan of the spectrum with respect to position.
  case ($"Error In") {
    frame Error, Default {
      w1 = $"Error In"
      w2 = $"Instrument Control Mega Cluster In"
      w3 = $"MSpot Mega Cluster In"
    }
    frame No Error {
      Property Node(instance in=$"MSpot Mega Cluster In", "Full Beam Multispectral Data Array"="Full MSpot Multispectral Data.gtype"[] []) -> ("Rainbow Sweep Parameters MSpot"=w4, "MSpot Sperctrum Calibration Parameters"=w5, instance out=w6)
      call "MSpot Step Calculator.gvi"(MSpot Spectrum Calibration Parameters In=w5) -> (Manual Spectra?=w7, Number of steps=w8)
      call "Rainbow Sweep Type Extractor.gvi"(Rainbow Sweep Parameters=w4, Error In=$"Error In") -> (Rainbow Sweep Array=w9, Error Out=w10)
      s1 = "Full MSpot Multispectral Data.gtype"[] []  # shift register
      s2 = w10  # shift register
      s3 = $"Instrument Control Mega Cluster In"  # shift register
      for (iteration -> i1) {
        w11 = each element of w9
        Array Index(array=s1) -> (out0[i1]=w12)
        case (w11) {
          frame "Red Sweep Opening", Default {
            call "KCube Initialize and Home.gvi"(Instrument Control Mega Cluster In=s3, Error In=s2, KCube Motor Selector="Blue Motor") -> (Instrument Control Mega Cluster Out=w16, Error Out=w17)
            s4 = w17  # shift register
            s5 = "MSpot Spectrum Data.gtype"[] []  # shift register
            s6 = w16  # shift register
            for (N = w8) (iteration -> i2) {
              call "MSpot parameter Extractor.gvi"(Current Step=i2, MSpot Spectrum Calibration Parameters In=w5, Rainbow Sweep Type=w11, Error In=s4) -> (Flame Integration Time=w18, Flame Scans to Average=w19, Motor Position to move to (mm)=w20, Error Out=w21)
              call "FGV Global Abort.gvi"(Global Abort Instructions="Read Current State", Error In=w21) -> (Local Abort Out=w22, Global Abort Out=w23, Error Out=w24)
              call "KCube Motor Single Move to Position.gvi"(Instrument Control Mega Cluster In=s6, Motor Position to move to (mm)=w20, Error In=w24, KCube Motor Selector="Blue Motor") -> (Instrument Control Mega Cluster Out=w25, Error Out=w26)
              case (w7) {
                frame False, Default {
                  call "Flame Set Scans to Average.gvi"(Instrument Control Mega Cluster In=w25, Scans to Average=w19, Error In=w26) -> (Instrument Control Mega Cluster Out=w30, Error Out=w31)
                  call "Flame Set Integration Time.gvi"(Instrument Control Mega Cluster In=w30, Integration Time=w18, Error In=w31) -> (Instrument Control Mega Cluster Out=w32, Error Out=w33)
                  call "Flame Get Spectra.gvi"(Instrument Control Mega Cluster In=w32, Error In=w33) -> (Instrument Control Mega Cluster Out=w29, Beam Spectrum=w27, Error Out=w28)
                }
                frame True {
                  w34 = cluster{"Wavelength": f64[], "Counts": f64[]} {all zero or empty}
                  Wait Until Next Multiple(multiple to wait=300)
                  w35 = "Please Save the spectrum file\non the oceanview software\nbefore continuing."
                  One Button Dialog(button name ("OK")="Okay, I will", message=w35)
                  w27 = w34
                  w28 = w26
                  w29 = w25
                }
              }
              Property Node(instance in="MSpot Spectrum Data.gtype" {all zero or empty}, "M Spot Spectrum"=w27, "Blue Motor Position (mm)"=w20, "Red Motor Position (mm)"=0) -> (instance out=w36)
              Insert Into Array(inArray=s5, index0=i2, new=w36) -> w37
              Logical Or(w22, w23) -> w38
              next s4 = w28
              next s5 = w37
              next s6 = w29
              stop if w38
            }
            Property Node(instance in=w12, "Rainbow Sweep Types"=w11, "MSpot Spectrum Data Array"=s5) -> (instance out=w15)
            call "KCube Motor Single Move to Position.gvi"(Instrument Control Mega Cluster In=s6, Motor Position to move to (mm)=50, Error In=s4, KCube Motor Selector="Blue Motor") -> (Instrument Control Mega Cluster Out=w39, Error Out=w40)
            call "KCube Motors Close.gvi"(Instrument Control Mega Cluster In=w39, Error In=w40) -> (Instrument Control Mega Cluster Out=w13, Error Out=w14)
          }
          frame "Red Sweep Closing" {
            call "KCube Initialize and Home.gvi"(Instrument Control Mega Cluster In=s3, Error In=s2, KCube Motor Selector="Blue Motor") -> (Instrument Control Mega Cluster Out=w41, Error Out=w42)
            s7 = w42  # shift register
            s8 = "MSpot Spectrum Data.gtype"[] []  # shift register
            s9 = w41  # shift register
            for (N = w8) (iteration -> i3) {
              call "MSpot parameter Extractor.gvi"(Current Step=i3, MSpot Spectrum Calibration Parameters In=w5, Rainbow Sweep Type=w11, Error In=s7) -> (Flame Integration Time=w43, Flame Scans to Average=w44, Motor Position to move to (mm)=w45, Error Out=w46)
              call "FGV Global Abort.gvi"(Global Abort Instructions="Read Current State", Error In=w46) -> (Local Abort Out=w47, Global Abort Out=w48, Error Out=w49)
              call "KCube Motor Single Move to Position.gvi"(Instrument Control Mega Cluster In=s9, Motor Position to move to (mm)=w45, Error In=w49, KCube Motor Selector="Blue Motor") -> (Instrument Control Mega Cluster Out=w50, Error Out=w51)
              case (w7) {
                frame False, Default {
                  call "Flame Set Scans to Average.gvi"(Instrument Control Mega Cluster In=w50, Scans to Average=w44, Error In=w51) -> (Instrument Control Mega Cluster Out=w54, Error Out=w55)
                  call "Flame Set Integration Time.gvi"(Instrument Control Mega Cluster In=w54, Integration Time=w43, Error In=w55) -> (Instrument Control Mega Cluster Out=w56, Error Out=w57)
                  call "Flame Get Spectra.gvi"(Instrument Control Mega Cluster In=w56, Error In=w57) -> (Instrument Control Mega Cluster Out=w53, Beam Spectrum=w52, Error Out=w58)
                }
                frame True {
                  w59 = cluster{"Wavelength": f64[], "Counts": f64[]} {all zero or empty}
                  w60 = "Please Save the spectrum file\non the oceanview software\nbefore continuing."
                  One Button Dialog(button name ("OK")="Okay, I will", message=w60)
                  Wait Until Next Multiple(multiple to wait=300)
                  w52 = w59
                  w53 = w50
                }
              }
              Property Node(instance in="MSpot Spectrum Data.gtype" {all zero or empty}, "M Spot Spectrum"=w52, "Blue Motor Position (mm)"=w45, "Red Motor Position (mm)"=0) -> (instance out=w61)
              Insert Into Array(inArray=s8, index0=i3, new=w61) -> w62
              Logical Or(w47, w48) -> w63
              next s7 = w51
              next s8 = w62
              next s9 = w53
              stop if w63
            }
            Property Node(instance in=w12, "Rainbow Sweep Types"=w11, "MSpot Spectrum Data Array"=s8) -> (instance out=w15)
            call "KCube Motor Single Move to Position.gvi"(Instrument Control Mega Cluster In=s9, Motor Position to move to (mm)=50, Error In=s7, KCube Motor Selector="Blue Motor") -> (Instrument Control Mega Cluster Out=w64, Error Out=w65)
            call "KCube Motors Close.gvi"(Instrument Control Mega Cluster In=w64, Error In=w65) -> (Instrument Control Mega Cluster Out=w13, Error Out=w14)
          }
          frame "Blue Sweep Closing" {
            call "KCube Initialize and Home.gvi"(Instrument Control Mega Cluster In=s3, Error In=s2, KCube Motor Selector="Red Motor") -> (Instrument Control Mega Cluster Out=w66, Error Out=w67)
            s10 = w67  # shift register
            s11 = "MSpot Spectrum Data.gtype"[] []  # shift register
            s12 = w66  # shift register
            for (N = w8) (iteration -> i4) {
              call "MSpot parameter Extractor.gvi"(Current Step=i4, MSpot Spectrum Calibration Parameters In=w5, Rainbow Sweep Type=w11, Error In=s10) -> (Flame Integration Time=w68, Flame Scans to Average=w69, Motor Position to move to (mm)=w70, Error Out=w71)
              call "FGV Global Abort.gvi"(Global Abort Instructions="Read Current State", Error In=w71) -> (Local Abort Out=w72, Global Abort Out=w73, Error Out=w74)
              call "KCube Motor Single Move to Position.gvi"(Instrument Control Mega Cluster In=s12, Motor Position to move to (mm)=w70, Error In=w74, KCube Motor Selector="Red Motor") -> (Instrument Control Mega Cluster Out=w75, Error Out=w76)
              case (w7) {
                frame False, Default {
                  call "Flame Set Scans to Average.gvi"(Instrument Control Mega Cluster In=w75, Scans to Average=w69, Error In=w76) -> (Instrument Control Mega Cluster Out=w80, Error Out=w81)
                  call "Flame Set Integration Time.gvi"(Instrument Control Mega Cluster In=w80, Integration Time=w68, Error In=w81) -> (Instrument Control Mega Cluster Out=w82, Error Out=w83)
                  call "Flame Get Spectra.gvi"(Instrument Control Mega Cluster In=w82, Error In=w83) -> (Instrument Control Mega Cluster Out=w79, Beam Spectrum=w77, Error Out=w78)
                }
                frame True {
                  w84 = cluster{"Wavelength": f64[], "Counts": f64[]} {all zero or empty}
                  w85 = "Please Save the spectrum file\non the oceanview software\nbefore continuing."
                  One Button Dialog(button name ("OK")="Okay, I will", message=w85)
                  Wait Until Next Multiple(multiple to wait=300)
                  w77 = w84
                  w78 = w76
                  w79 = w75
                }
              }
              Property Node(instance in="MSpot Spectrum Data.gtype" {all zero or empty}, "M Spot Spectrum"=w77, "Red Motor Position (mm)"=w70, "Blue Motor Position (mm)"=0) -> (instance out=w86)
              Insert Into Array(inArray=s11, index0=i4, new=w86) -> w87
              Logical Or(w72, w73) -> w88
              next s10 = w78
              next s11 = w87
              next s12 = w79
              stop if w88
            }
            Property Node(instance in=w12, "Rainbow Sweep Types"=w11, "MSpot Spectrum Data Array"=s11) -> (instance out=w15)
            call "KCube Motor Single Move to Position.gvi"(Instrument Control Mega Cluster In=s12, Motor Position to move to (mm)=50, Error In=s10, KCube Motor Selector="Red Motor") -> (Instrument Control Mega Cluster Out=w89, Error Out=w90)
            call "KCube Motors Close.gvi"(Instrument Control Mega Cluster In=w89, Error In=w90) -> (Instrument Control Mega Cluster Out=w13, Error Out=w14)
          }
          frame "Blue Sweep Opening" {
            call "KCube Initialize and Home.gvi"(Instrument Control Mega Cluster In=s3, Error In=s2, KCube Motor Selector="Red Motor") -> (Instrument Control Mega Cluster Out=w91, Error Out=w92)
            s13 = w92  # shift register
            s14 = "MSpot Spectrum Data.gtype"[] []  # shift register
            s15 = w91  # shift register
            for (N = w8) (iteration -> i5) {
              call "MSpot parameter Extractor.gvi"(Current Step=i5, MSpot Spectrum Calibration Parameters In=w5, Rainbow Sweep Type=w11, Error In=s13) -> (Flame Integration Time=w93, Flame Scans to Average=w94, Motor Position to move to (mm)=w95, Error Out=w96)
              call "FGV Global Abort.gvi"(Global Abort Instructions="Read Current State", Error In=w96) -> (Local Abort Out=w97, Global Abort Out=w98, Error Out=w99)
              call "KCube Motor Single Move to Position.gvi"(Instrument Control Mega Cluster In=s15, Motor Position to move to (mm)=w95, Error In=w99, KCube Motor Selector="Red Motor") -> (Instrument Control Mega Cluster Out=w100, Error Out=w101)
              case (w7) {
                frame False, Default {
                  call "Flame Set Scans to Average.gvi"(Instrument Control Mega Cluster In=w100, Scans to Average=w94, Error In=w101) -> (Instrument Control Mega Cluster Out=w105, Error Out=w106)
                  call "Flame Set Integration Time.gvi"(Instrument Control Mega Cluster In=w105, Integration Time=w93, Error In=w106) -> (Instrument Control Mega Cluster Out=w107, Error Out=w108)
                  call "Flame Get Spectra.gvi"(Instrument Control Mega Cluster In=w107, Error In=w108) -> (Instrument Control Mega Cluster Out=w104, Beam Spectrum=w102, Error Out=w103)
                }
                frame True {
                  w109 = cluster{"Wavelength": f64[], "Counts": f64[]} {all zero or empty}
                  w110 = "Please Save the spectrum file\non the oceanview software\nbefore continuing."
                  One Button Dialog(button name ("OK")="Okay, I will", message=w110)
                  Wait Until Next Multiple(multiple to wait=300)
                  w102 = w109
                  w103 = w101
                  w104 = w100
                }
              }
              Property Node(instance in="MSpot Spectrum Data.gtype" {all zero or empty}, "M Spot Spectrum"=w102, "Red Motor Position (mm)"=w95, "Blue Motor Position (mm)"=0) -> (instance out=w111)
              Insert Into Array(inArray=s14, index0=i5, new=w111) -> w112
              Logical Or(w97, w98) -> w113
              next s13 = w103
              next s14 = w112
              next s15 = w104
              stop if w113
            }
            Property Node(instance in=w12, "Rainbow Sweep Types"=w11, "MSpot Spectrum Data Array"=s14) -> (instance out=w15)
            call "KCube Motor Single Move to Position.gvi"(Instrument Control Mega Cluster In=s15, Motor Position to move to (mm)=50, Error In=s13, KCube Motor Selector="Red Motor") -> (Instrument Control Mega Cluster Out=w114, Error Out=w115)
            call "KCube Motors Close.gvi"(Instrument Control Mega Cluster In=w114, Error In=w115) -> (Instrument Control Mega Cluster Out=w13, Error Out=w14)
          }
        }
        Insert Into Array(inArray=s1, index0=i1, new=w15) -> w116
        next s1 = w116
        next s2 = w14
        next s3 = w13
      }
      Property Node(instance in=w6, "Full Beam Multispectral Data Array"=s1) -> (instance out=w3)
      w1 = s2
      w2 = s3
    }
  }
  $"MSpot Mega Cluster Out" <- w3
  $"Error Out" <- w1
  $"Instrument Control Mega Cluster Out" <- w2
