vi "MSpot Spectrum Visualizer.gvi"   [LabVIEW NXG 5.0.0]
inputs:
  "Error In": error
  "Full MSpot Multispectral Data Array": "Full MSpot Multispectral Data.gtype"[]
outputs:
  "Error Out": error
panel controls:
  "Sweep Type Selector": i32
  "Graph (position) Selector": i32
  "Continue": bool
  "Div Wavelength Threshold": f64
  "Divide?": bool
  "Smooth Peaks?": bool
panel indicators:
  "Rainbow Sweep Type": "Rainbow Sweep Types.gtype"
  "M Spot Spectrum": cluster{"Element 1": f64[], "Element 2": f64[]}
  "MSpot Spectrum Data": "MSpot Spectrum Data.gtype"
types:
  "Rainbow Sweep Types.gtype" = enum{"Red Sweep Closing", "Red Sweep Opening", "Blue Sweep Closing", "Blue Sweep Opening"}
  "MSpot Spectrum Data.gtype" = cluster{"M Spot Spectrum": cluster{"Wavelength": f64[], "Counts": f64[]}, "Blue Motor Position (mm)": f64, "Red Motor Position (mm)": f64, "Dividing Wavelength (nm)": f64}
  "Full MSpot Multispectral Data.gtype" = cluster{"MSpot Spectrum Data Array": "MSpot Spectrum Data.gtype"[], "Rainbow Sweep Types": "Rainbow Sweep Types.gtype"}
uses:
  Rainbow Measurement Setup::Main Functions::One Time Calibrations::MSpot Spectrum::Dividing Wavelength Calculations::Dividing Wavelength Calculator.gvi
  Rainbow Measurement Setup::Side Functions::Messages And Prompts::General Simple Prompt.gvi
  Rainbow Measurement Setup::Main Functions::One Time Calibrations::MSpot Spectrum::Dividing Wavelength Calculations::Spectra Operator.gvi
diagram:
  Property Node(instance in=reference to unnamed native front panel, error in=$"Error In") -> ("Window"=w1, error out=w2)
  Open Window(reference in=w1, error in=w2) -> (reference out=w3, error out=w4)
  # This subVI allows us to visualize the data obtained on the Measuring Spot Spectrum Calibration subroutine so that we can
  # extract our own conclusions and elaborate the calibration file.
  case (w4) {
    frame Error, Default {
      w5 = w4
      w6 = w3
    }
    frame No Error {
      Is Empty Array(array=$"Full MSpot Multispectral Data Array") -> w7
      case (w7) {
        frame True {
          One Button Dialog(button name ("OK")="Oh, sorry", message="No Calibration Found")
          w5 = w4
        }
        frame False {
          call "Dividing Wavelength Calculator.gvi"(Error In=w4) -> (Error Out=w8)
          s1 = uninitialised  # shift register
          while {
            event (timeout = 50) {
              on "Timeout" {
                Property Node(instance in=s1) -> ("MSpot Spectrum Data Array"=w10, "Rainbow Sweep Types"=w11, instance out=w9)
                Array Index(array=w10) -> (out0[$"Graph (position) Selector"]=w12)
                Property Node(instance in=w12) -> ("M Spot Spectrum"=w13, "Dividing Wavelength (nm)"=w14)
                Property Node(instance in=w13) -> ("Wavelength"=w15, "Counts"=w16)
                Is Empty Array(array=w16) -> w17
                case (w17) {
                  frame True { }
                  frame False {
                    Build Cluster(w15, w16) -> w18
                    $"M Spot Spectrum" <- w18
                  }
                }
                $"MSpot Spectrum Data" <- w12
                Property Node(instance in=reference to "M Spot Spectrum") -> ("Cursor"=w19)
                Property Node(instance in=w19, "XPosition"=w14, "Visible"=TRUE)
                $"Rainbow Sweep Type" <- w11
                Array Size(array=$"Full MSpot Multispectral Data Array") -> (size(s)=w20)
                Decrement(x=w20) -> w21
                Is Equal To 0(x=w21) -> w22
                Not(x=w22) -> w23
                Property Node(instance in=reference to "Sweep Type Selector", "Maximum"=w21, "Minimum"=0, "Visible"=w23) -> (error out=w24)
                Array Size(array=w10) -> (size(s)=w25)
                Decrement(x=w25) -> w26
                Property Node(instance in=reference to "Graph (position) Selector", "Minimum"=0, "Maximum"=w26, error in=w24) -> (error out=w5)
              }
              on "Divide?" Value changed; "Smooth Peaks?" Value changed; "Sweep Type Selector" Value changed {
                call "General Simple Prompt.gvi"(Prompt Message="Please wait for the computation to complete.", Okay Button Message="Okay, I'll wait.", Error In=w8, Prompt?=TRUE) -> (Error Out=w27)
                call "Dividing Wavelength Calculator.gvi"(Full MSpot Multispectral Data Array In=$"Full MSpot Multispectral Data Array", Error In=w27, Dividing Wavelength Threshold=$"Div Wavelength Threshold") -> (Full MSpot Multispectral Data Array Out=w28, Error Out=w29)
                Array Index(array=w28) -> (out0[$"Sweep Type Selector"]=w30)
                case ($"Divide?") {
                  frame False, Default {
                    w31 = w30
                    w32 = w29
                  }
                  frame True {
                    call "Spectra Operator.gvi"(Full MSpot Multispectral Data=w30, Error In=w29, Spectra Operator control="Divide Spectra") -> (Operated Data=w31, Error Out=w32)
                  }
                }
                case ($"Smooth Peaks?") {
                  frame False, Default {
                    w9 = w31
                    w33 = w32
                  }
                  frame True {
                    call "Spectra Operator.gvi"(Full MSpot Multispectral Data=w31, Error In=w32, Spectra Operator control="Smooth Peaks") -> (Operated Data=w9, Error Out=w33)
                  }
                }
                call "General Simple Prompt.gvi"(Prompt Message="Computation Complete, Thanks", Okay Button Message="Oh, thank you. :)", Error In=w33, Prompt?=TRUE) -> (Error Out=w5)
              }
            }
            next s1 = w9
            stop if $Continue
          }
        }
      }
      w6 = w3
    }
  }
  Close Window(reference in=w6, error in=w5) -> (error out=w34)
  $"Error Out" <- w34
