vi "MRM Rainbow Sweep.gvi"   [LabVIEW NXG 5.0.0]
inputs:
  "Error In": error
  "Instrument Control Mega Cluster In": "Instrument Control Mega Cluster.gtype"
  "LPC Mega Cluster In": "LPC Mega Cluster.gtype"
  "MRM Mega Cluster In": "MRM Mega Cluster.gtype" = {"MRM Specific Parameters"={"Max (V)"=1.2, "Min (V)"=-0.5, "V Points"=100, "Curr Range (A)"=0, "Sweep Dir"=FALSE, "Current Avg"=3, "Max (A)"=0.1, "Integration Time"=0.5, "Cell Area (m^2)"=8e-06, "Autorange"=TRUE, "Full Spctr Ref"=TRUE}, "Cell Selector"={FALSE, FALSE, FALSE, FALSE, FALSE, FALSE, FALSE, FALSE, FALSE, FALSE, FALSE, FALSE, FALSE, FALSE, FALSE, FALSE, FALSE, FALSE, FALSE, FALSE, FALSE, FALSE, FALSE, FALSE, FALSE, FALSE, FALSE, FALSE}, "Cells to Measure Array"=[], "Rainbow Sweep Parameters MRM"={0, 900, 400, 1, 1, 0}, "MRM Data Array"=[]}
outputs:
  "Error Out": error
  "Instrument Control Mega Cluster Out": "Instrument Control Mega Cluster.gtype"
  "MRM Mega Cluster Out": "MRM Mega Cluster.gtype"
types:
  "Instrument Coms Info.gtype" = cluster{"Arduino Coms Info": "Arduino Detection cluster control.gtype", "Photodetector Names": string[], "Keythley Address": "VISA Instr", "Photodetector Detected?": bool, "Thorlabs Motors Detected?": bool, "Keithley Detected?": bool, "Thorlabs Motors Serial Number": "Thorlabs Motors Serial Number In.gtype", "Photodetector IVI session": "Ivi IviDefault", "Flame ID": string, "Flame Detected?": bool, "Flame Wrapper ID": u64}
  "Debugging Cluster.gtype" = cluster{"Debugging mode?": bool, "Initialize App": bool, "Insturment Debugging": "Insturment Debugging Cluster.gtype"}
  "Instrument Control Mega Cluster.gtype" = cluster{"Instruments Coms Info": "Instrument Coms Info.gtype", "Debugging Cluster": "Debugging Cluster.gtype"}
  "Raibow Sweep Selector.gtype" = enum{"Red Sweep", "Blue Sweep", "Full Sweep Red First", "Full Sweep Blue First"}
  "Rainbow Sweep Param Selector.gtype" = cluster{"Raibow Sweep Selector": "Raibow Sweep Selector.gtype", "Max Wavelength (nm)": f64, "Min Wavelength (nm)": f64, "Wavelength Step (nm)": f64, "Rainbow Sweep Type Selector": "Rainbow Sweep Type Selector.gtype"}
  "Light power Calibration Parameters.gtype" = cluster{"Powermeter Averages": u32, "Photodtctr Area (m^2)": f64, "Only Full Spectrum": bool}
  T1 = cluster{"Dividing Wavelength Array": f64[], "Measured Power Array": f64[], "Power Density Array": f64[]}
  "Rainbow Sweep Types.gtype" = enum{"Red Sweep Closing", "Red Sweep Opening", "Blue Sweep Closing", "Blue Sweep Opening"}
  "Light Power Calibration Data.gtype" = cluster{"Single Light Calibration": T1, "Rainbow Sweep Types": "Rainbow Sweep Types.gtype", "Total Light Power Density (W/m^2)": f64}
  "LPC Mega Cluster.gtype" = cluster{"Rainbow Sweep Parameters LPC": "Rainbow Sweep Param Selector.gtype", "LPC Specific Parameters": "Light power Calibration Parameters.gtype", "Light Power Calibration Data": "Light Power Calibration Data.gtype"[]}
  "MRM Specific Parameters.gtype" = cluster{"Max (V)": f64, "Min (V)": f64, "V Points": u32, "Curr Range (A)": f64, "Sweep Dir": bool, "Current Avg": u32, "Max (A)": f64, "Integration Time": f64, "Cell Area (m^2)": f64, "Autorange": bool, "Full Spctr Ref": bool}
  T2 = cluster{"L.01": bool, "R.01": bool, "L.02": bool, "R.02": bool, "L.03": bool, "R.03": bool, "L.04": bool, "R.04": bool, "L.05": bool, "R.05": bool, "L.06": bool, "R.06": bool, "L.07": bool, "R.07": bool, "L.08": bool, "R.08": bool, "L.09": bool, "R.09": bool, "L.10": bool, "R.10": bool, "L.11": bool, "R.11": bool, "L.12": bool, "R.12": bool}
  "MRM Cell Selector.gtype" = cluster{"All": bool, "Left": bool, "Right": bool, "Cell Cluster": T2, "Reset": bool}
  "XZ Stage Cell.gtype" = enum{"L.01", "L.02", "L.03", "L.04", "L.05", "L.06", "L.07", "L.08", "L.09", "L.10", "L.11", "L.12", "R.01", "R.02", "R.03", "R.04", "R.05", "R.06", "R.07", "R.08", "R.09", "R.10", "R.11", "R.12"}
  "Selected Cells Array.gtype" = "XZ Stage Cell.gtype"[]
  T3 = enum{"L.01", "L.02", "L.03", "L.04", "L.05", "L.06", "L.07", "L.08", "L.09", "L.10", "L.11", "L.12", "R.01", "R.02", "R.03", "R.04", "R.05", "R.06", "R.07", "R.08", "R.09", "R.10", "R.11", "R.12"}
  "MRM Full Data From SRM Cluster.gtype" = cluster{"SRM Mega Cluster": "SRM Mega Cluster.gtype", "Cell Label": T3}
  "MRM Mega Cluster.gtype" = cluster{"MRM Specific Parameters": "MRM Specific Parameters.gtype", "Cell Selector": "MRM Cell Selector.gtype", "Cells to Measure Array": "Selected Cells Array.gtype", "Rainbow Sweep Parameters MRM": "Rainbow Sweep Param Selector.gtype", "MRM Data Array": "MRM Full Data From SRM Cluster.gtype"[]}
  "IV Single Measurement.gtype" = cluster{"Voltage (V)": f64[], "Current (A)": f64[], "Current Density (A/m^2)": f64[], "Dividing Wavelength (nm)": f64, "Light Power Density (W/m^2)": f64, "Total Light Power Density (W/m^2)": f64}
  "IV Full Raw Data.gtype" = cluster{"Rainbow Sweep Types": "Rainbow Sweep Types.gtype", "IV Raw Data Array": "IV Single Measurement.gtype"[]}
  "SRM Sweep Live Parameters.gtype" = cluster{"Current Wavelength (nm)": f64, "Rainbow Sweep Types": "Rainbow Sweep Types.gtype", "Finished Measurement?": bool}
  "SRM Single Plot Cluster.gtype" = cluster{"Voltage (V)": f64[], "Current Density (A/m^2)": f64[]}
  "SRM Sweep Live Parameters FGV Cluster.gtype" = cluster{"IV Single Measurement Array": "IV Single Measurement.gtype"[], "SRM Sweep type combo box selction": string, "IV Single Measurement Plot Array": "SRM Single Plot Cluster.gtype"[], "SRM Live Parameters": "SRM Sweep Live Parameters.gtype", "Counter": i32, "Full IV Data Array": "IV Full Raw Data.gtype"[], "Combobox Reference": "ComboBoxSelector reference", "Refresh now": bool, "Graph Reference": "Graph reference"}
uses:
  Rainbow Measurement Setup::Side Functions::Messages And Prompts::FGV Cancel Prompts until Finished Routine.gvi
  Rainbow Measurement Setup::Side Functions::Rainbow Sweep::Rainbow Sweep Param Generator.gvi
  Rainbow Measurement Setup::Side Functions::Instrument Control::Keithley::Keithley Set Constant Parameters.gvi
  Rainbow Measurement Setup::Side Functions::Instrument Control::Thorlabs Motors::Dividing Wavelength Control::Dividing Wavelength Calibration Data FGV.gvi
  Rainbow Measurement Setup::Main Functions::Rainbow Measurement::Cell Single Rainbow Measurement::SRM Extract Correct Calibration Data.gvi
  Rainbow Measurement Setup::Side Functions::Global Abort::FGV Global Abort.gvi
  Rainbow Measurement Setup::Side Functions::Instrument Control::Thorlabs Motors::Dividing Wavelength Control::KCube Dividing Wavelength Translator.gvi
  Rainbow Measurement Setup::Main Functions::Rainbow Measurement::Cell Single Rainbow Measurement::SRM Extract Measured Power.gvi
  Rainbow Measurement Setup::Side Functions::Instrument Control::Keithley::Keithley Sweep Subroutine.gvi
  Rainbow Measurement Setup::Main Functions::Rainbow Measurement::Cell Single Rainbow Measurement::IV Calculations::IV to IJV Data.gvi
  Rainbow Measurement Setup::Main Functions::Rainbow Measurement::Cell Single Rainbow Measurement::SRM Live Parameters::SRM Sweep Live Parameters FGV.gvi
  Rainbow Measurement Setup::Side Functions::Utilities::Progress Handling::Progress General Calculator.gvi
  Rainbow Measurement Setup::Side Functions::Utilities::Progress Handling::Progress FGV.gvi
  Rainbow Measurement Setup::Side Functions::Instrument Control::Thorlabs Motors::Movement::KCube Move to 0 or Home.gvi
diagram:
  # This SubVI Takes the specified Parameters both for the sweep types and for the keithley electrical sweep and performs all the measurements while storing them on their
  # corresponding clusters, before outputing all the information within the Full IV Curve Data array.
  case ($"Error In") {
    frame Error, Default {
      w1 = $"Error In"
      w2 = $"Instrument Control Mega Cluster In"
      w3 = $"MRM Mega Cluster In"
    }
    frame No Error {
      Property Node(instance in=$"MRM Mega Cluster In") -> ("MRM Data Array"=w4, instance out=w5)
      s1 = $"Instrument Control Mega Cluster In"  # shift register
      s2 = $"Error In"  # shift register
      for {
        w6 = each element of w4
        Property Node(instance in=w6) -> ("SRM Mega Cluster:Rainbow Sweep Parameters SRM"=w8, "SRM Mega Cluster"=w9, instance out=w10)
        call "FGV Cancel Prompts until Finished Routine.gvi"(Error In=s2, FGV Instructions="Reset State") -> (Error Out=w11)
        call "Rainbow Sweep Param Generator.gvi"(Rainbow Sweep Parameters=w8, Error In=w11) -> (Rainbow Sweep Parameters Array=w12, Error Out=w13)
        call "Keithley Set Constant Parameters.gvi"(Instrument Control Mega Cluster In=s1, SRM Mega Cluster In=w9, Error In=w13) -> (Instrument Control Mega Cluster Out=w14, SRM Mega Cluster Out=w15, Error Out=w16)
        call "Dividing Wavelength Calibration Data FGV.gvi"(Div Wavelength FGV Instructions="Read Loaded Data", Error In=w16) -> (Dividing Wavelength Calibration Data Out=w17, Error Out=w18)
        s3 = w18  # shift register
        s4 = w14  # shift register
        s5 = "IV Full Raw Data.gtype"[] []  # shift register
        s6 = 0  # shift register
        s7 = w15  # shift register
        for (N -> w19) (iteration -> i1) {
          w20 = each element of w12
          Property Node(instance in=w20) -> ("Dividing Wavelength Array"=w21, "Rainbow Sweep Types"=w22)
          call "SRM Extract Correct Calibration Data.gvi"(LPC Mega Cluster In=$"LPC Mega Cluster In", Rainbow Sweep Type=w22, Error In=s3) -> (Extracted Light Power Calibration Data=w23, Error Out=w24)
          s8 = w24  # shift register
          s9 = s4  # shift register
          s10 = "IV Single Measurement.gtype"[] []  # shift register
          s11 = s6  # shift register
          s12 = s7  # shift register
          for (N -> w25) (iteration -> i2) {
            w26 = each element of w21
            Multiply(w25, w19) -> w27
            call "FGV Global Abort.gvi"(Global Abort Instructions="Read Current State", Error In=s8) -> (Local Abort Out=w28, Global Abort Out=w29, Error Out=w30)
            call "KCube Dividing Wavelength Translator.gvi"(Dividing Wavelength=w26, Instrument Control Mega Cluster In=s9, Dividing Wavelength Calibration Data In=w17, Error In=w30, Rainbow Sweep Types=w22) -> (Instrument Control Mega Cluster Out=w31, Error Out=w32)
            call "SRM Extract Measured Power.gvi"(Dividing Wavelength In=w26, Light Power Calibration Data In=w23, SRM Mega Cluster In=s12, Error In=w32) -> (IV Single Measurement Out=w33, Error Out=w34)
            call "Keithley Sweep Subroutine.gvi"(Instrument Control Mega Cluster In=w31, SRM Mega Cluster In=s12, IV Single Measurement In=w33, Error In=w34) -> (Instrument Control Mega Cluster Out=w35, SRM Mega Cluster Out=w36, IV Single Measurement Out=w37, Error Out=w38)
            call "IV to IJV Data.gvi"(SRM Mega Cluster In=w36, IV Single Measurement In=w37, Error In=w38) -> (SRM Mega Cluster Out=w39, IV Single Measurement Out=w40, Error Out=w41)
            w42 = "SRM Sweep Live Parameters.gtype" {"Current Wavelength (nm)"=0, "Rainbow Sweep Types"="Red Sweep Closing", "Finished Measurement?"=TRUE}
            Property Node(instance in=w42, "Current Wavelength (nm)"=w26, "Rainbow Sweep Types"=w22, "Finished Measurement?"=FALSE) -> (instance out=w43)
            Insert Into Array(inArray=s10, index0=i2, new=w40) -> w44
            w45 = "SRM Sweep Live Parameters FGV Cluster.gtype" {all zero or empty}
            Property Node(instance in=w45, "IV Single Measurement Array"=w44, "SRM Live Parameters"=w43) -> (instance out=w46)
            call "SRM Sweep Live Parameters FGV.gvi"(FGV Instructions="Set State", SRM sweep live parameters FGV Cluster In=w46, Error In=w41) -> (Error Out=w47)
            call "Progress General Calculator.gvi"(Starting Value=40, Ending Value=80, Number Of Steps=w27, Current Step=s11, Error In=w47) -> (Current Progress=w48, Error Out=w49)
            call "Progress FGV.gvi"(FGV Instructions="Set State", Progress In=w48, Error In=w49) -> (Error Out=w50)
            Increment(x=s11) -> w51
            Logical Or(w28, w29) -> w52
            Wait Until Next Multiple(multiple to wait=10)
            next s8 = w50
            next s9 = w35
            next s10 = w44
            next s11 = w51
            next s12 = w39
            stop if w52
          }
          Property Node(instance in="IV Full Raw Data.gtype" {all zero or empty}, "IV Raw Data Array"=s10, "Rainbow Sweep Types"=w22) -> (instance out=w53)
          Insert Into Array(inArray=s5, index0=i1, new=w53) -> w54
          w55 = "SRM Sweep Live Parameters FGV Cluster.gtype" {all zero or empty}
          Property Node(instance in=w55, "Full IV Data Array"=w54, "Refresh now"=TRUE) -> (instance out=w56)
          call "SRM Sweep Live Parameters FGV.gvi"(FGV Instructions="Set State", SRM sweep live parameters FGV Cluster In=w56, Error In=s8) -> (Error Out=w57)
          call "KCube Move to 0 or Home.gvi"(Instrument Control Mega Cluster In=s9, Error In=w57) -> (Instrument Control Mega Cluster Out=w58, Error Out=w59)
          next s3 = w59
          next s4 = w58
          next s5 = w54
          next s6 = s11
          next s7 = s12
          stop if w52
        }
        Property Node(instance in=s7, "Full IV Curve Raw Data"=s5) -> (instance out=w60)
        Property Node(instance in=w10, "SRM Mega Cluster"=w60) -> (instance out=w61)
        w62 = "SRM Sweep Live Parameters FGV Cluster.gtype" {"SRM Live Parameters"={"Current Wavelength (nm)"=-1, "Rainbow Sweep Types"="Red Sweep Closing", "Finished Measurement?"=TRUE}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}
        call "SRM Sweep Live Parameters FGV.gvi"(FGV Instructions="Set State", SRM sweep live parameters FGV Cluster In=w62, Error In=s3) -> (Error Out=w63)
        call "KCube Move to 0 or Home.gvi"(Instrument Control Mega Cluster In=s4, Error In=w63) -> (Instrument Control Mega Cluster Out=w64, Error Out=w65)
        append w61 to w7
        next s1 = w64
        next s2 = w65
      }
      Property Node(instance in=w5, "MRM Data Array"=w7) -> (instance out=w3)
      w1 = s2
      w2 = s1
    }
  }
  $"MRM Mega Cluster Out" <- w3
  $"Instrument Control Mega Cluster Out" <- w2
  $"Error Out" <- w1
