vi "Single Rainbow Measurement Subroutine.gvi"   [LabVIEW NXG 5.0.0]
panel controls:
  "Error In": error
  "Stand Alone?": bool
  "Debugging Cluster In": "Debugging Cluster.gtype"
  "Instrument Coms Info In": "Instrument Coms Info.gtype"
  "Default Data Saving Location": path
  "Cell Naming Cluster": "Cell Naming Cluster.gtype"
  "SRM Operation Control": "SRM Operation Control.gtype" = "New Measurement"
  "Light Power Calibration Data": "Light Power Calibration Data.gtype"[]
  "Rainbow Sweep Param Selector": "Rainbow Sweep Param Selector.gtype" = {0, 1100, 300, 1, 1, 0}
panel indicators:
  "Instuments Coms Info Out": "Instrument Coms Info.gtype"
  "Debugging Cluster Out": "Debugging Cluster.gtype"
  "Error Out": error
types:
  "Insturment Debugging Cluster.gtype" = cluster{"Keithley": bool, "Arduinos": bool, "Thorlabs Motors": bool, "Photodetector": bool, "Flame Spectr": bool}
  "Debugging Cluster.gtype" = cluster{"Debugging mode?": bool, "Initialize App": bool, "Insturment Debugging": "Insturment Debugging Cluster.gtype"}
  T1 = cluster{"Element 1": "VISA Instr", "Element 2": string}
  "Arduino Detection cluster control.gtype" = cluster{"XZ Stage Arduino Address": "VISA Instr", "XZ Stage Arduino Detected?": bool, "Multiplexer Arduino Detected?": bool, "Multiplexer Arduino Address": "VISA Instr", "Arduinos List": T1[], "XZ Stage Log": string, "Multiplexer Log": string}
  "Thorlabs Motors Serial Number In.gtype" = cluster{"Thorlabs Blue Motor": string, "Thorlabs Red Motor": string, "Blue Motor Homed?": bool, "Red Motor Homed?": bool}
  "Instrument Coms Info.gtype" = cluster{"Arduino Coms Info": "Arduino Detection cluster control.gtype", "Photodetector Names": string[], "Keythley Address": "VISA Instr", "Photodetector Detected?": bool, "Thorlabs Motors Detected?": bool, "Keithley Detected?": bool, "Thorlabs Motors Serial Number": "Thorlabs Motors Serial Number In.gtype", "Photodetector IVI session": "Ivi IviDefault", "Flame ID": string, "Flame Detected?": bool, "Flame Wrapper ID": u64}
  "Cell Naming Cluster.gtype" = cluster{"Cell Label": string, "Sample Prefix": string, "Author Initials": string, "Current Date": string, "Batch Name": string}
  "SRM Operation Control.gtype" = enum{"New Measurement", "Load Measurement", "Save Measurement"}
  T2 = cluster{"Dividing Wavelength Array": f64[], "Measured Power Array": f64[]}
  "Rainbow Sweep Types.gtype" = enum{"Red Sweep Closing", "Red Sweep Opening", "Blue Sweep Closing", "Blue Sweep Opening"}
  "Light Power Calibration Data.gtype" = cluster{"Single Light Calibration": T2, "Rainbow Sweep Types": "Rainbow Sweep Types.gtype"}
  "Raibow Sweep Selector.gtype" = enum{"Red Sweep", "Blue Sweep", "Full Sweep Red First", "Full Sweep Blue First"}
  T3 = enum{"Red Sweep Closing", "Red Sweep Opening", "Red Sweep Both Ways"}
  T4 = enum{"Blue Sweep Opening", "Blue Sweep Closing", "Blue Sweep Both Ways"}
  "Rainbow Sweep Type Selector.gtype" = cluster{"Red Sweep Mode": T3, "Blue Sweep Mode": T4}
  "Rainbow Sweep Param Selector.gtype" = cluster{"Raibow Sweep Selector": "Raibow Sweep Selector.gtype", "Max Wavelength (nm)": f64, "Min Wavelength (nm)": f64, "Wavelength Step (nm)": f64, "Rainbow Sweep Type Selector": "Rainbow Sweep Type Selector.gtype"}
uses:
  Rainbow Measurement Setup::Main Functions::Instruction Queue::Current State::FGV Current State.gvi
  Rainbow Measurement Setup::Side Functions::Global Abort::FGV Global Abort.gvi
  Rainbow Measurement Setup::Main Functions::Rainbow Measurement::Cell Rainbow Single Measurement::SRM Start Calculator.gvi
  Rainbow Measurement Setup::Side Functions::Instrument Control::Thorlabs Motors::Dividing Wavelength Control::Dividing Wavelength Calibration Data FGV.gvi
  Rainbow Measurement Setup::Side Functions::Instrument Control::Debug Cluster Instrument Extractor.gvi
  Rainbow Measurement Setup::Main Functions::One Time Calibrations::Beam Power Density::Specific Detect Instruments Subroutine.gvi
  Rainbow Measurement Setup::Side Functions::Instrument Control::Thorlabs Motors::Movement::KCube Move to 0 or Home.gvi
  Rainbow Measurement Setup::Side Functions::Instrument Control::Arduino::XZ Stage Arduino::XZ Stage Initialize And Home.gvi
  Rainbow Measurement Setup::Side Functions::Instrument Control::Keithley::Keithley Initialize Subroutine.gvi
  Rainbow Measurement Setup::Side Functions::Instrument Control::Arduino::XZ Stage Arduino::XZ Stage Close Coms.gvi
  Rainbow Measurement Setup::Side Functions::Instrument Control::Thorlabs Motors::Movement::KCube Motors Close.gvi
  Rainbow Measurement Setup::Side Functions::Instrument Control::Keithley::Keithley Close Subroutine.gvi
  Rainbow Measurement Setup::Main Functions::Rainbow Measurement::Cell Rainbow Single Measurement::File Handling::Single Measurement Save Graphs Prompt.gvi
  Rainbow Measurement Setup::Main Functions::Rainbow Measurement::Cell Rainbow Single Measurement::File Handling::Single Measurement Load Prompt.gvi
  Rainbow Measurement Setup::Side Functions::Messages And Prompts::General Simple Prompt.gvi
  Rainbow Measurement Setup::Side Functions::Utilities::Progress Handling::Progress FGV.gvi
diagram:
  w1 = $"Light Power Calibration Data"
  w2 = $"Cell Naming Cluster"
  w3 = $"Rainbow Sweep Param Selector"
  w4 = $"Default Data Saving Location"
  w5 = $"SRM Operation Control"
  w6 = $"Stand Alone?"
  # This SubVI Measures the Light power for each motor position for each sweep type and outputs the data so that it can be plotted
  # on the main window for checking and for calibration purposes
  case ($"Error In") {
    frame Error, Default {
      w7 = $"Error In"
      w8 = $"Instrument Coms Info In"
      w9 = $"Debugging Cluster In"
    }
    frame No Error {
      call "FGV Current State.gvi"(Current State Instructions="Set Current State and Substate", Current State="Rainbow Single Measurement", Current Substate="", Error In=$"Error In") -> (Error Out=w10)
      s1 = w10  # shift register
      s2 = "Start App"  # shift register
      s3 = $"Debugging Cluster In"  # shift register
      s4 = $"Instrument Coms Info In"  # shift register
      while (after w4) (after w2) (after w3) {
        call "FGV Global Abort.gvi"(Global Abort Instructions="Read Current State", Error In=s1) -> (Local Abort Out=w11, Global Abort Out=w12, Error Out=w13)
        Select(s=w11, t="Close Coms", f=s2) -> w14
        case (w14) {
          frame "Start App", Default {
            call "FGV Current State.gvi"(Current State Instructions="Set Current Substate", Current Substate="Starting Light Power Calibration", Error In=w13) -> (Error Out=w15)
            w16 = "Load Light Power Calibration"
            w17 = default
            w18 = _
            w19 = _
          }
          frame "Load Light Power Calibration" {
            call "SRM Start Calculator.gvi"(SRM Operation Control=w5, Stand Alone?=w6) -> (Desired State=w16)
            w15 = _
            w17 = default
            w18 = _
            w19 = _
          }
          frame "Detect Instruments" {
            call "FGV Current State.gvi"(Current State Instructions="Set Current Substate", Current Substate="Detecting Instruments", Error In=w13) -> (Error Out=w20)
            call "Dividing Wavelength Calibration Data FGV.gvi"(General FGV Instructions="Set State", Error In=w20) -> (Error Out=w21)
            call "Debug Cluster Instrument Extractor.gvi"(Debugging Cluster In=s3, Error In=w21) -> (Debuging Cluster Out=w18, Instruments to Detect=w22, Error Out=w23)
            call "Specific Detect Instruments Subroutine.gvi"(Instrument Coms Info In=s4, Error In=w23, Instruments To Detect Array=w22) -> (Instrument Coms Info Out=w19, Error Out=w15)
            w16 = "Initialize Instruments"
            w17 = default
          }
          frame "Initialize Instruments" {
            call "FGV Current State.gvi"(Current State Instructions="Set Current Substate", Current Substate="Initializing Instruments", Error In=w13) -> (Error Out=w24)
            call "KCube Move to 0 or Home.gvi"(Instrument Coms Info In=s4, Debugging Cluster In=s3, Error In=w24) -> (Instrument Coms Info Out=w25, Debugging Cluster Out=w26, Error Out=w27)
            call "XZ Stage Initialize And Home.gvi"(Instrument Coms Info In=w25, Debugging Cluster In=w26, Error In=w27) -> (Instrument Coms Info Out=w28, Debugging Cluster Out=w29, Error Out=w30)
            call "Keithley Initialize Subroutine.gvi"(Instrument Coms Info In=w28, Debugging Cluster In=w29, Error In=w30) -> (Instrument Coms Info Out=w19, Debugging Cluster Out=w18, Error Out=w15)
            w16 = "Rainbow Sweep"
            w17 = default
          }
          frame "Rainbow Sweep" {
            call "FGV Current State.gvi"(Current State Instructions="Set Current Substate", Current Substate="Acquiring Spectra", Error In=w13) -> (Error Out=w15)
            w16 = _
            w17 = default
            w18 = _
            w19 = _
          }
          frame "Close Coms" {
            call "FGV Current State.gvi"(Current State Instructions="Set Current Substate", Current Substate="Closing Coms", Error In=w13) -> (Error Out=w31)
            call "XZ Stage Close Coms.gvi"(Instrument Coms Info In=s4, Error In=w31) -> (Instrument Coms Info Out=w32, Error Out=w33)
            call "KCube Motors Close.gvi"(Instrument Coms Info In=w32, Error In=w33) -> (Instrument Coms Info Out=w34, Error Out=w35)
            call "Keithley Close Subroutine.gvi"(Instrument Coms Info In=w34, Debugging Cluster In=s3, Error In=w35) -> (Instrument Coms Info Out=w19, Debugging Cluster Out=w18, Error Out=w36)
            call "Single Measurement Save Graphs Prompt.gvi"(Error In=w36) -> (Desired State=w37, Error Out=w15)
            Select(s=w11, t="Stop App", f=w37) -> w16
            w17 = default
          }
          frame "Load Measurement" {
            call "FGV Current State.gvi"(Current State Instructions="Set Current Substate", Current Substate="Loading Calibration", Error In=w13) -> (Error Out=w38)
            call "Single Measurement Load Prompt.gvi"(Error In=w38) -> (Error Out=w15)
            w16 = _
            w17 = default
            w18 = s3
            w19 = s4
          }
          frame "Save Graphs" {
            call "FGV Current State.gvi"(Current State Instructions="Set Current Substate", Current Substate="Saving Graphs", Error In=w13) -> (Error Out=w39)
            w40 = "Your Measurement Files Have been saved\npropperly on your personal data folder."
            call "General Simple Prompt.gvi"(Prompt Message=w40, Okay Button Message="Perfect Thanks :)", Error In=w39, Prompt?=TRUE) -> (Error Out=w15)
            w16 = "Stop App"
            w17 = default
            w18 = s3
            w19 = s4
          }
          frame "Stop App" {
            call "FGV Current State.gvi"(Current State Instructions="Set Current Substate", Current Substate="Stopping Apps", Error In=w13) -> (Error Out=w15)
            w16 = "Start App"
            w17 = TRUE
            w18 = s3
            w19 = s4
          }
        }
        call "Progress FGV.gvi"(FGV Instructions="Set State", Progress In=0, Error In=w15) -> (Error Out=w41)
        Logical Or(w12, w41, w17) -> w42
        next s1 = w41
        next s2 = w16
        next s3 = w18
        next s4 = w19
        stop if w42
      }
      w7 = s1
      w8 = s4
      w9 = s3
    }
  }
  $"Instuments Coms Info Out" <- w8
  $"Debugging Cluster Out" <- w9
  $"Error Out" <- w7
