vi "SRM Header Info Extractor.gvi"   [LabVIEW NXG 5.0.0]
inputs:
  "Error In": error
  "Header Data": string
outputs:
  "Error Out": error
  "Dividing Wavelength": f64
  "Light Power Density": f64
diagram:
  # Ths SubVI Takes the header of a single Raw IV Curve and
  # extracts the dividing wavelength and the Light power measured
  # at that dividing wavelength
  case ($"Error In") {
    frame Error, Default {
      w1 = $"Error In"
      w2 = default
      w3 = default
    }
    frame No Error {
      Search Or Split String(search string/char="Dividing Wavelength (nm) = ", string=$"Header Data") -> (match + rest of string=w4)
      Search And Replace String(error in (no error)=$"Error In", input string=w4, replace string ("")="", search string="Dividing Wavelength (nm) = ") -> (error out=w5, result string=w6)
      Floating Point String To Number(string=w6, use system decimal point (T)=FALSE) -> (number=w3)
      Search Or Split String(search string/char="Light Power (W) = ", string=$"Header Data") -> (match + rest of string=w7)
      Search And Replace String(error in (no error)=w5, input string=w7, replace string ("")="", search string="Light Power Density (W/m^2) =") -> (error out=w1, result string=w8)
      Floating Point String To Number(string=w8, use system decimal point (T)=FALSE) -> (number=w2)
    }
  }
  $"Dividing Wavelength" <- w3
  $"Light Power Density" <- w2
  $"Error Out" <- w1
