vi "SRM file handling.gvi"   [LabVIEW NXG 5.0.0]
inputs:
  "Error In": error
  "Misc Data Mega Cluster In": "Misc Data Mega Cluster.gtype"
  "SRM Mega Cluster In": "SRM Mega Cluster.gtype"
  "Modify File Operation": "Modify File Operation.gtype" = "Save TXT"
outputs:
  "Error Out": error
  "SRM Mega Cluster Out": "SRM Mega Cluster.gtype"
  "Boolean Handler Out": "SRM Load Boolean Handler.gtype"
  "Loaded Files": string[]
panel indicators:
  "Misc Data Mega Cluster Out": "Misc Data Mega Cluster.gtype"
types:
  "Modify File Operation.gtype" = enum{"Save TXT", "Load TXT"}
  "SRM Load Boolean Handler.gtype" = cluster{"Canceled Loading?": bool, "Found Any Folder?": bool, "Found Files Within all Folders?": bool, "Duplicate Measurement Files?": bool}
  "Full Reference Cluster.gtype" = cluster{"Enum Reference Cluster": "Enum Control Reference Cluster.gtype", "Boolean Reference Cluster": "Boolean Control Reference Cluster.gtype", "Numeric Reference Cluster": "Numeric Control Reference Cluster.gtype", "Numeric Cluster Reference Cluster": "Numeric Cluster Reference Cluster.gtype", "Path Reference Cluster": "Path Reference Cluster.gtype", "Cluster Reference Cluster": "Cluster Reference Cluster.gtype", "XZ Stage Controls Reference Cluster": "XZ Stage Controls Reference Cluster.gtype"}
  "Cell Naming Cluster.gtype" = cluster{"Cell Label": string, "Sample Prefix": string, "Author Initials": string, "Current Date": string, "Batch Name": string}
  T1 = cluster{"X Coordinate (mm)": f64, "Z Coordinate (mm)": f64}
  T2 = cluster{"X Coordinate (mm)": f64, "Z Coordinate (mm)": f64, "Vertical Spacing (mm)": f64}
  "XZ All Position Cluster.gtype" = cluster{"Diffusor Coordinates": T1, "Photodetector Coordinates": T1, "Cell R.01 Coordinates": T2}
  T3 = cluster{"Thorlabs Motor Serial Number File Path": path, "Default Data Saving Location": path}
  "Misc Data Mega Cluster.gtype" = cluster{"Full Reference Cluster": "Full Reference Cluster.gtype", "Cell Naming Cluster": "Cell Naming Cluster.gtype", "All XZ Position Cluster": "XZ All Position Cluster.gtype", "All Paths": T3}
  "SRM Specific Parameters.gtype" = cluster{"Max (V)": f64, "Min (V)": f64, "V Points": u32, "Current Range (A)": f64, "Autorange": bool, "Sweep Dir": bool, "Current Averages": u32, "Max (A)": f64, "Integration Time": f64, "Cell Area (m^2)": f64}
  "Raibow Sweep Selector.gtype" = enum{"Red Sweep", "Blue Sweep", "Full Sweep Red First", "Full Sweep Blue First"}
  "Rainbow Sweep Param Selector.gtype" = cluster{"Raibow Sweep Selector": "Raibow Sweep Selector.gtype", "Max Wavelength (nm)": f64, "Min Wavelength (nm)": f64, "Wavelength Step (nm)": f64, "Rainbow Sweep Type Selector": "Rainbow Sweep Type Selector.gtype"}
  "Rainbow Sweep Types.gtype" = enum{"Red Sweep Closing", "Red Sweep Opening", "Blue Sweep Closing", "Blue Sweep Opening"}
  "IV Full Data Cluster.gtype" = cluster{"IV Measurements Array": "IV Single Measurement.gtype"[], "Rainbow Sweep Types": "Rainbow Sweep Types.gtype", "IV Refined Data": "IV Refined Full Sweep Data.gtype"}
  "IV Full Raw Data.gtype" = cluster{"Rainbow Sweep Types": "Rainbow Sweep Types.gtype", "IV Raw Data Array": "IV Single Measurement.gtype"[]}
  "SRM Mega Cluster.gtype" = cluster{"SRM Specific Parameters": "SRM Specific Parameters.gtype", "Rainbow Sweep Parameters SRM": "Rainbow Sweep Param Selector.gtype", "SRM Full IV data Array": "IV Full Data Cluster.gtype"[], "Full IV Curve Raw Data": "IV Full Raw Data.gtype"[]}
  "IV Single Measurement.gtype" = cluster{"Voltage": f64[], "Current": f64[], "Current Density": f64[], "Dividing Wavelength": f64, "Light Power": f64}
uses:
  Rainbow Measurement Setup::Side Functions::Messages And Prompts::Select path prompt.gvi
  Rainbow Measurement Setup::Side Functions::Path Manipulation::File_FolderName Scan For Sweep.gvi
  Rainbow Measurement Setup::Main Functions::Modify TXT file::Modify Measurement TXT File.gvi
  Rainbow Measurement Setup::Main Functions::Rainbow Measurement::Cell Single Rainbow Measurement::File Handling::SRM Header Info Extractor.gvi
  Rainbow Measurement Setup::Side Functions::Utilities::Array Detect Duplicates.gvi
  Rainbow Measurement Setup::Side Functions::Messages And Prompts::FGV Repeat Operation for all following files.gvi
diagram:
  # This subVI Handles the Saving of all the Single Rainbow Measurement files. It can both save and load the files from a specified folder and to the user folder respectively
  case ($"Error In") {
    frame Error, Default {
      w1 = $"Error In"
      w2 = default
      w3 = default
      w4 = $"SRM Mega Cluster In"
      w5 = $"Misc Data Mega Cluster In"
    }
    frame No Error {
      case ($"Modify File Operation") {
        frame "Load TXT" {
          w13 = "Please Select the folder with the Rainbow Measurement Files you want to Load. "
          w14 = "Please select the cell folder within the device you want to analyze (i.e. L12)"
          call "Select path prompt.gvi"(Main Message=w13, Sub message=w14, Error In=$"Error In", Cancel Available?=TRUE) -> (New Path=w15, Cancelled?=w16, Error Out=w17)
          case (w16) {
            frame True {
              w11 = default
              w6 = w17
              w8 = TRUE
              w2 = default
              w7 = TRUE
              w9 = default
              w10 = default
            }
            frame False {
              List Folder(error in=w17, path=w15) -> (error out=w18, folder names=w19, path out=w20)
              s1 = w18  # shift register
              s2 = 0  # shift register
              s3 = "IV Full Raw Data.gtype"[] []  # shift register
              for {
                w21 = each element of w19
                Build Path(base path=w20, name or relative path=w21) -> (appended path=w25)
                Search And Replace String(error in (no error)=s1, input string=w21, search string="Raw IV Curves") -> (error out=w26, number of replacements=w27)
                call "File_FolderName Scan For Sweep.gvi"(FileName/FolderName In=w21, Error In=w26) -> (Is File/Folder sweep type?=w28, Sweep Type=w29, Error Out=w30)
                Is Not Equal To 0(x=w27) -> w31
                Logical And(w31, w28) -> w32
                case (w32) {
                  frame False, Default {
                    w33 = s2
                    w34 = s3
                    w35 = w30
                    w36 = default
                    w37 = "Red Sweep Closing"
                    w38 = default
                  }
                  frame True {
                    Array Index(array=s3) -> (out0[s2]=w39)
                    Property Node(instance in=w39) -> ("IV Raw Data Array"=w40)
                    List Folder(error in=w30, path=w25) -> (error out=w41, file names=w42, path out=w43)
                    s4 = w41  # shift register
                    s5 = w40  # shift register
                    s6 = 0  # shift register
                    for {
                      w44 = each element of w42
                      Build Path(base path=w43, name or relative path=w44) -> (appended path=w46)
                      Search And Replace String(input string=w44, search string=".txt") -> (number of replacements=w47)
                      Is Not Equal To 0(x=w47) -> w48
                      case (w48) {
                        frame False, Default {
                          w49 = s4
                          w50 = s5
                          w51 = s6
                          w52 = default
                        }
                        frame True {
                          Increment(x=s6) -> w51
                          call "Modify Measurement TXT File.gvi"(Filename to load/save=w46, Modify File Operation="Load TXT", Error In=s4, Measurement File Type="Single Cell Rainbow Raw") -> (Loaded Data=w53, Header Data=w54, Error Out=w55)
                          Array Index(array=w53) -> (out0[_, 0]=w56, out1[_, 1]=w57, out2[_, 2]=w58)
                          call "SRM Header Info Extractor.gvi"(Header Data=w54, Error In=w55) -> (Dividing Wavelength=w59, Light Power=w60, Error Out=w49)
                          Property Node(instance in="IV Single Measurement.gtype" {all zero or empty}, "Voltage"=w56, "Current"=w57, "Current Density"=w58, "Dividing Wavelength"=w59, "Light Power"=w60) -> (instance out=w61)
                          Insert Into Array(inArray=s5, index0=s6, new=w61) -> w50
                          w52 = TRUE
                        }
                      }
                      append w52 to w45
                      next s4 = w49
                      next s5 = w50
                      next s6 = w51
                    }
                    Or Array Elements(Boolean array=w45) -> (logical OR=w38)
                    Property Node(instance in=w39, "IV Raw Data Array"=s5, "Rainbow Sweep Types"=w29) -> (instance out=w62)
                    Insert Into Array(inArray=s3, new=w62) -> w34
                    Increment(x=s2) -> w33
                    w35 = s4
                    w36 = TRUE
                    w37 = w29
                  }
                }
                append w36 to w22
                append w21 to w2 if w32
                append w37 to w23 if w32
                append w38 to w24
                next s1 = w35
                next s2 = w33
                next s3 = w34
              }
              Or Array Elements(Boolean array=w22) -> (logical OR=w7)
              Or Array Elements(Boolean array=w24) -> (logical OR=w10)
              call "Array Detect Duplicates.gvi"(Array In=w23, Error In=s1) -> (Repeated?=w9, Error Out=w6)
              w11 = s3
              w8 = default
            }
          }
          w12 = $"SRM Mega Cluster In"
          w5 = $"Misc Data Mega Cluster In"
        }
        frame "Save TXT", Default {
          Property Node(instance in=$"SRM Mega Cluster In") -> ("SRM Full IV data Array"=w63, instance out=w12)
          s7 = $"Error In"  # shift register
          s8 = $"Misc Data Mega Cluster In"  # shift register
          for {
            w64 = each element of w63
            Property Node(instance in=w64) -> ("IV Measurements Array"=w65, "Rainbow Sweep Types"=w66, "IV Refined Data"=w67)
            Property Node(instance in=$"Misc Data Mega Cluster In") -> ("Cell Naming Cluster:Sample Prefix"=w68)
            s9 = s7  # shift register
            s10 = s8  # shift register
            for {
              w69 = each element of w65
              Property Node(instance in=w69) -> ("Voltage"=w70, "Current"=w71, "Current Density"=w72, "Dividing Wavelength"=w73, "Light Power"=w74)
              Format Into String(formatString="%d", errIn=s9, w73) -> (outString=w75, errOut=w76)
              Concatenate Strings(w68, ".", w75, "nm") -> w77
              Property Node(instance in=s10, "Cell Naming Cluster:Sample Prefix"=w77) -> (instance out=w78)
              Build Array(w70, w71, w72) -> w79
              Transpose 2D Array(2D array=w79) -> (transposed array=w80)
              Concatenate Strings(" Dividing Wavelength (nm) = ", w75, "  Light Power (W) = ") -> w81
              Format Into String(initString=w81, errIn=w76, w74) -> (outString=w82, errOut=w83)
              call "Modify Measurement TXT File.gvi"(Variable Header Info=w82, Rainbow Sweep Types=w66, Misc Data Mega Cluster In=w78, Modify File Operation="Save TXT", Data To Save=w80, Error In=w83, Measurement File Type="Single Cell Rainbow Raw") -> (Error Out=w84, Misc Data Mega Cluster Out=w85)
              next s9 = w84
              next s10 = w85
            }
            Property Node(instance in=w67) -> ("Dividing Wavelength (nm)"=w86, "Light Power (W)"=w87, "Jsc (A/m^2)"=w88, "Voc (V)"=w89, "FF (%)"=w90, "Efficiency (%)"=w91, "Rs (Ω/m^2)"=w92, "Rsh (Ω/m^2)"=w93)
            Build Array(w86, w87, w88, w89, w90, w91, w92, w93) -> w94
            Transpose 2D Array(2D array=w94) -> (transposed array=w95)
            call "Modify Measurement TXT File.gvi"(Rainbow Sweep Types=w66, Misc Data Mega Cluster In=s10, Modify File Operation="Save TXT", Data To Save=w95, Error In=s9, Measurement File Type="Single Cell Rainbow Refined") -> (Error Out=w96, Misc Data Mega Cluster Out=w97)
            next s7 = w96
            next s8 = w97
          }
          w6 = s7
          w7 = default
          w8 = default
          w2 = default
          w9 = default
          w10 = default
          w11 = default
          w5 = s8
        }
      }
      call "FGV Repeat Operation for all following files.gvi"(FGV Instructions="Reset State", Error In=w6) -> (Error Out=w1)
      Property Node(instance in="SRM Load Boolean Handler.gtype" {all zero or empty}, "Canceled Loading?"=w8, "Found Any Folder?"=w7, "Found Files Within all Folders?"=w10, "Duplicate Measurement Files?"=w9) -> (instance out=w3)
      Property Node(instance in=w12, "Full IV Curve Raw Data"=w11) -> (instance out=w4)
    }
  }
  $"Misc Data Mega Cluster Out" <- w5
  $"Error Out" <- w1
  $"Boolean Handler Out" <- w3
  $"SRM Mega Cluster Out" <- w4
  $"Loaded Files" <- w2
