vi "FF and Efficiency.gvi"   [LabVIEW NXG 5.0.0]
inputs:
  "Error In": error
  "IV Sweep Data In": "IV Refined Single Sweep Data.gtype"
  "IV Single Measurement": "IV Single Measurement.gtype"
  "Full Spectrum Reference?": bool
outputs:
  "Error Out": error
  "IV Sweep Data Out": "IV Refined Single Sweep Data.gtype"
types:
  "IV Refined Single Sweep Data.gtype" = cluster{"Rs (Ω/m^2)": f64, "Rsh (Ω/m^2)": f64, "Jsc (A/m^2)": f64, "Voc (V)": f64, "FF (%)": f64, "Efficiency (%)": f64, "Dividing Wavelength": f64, "Light Power": f64}
  "IV Single Measurement.gtype" = cluster{"Voltage": f64[], "Current": f64[], "Current Density": f64[], "Dividing Wavelength": f64, "Light Power Density": f64, "Total Light Power Density": f64}
diagram:
  # This SubVI Calculates the point of maximum generated power
  # and calculates the filling factor taking into account the previously
  # calculated Jsc and Voc.
  case ($"Error In") {
    frame Error, Default {
      w1 = $"Error In"
      w2 = $"IV Sweep Data In"
    }
    frame No Error {
      Property Node(instance in=$"IV Sweep Data In") -> ("Voc (V)"=w3, "Jsc (A/m^2)"=w4, instance out=w5)
      Multiply(w3, w4) -> w6
      Absolute Value(x=w6) -> w7
      Property Node(instance in=$"IV Single Measurement") -> ("Voltage"=w8, "Current Density"=w9, "Current"=w10, "Total Light Power Density"=w11, "Light Power Density"=w12)
      Multiply(w8, w9) -> w13
      Array Max And Min(array=w13) -> (min value=w14)
      Absolute Value(x=w14) -> w15
      Multiply(w15, 100) -> w16
      Divide(x=w16, y=w7) -> w17
      Multiply(w8, w10) -> w18
      Array Max And Min(array=w18) -> (min value=w19)
      Absolute Value(x=w19) -> w20
      case ($"Full Spectrum Reference?") {
        frame False, Default {
          Divide(x=w20, y=w12) -> w21
        }
        frame True {
          Divide(x=w20, y=w11) -> w21
        }
      }
      Multiply(w21, 100) -> w22
      Property Node(instance in=w5, "FF (%)"=w17, "Efficiency (%)"=w22) -> (instance out=w2)
      w1 = $"Error In"
    }
  }
  $"Error Out" <- w1
  $"IV Sweep Data Out" <- w2
