vi "SRM Rainbow Parameter Rewritter.gvi"   [LabVIEW NXG 5.0.0]
inputs:
  "Light Power Calibration Data In": "Light Power Calibration Data.gtype"
  "Rainbow Sweep Parameters Selector In": "Rainbow Sweep Param Selector.gtype" = {0, 1100, 300, 1, 1, 0}
  "Desired Operation": "SRM Wrong Sweep Parameters Operation.gtype" = "Change Parameters"
  "Error In": error
outputs:
  "Error Out": error
  "Rainbow Sweep Parameters Selector Out": "Rainbow Sweep Param Selector.gtype"
  "Light Power Calibration Data Out": "Light Power Calibration Data.gtype"
  "Cancelled Measurement?": bool
types:
  "Raibow Sweep Selector.gtype" = enum{"Red Sweep", "Blue Sweep", "Full Sweep Red First", "Full Sweep Blue First"}
  T1 = enum{"Red Sweep Closing", "Red Sweep Opening", "Red Sweep Both Ways"}
  T2 = enum{"Blue Sweep Opening", "Blue Sweep Closing", "Blue Sweep Both Ways"}
  "Rainbow Sweep Type Selector.gtype" = cluster{"Red Sweep Mode": T1, "Blue Sweep Mode": T2}
  "Rainbow Sweep Param Selector.gtype" = cluster{"Raibow Sweep Selector": "Raibow Sweep Selector.gtype", "Max Wavelength (nm)": f64, "Min Wavelength (nm)": f64, "Wavelength Step (nm)": f64, "Rainbow Sweep Type Selector": "Rainbow Sweep Type Selector.gtype"}
  T3 = cluster{"Dividing Wavelength Array": f64[], "Measured Power Array": f64[]}
  "Rainbow Sweep Types.gtype" = enum{"Red Sweep Closing", "Red Sweep Opening", "Blue Sweep Closing", "Blue Sweep Opening"}
  "Light Power Calibration Data.gtype" = cluster{"Single Light Calibration": T3, "Rainbow Sweep Types": "Rainbow Sweep Types.gtype"}
  "SRM Wrong Sweep Parameters Operation.gtype" = enum{"Change Parameters", "Cancel Measurement", "Continue"}
uses:
  Rainbow Measurement Setup::Side Functions::Utilities::Array Parameters Calculation.gvi
diagram:
  case ($"Error In") {
    frame Error, Default {
      w1 = $"Error In"
      w2 = $"Rainbow Sweep Parameters Selector In"
      w3 = $"Light Power Calibration Data In"
      w4 = default
    }
    frame No Error {
      case ($"Desired Operation") {
        frame "Change Parameters", Default {
          Property Node(instance in=$"Rainbow Sweep Parameters Selector In") -> ("Max Wavelength (nm)"=w5, "Min Wavelength (nm)"=w6, instance out=w7)
          Property Node(instance in=$"Light Power Calibration Data In") -> ("Single Light Calibration:Dividing Wavelength Array"=w8, instance out=w3)
          call "Array Parameters Calculation.gvi"(Input Array 1D=w8, Range Value 1=w5, Range Value 2=w6, Error In=$"Error In") -> (Coerced Min Wavelenght=w9, Coerced Max Wavelenght=w10, Step Value=w11, Error Out=w1)
          Property Node(instance in=w7, "Max Wavelength (nm)"=w10, "Min Wavelength (nm)"=w9, "Wavelength Step (nm)"=w11) -> (instance out=w2)
          w4 = default
        }
        frame "Cancel Measurement" {
          w1 = $"Error In"
          w2 = $"Rainbow Sweep Parameters Selector In"
          w3 = $"Light Power Calibration Data In"
          w4 = TRUE
        }
        frame "Continue" {
          w1 = $"Error In"
          w2 = $"Rainbow Sweep Parameters Selector In"
          w3 = $"Light Power Calibration Data In"
          w4 = default
        }
      }
    }
  }
  $"Light Power Calibration Data Out" <- w3
  $"Cancelled Measurement?" <- w4
  $"Error Out" <- w1
  $"Rainbow Sweep Parameters Selector Out" <- w2
