vi "SRM Sweep Refined FGV Read Handler.gvi"   [LabVIEW NXG 5.0.0]
inputs:
  "SRM Refined Plot Rainbow Sweep Types Selector In": "ComboBoxSelector reference"
  "Parameter Selector": "SRM Refined Plot Parameter Selector.gtype" = "Efficiency (%)"
  "IV Refined Data Plot": "SRM IV Refined Data Plot.gtype"[]
  "Error In": error
outputs:
  "SRM Refined Plot Rainbow Sweep Types Selector Out": "ComboBoxSelector reference"
  "IV Extracted Parameters Plot": T8
  "Error Out": error
types:
  T1 = cluster{"Dividing Wavelength (nm)": f64[], "Efficiency (%)": f64[]}
  T2 = cluster{"Dividing Wavelength (nm)": f64[], "Jsc (A/m^2)": f64[]}
  T3 = cluster{"Dividing Wavelength (nm)": f64[], "Voc (V)": f64[]}
  T4 = cluster{"Dividing Wavelength (nm)": f64[], "Light Power (W)": f64[]}
  T5 = cluster{"Dividing Wavelength (nm)": f64[], "FF (%)": f64[]}
  T6 = cluster{"Dividing Wavelength (nm)": f64[], "Rs (Ω/m^2)": f64[]}
  T7 = cluster{"Dividing Wavelength (nm)": f64[], "Rsh (Ω/m^2)": f64[]}
  "Rainbow Sweep Types.gtype" = enum{"Red Sweep Closing", "Red Sweep Opening", "Blue Sweep Closing", "Blue Sweep Opening"}
  "SRM IV Refined Data Plot.gtype" = cluster{"Efficiency Plot": T1, "Jsc Plot": T2, "Voc Plot": T3, "Light Power Plot": T4, "FF Plot": T5, "Rs Plot": T6, "Rsh Plot": T7, "Rainbow Sweep Types": "Rainbow Sweep Types.gtype"}
  "SRM Refined Plot Parameter Selector.gtype" = enum{"Efficiency (%)", "Jsc (A)", "Voc (V)", "Light Power (W)", "FF (%)", "Rs (Ω/m^2)", "Rsh (Ω/m^2)"}
  T8 = cluster{"Dividing Wavelength (nm)": f64[], "Element 2": f64[]}
diagram:
  # This SubVI Takes all the sweep types and scans for the selected one, and once it finds it
  # it outputs the selected data to the IV Extracted Parameters plot so that it can be correctly
  # plotted.
  case ($"Error In") {
    frame Error, Default {
      w1 = default
      w2 = $"Error In"
      w3 = $"SRM Refined Plot Rainbow Sweep Types Selector In"
    }
    frame No Error {
      Property Node(instance in=$"SRM Refined Plot Rainbow Sweep Types Selector In", error in=$"Error In") -> ("Value"=w4, error out=w2, instance out=w3)
      for {
        w5 = each element of $"IV Refined Data Plot"
        Property Node(instance in=w5) -> ("Rainbow Sweep Types"=w7, instance out=w8)
        Format Into String(w7) -> w9
        Is Equal(x=w9, y=w4) -> w10
        w6 = w8 if w10
      }
      case ($"Parameter Selector") {
        frame "Efficiency (%)", Default {
          Property Node(instance in=w6) -> ("Efficiency Plot"=w1)
        }
        frame "Jsc (A)" {
          Property Node(instance in=w6) -> ("Jsc Plot"=w1)
        }
        frame "Voc (V)" {
          Property Node(instance in=w6) -> ("Voc Plot"=w1)
        }
        frame "Light Power (W)" {
          Property Node(instance in=w6) -> ("Light Power Plot"=w1)
        }
        frame "FF (%)" {
          Property Node(instance in=w6) -> ("FF Plot"=w1)
        }
        frame "Rs (Ω/m^2)" {
          Property Node(instance in=w6) -> ("Rsh Plot"=w1)
        }
        frame "Rsh (Ω/m^2)" {
          Property Node(instance in=w6) -> ("Rsh Plot"=w1)
        }
      }
    }
  }
  $"IV Extracted Parameters Plot" <- w1
  $"SRM Refined Plot Rainbow Sweep Types Selector Out" <- w3
  $"Error Out" <- w2
