vi "SRM Sweep Refined FGV Set State.gvi"   [LabVIEW NXG 5.0.0]
inputs:
  "Combo Box Reference In": "ComboBoxSelector reference"
  "IV Full Data Cluster Array In": "IV Full Data Cluster.gtype"[]
  "Error In": error
outputs:
  "Combo Box Reference Out": "ComboBoxSelector reference"
  "IV Refined Plot Data Out": "SRM IV Refined Data Plot.gtype"[]
  "Error Out": error
types:
  T1 = cluster{"Dividing Wavelength (nm)": f64[], "Efficiency (%)": f64[]}
  T2 = cluster{"Dividing Wavelength (nm)": f64[], "Jsc (A/m^2)": f64[]}
  T3 = cluster{"Dividing Wavelength (nm)": f64[], "Voc (V)": f64[]}
  T4 = cluster{"Dividing Wavelength (nm)": f64[], "Light Power (W)": f64[]}
  T5 = cluster{"Dividing Wavelength (nm)": f64[], "FF (%)": f64[]}
  T6 = cluster{"Dividing Wavelength (nm)": f64[], "Rs (Ω/m^2)": f64[]}
  T7 = cluster{"Dividing Wavelength (nm)": f64[], "Rsh (Ω/m^2)": f64[]}
  "Rainbow Sweep Types.gtype" = enum{"Red Sweep Closing", "Red Sweep Opening", "Blue Sweep Closing", "Blue Sweep Opening"}
  "SRM IV Refined Data Plot.gtype" = cluster{"Efficiency Plot": T1, "Jsc Plot": T2, "Voc Plot": T3, "Light Power Plot": T4, "FF Plot": T5, "Rs Plot": T6, "Rsh Plot": T7, "Rainbow Sweep Types": "Rainbow Sweep Types.gtype"}
  "IV Single Measurement.gtype" = cluster{"Voltage": f64[], "Current": f64[], "Current Density": f64[], "Dividing Wavelength": f64, "Light Power": f64}
  "IV Refined Full Sweep Data.gtype" = cluster{"Rs (Ω/m^2)": f64[], "Rsh (Ω/m^2)": f64[], "Jsc (A/m^2)": f64[], "Voc (V)": f64[], "FF (%)": f64[], "Efficiency (%)": f64[], "Dividing Wavelength (nm)": f64[], "Light Power (W)": f64[]}
  "IV Full Data Cluster.gtype" = cluster{"IV Measurements Array": "IV Single Measurement.gtype"[], "Rainbow Sweep Types": "Rainbow Sweep Types.gtype", "IV Refined Data": "IV Refined Full Sweep Data.gtype"}
uses:
  Rainbow Measurement Setup::Main Functions::Rainbow Measurement::Cell Single Rainbow Measurement::Plotting::SRM Refined Data Graph Adapter.gvi
diagram:
  # This SubVI takes the IV Data and extracts the values of the rainbow sweep types
  # to set the Combobox values to all the available sweep types
  case ($"Error In") {
    frame Error, Default {
      w1 = $"Combo Box Reference In"
      w2 = default
      w3 = $"Error In"
    }
    frame No Error {
      call "SRM Refined Data Graph Adapter.gvi"(IV Full Data Cluster Array In=$"IV Full Data Cluster Array In", Error In=$"Error In") -> (IV Full Data To Plot=w2, Error Out=w4)
      s1 = w4  # shift register
      for {
        w5 = each element of $"IV Full Data Cluster Array In"
        Property Node(instance in=w5) -> ("Rainbow Sweep Types"=w7)
        Format Into String(w7) -> w8
        append w8 to w6
      }
      Property Node(instance in=$"Combo Box Reference In", "Items"=w6, "ValueSignaling"=w8, error in=s1) -> (error out=w3, instance out=w1)
    }
  }
  $"IV Refined Plot Data Out" <- w2
  $"Combo Box Reference Out" <- w1
  $"Error Out" <- w3
