vi "SRM Extract Correct Calibration Data.gvi"   [LabVIEW NXG 5.0.0]
inputs:
  "Light Power Calibration Data In": "Light Power Calibration Data.gtype"[]
  "Rainbow Param Selector In": "Rainbow Sweep Parameters.gtype"
  "Error In": error
outputs:
  "Error Out": error
  "Extracted Light Power Calibration Data": "Light Power Calibration Data.gtype"
types:
  T1 = cluster{"Dividing Wavelength Array": f64[], "Measured Power Array": f64[]}
  "Rainbow Sweep Types.gtype" = enum{"Red Sweep Closing", "Red Sweep Opening", "Blue Sweep Closing", "Blue Sweep Opening"}
  "Light Power Calibration Data.gtype" = cluster{"Single Light Calibration": T1, "Rainbow Sweep Types": "Rainbow Sweep Types.gtype"}
  "Rainbow Sweep Parameters.gtype" = cluster{"Dividing Wavelength Array": f64[], "Rainbow Sweep Types": "Rainbow Sweep Types.gtype"}
diagram:
  # This subVI Extracts the LIght power calibration data that
  # matches the current desired sweep type, for the IV calculations
  case ($"Error In") {
    frame Error {
      w1 = "Light Power Calibration Data.gtype" {all zero or empty}
      w2 = $"Error In"
    }
    frame No Error {
      for {
        w3 = each element of $"Light Power Calibration Data In"
        Property Node(instance in=w3) -> ("Rainbow Sweep Types"=w4)
        Property Node(instance in=$"Rainbow Param Selector In") -> ("Rainbow Sweep Types"=w5)
        Is Equal(x=w4, y=w5) -> w6
        w1 = w3 if w6
        stop if w6
      }
      w2 = $"Error In"
    }
  }
  $"Error Out" <- w2
  $"Extracted Light Power Calibration Data" <- w1
