vi "SRM Rainbow Sweep.gvi"   [LabVIEW NXG 5.0.0]
inputs:
  "Error In": error
  "SRM Specific Parameters": "SRM Specific Parameters.gtype"
  "Rainbow Sweep Param Selector": "Rainbow Sweep Param Selector.gtype" = {0, 1100, 300, 1, 1, 0}
  "Debugging Cluster In": "Debugging Cluster.gtype"
  "Instrument Coms Info In": "Instrument Coms Info.gtype"
  "Light Power Calibration Data": "Light Power Calibration Data.gtype"[]
outputs:
  "Error Out": error
  "Instrument Coms Info Out": "Instrument Coms Info.gtype"
  "Debugging Cluster Out": "Debugging Cluster.gtype"
  "Full IV Curve Raw Data": "IV Full Raw Data.gtype"[]
types:
  "SRM Specific Parameters.gtype" = cluster{"Max (V)": f64, "Min (V)": f64, "V Points": u32, "Current Range (A)": f64, "Autorange": bool, "Sweep Dir": bool, "Current Averages": u32, "Max (A)": f64, "Integration Time": f64, "Cell Area (m^2)": f64}
  "Raibow Sweep Selector.gtype" = enum{"Red Sweep", "Blue Sweep", "Full Sweep Red First", "Full Sweep Blue First"}
  T1 = enum{"Red Sweep Closing", "Red Sweep Opening", "Red Sweep Both Ways"}
  T2 = enum{"Blue Sweep Opening", "Blue Sweep Closing", "Blue Sweep Both Ways"}
  "Rainbow Sweep Type Selector.gtype" = cluster{"Red Sweep Mode": T1, "Blue Sweep Mode": T2}
  "Rainbow Sweep Param Selector.gtype" = cluster{"Raibow Sweep Selector": "Raibow Sweep Selector.gtype", "Max Wavelength (nm)": f64, "Min Wavelength (nm)": f64, "Wavelength Step (nm)": f64, "Rainbow Sweep Type Selector": "Rainbow Sweep Type Selector.gtype"}
  "Insturment Debugging Cluster.gtype" = cluster{"Keithley": bool, "Arduinos": bool, "Thorlabs Motors": bool, "Photodetector": bool, "Flame Spectr": bool}
  "Debugging Cluster.gtype" = cluster{"Debugging mode?": bool, "Initialize App": bool, "Insturment Debugging": "Insturment Debugging Cluster.gtype"}
  T3 = cluster{"Element 1": "VISA Instr", "Element 2": string}
  "Arduino Detection cluster control.gtype" = cluster{"XZ Stage Arduino Address": "VISA Instr", "XZ Stage Arduino Detected?": bool, "Multiplexer Arduino Detected?": bool, "Multiplexer Arduino Address": "VISA Instr", "Arduinos List": T3[], "XZ Stage Log": string, "Multiplexer Log": string}
  "Thorlabs Motors Serial Number In.gtype" = cluster{"Thorlabs Blue Motor": string, "Thorlabs Red Motor": string, "Blue Motor Homed?": bool, "Red Motor Homed?": bool}
  "Instrument Coms Info.gtype" = cluster{"Arduino Coms Info": "Arduino Detection cluster control.gtype", "Photodetector Names": string[], "Keythley Address": "VISA Instr", "Photodetector Detected?": bool, "Thorlabs Motors Detected?": bool, "Keithley Detected?": bool, "Thorlabs Motors Serial Number": "Thorlabs Motors Serial Number In.gtype", "Photodetector IVI session": "Ivi IviDefault", "Flame ID": string, "Flame Detected?": bool, "Flame Wrapper ID": u64}
  T4 = cluster{"Dividing Wavelength Array": f64[], "Measured Power Array": f64[]}
  "Rainbow Sweep Types.gtype" = enum{"Red Sweep Closing", "Red Sweep Opening", "Blue Sweep Closing", "Blue Sweep Opening"}
  "Light Power Calibration Data.gtype" = cluster{"Single Light Calibration": T4, "Rainbow Sweep Types": "Rainbow Sweep Types.gtype"}
  "IV Single Measurement.gtype" = cluster{"Voltage": f64[], "Current": f64[], "Current Density": f64[], "Dividing Wavelength": f64, "Light Power": f64}
  "IV Full Raw Data.gtype" = cluster{"Rainbow Sweep Types": "Rainbow Sweep Types.gtype", "IV Raw Data Array": "IV Single Measurement.gtype"[]}
  "SRM Sweep Live Parameters.gtype" = cluster{"Current Wavelength (nm)": f64, "Rainbow Sweep Types": "Rainbow Sweep Types.gtype", "Finished Measurement?": bool}
  "SRM Single Plot Cluster.gtype" = cluster{"Voltage": f64[], "Current Density": f64[]}
  "SRM Sweep Live Parameters FGV Cluster.gtype" = cluster{"IV Single Measurement Array": "IV Single Measurement.gtype"[], "SRM Sweep type combo box selction": string, "IV Single Measurement Plot Array": "SRM Single Plot Cluster.gtype"[], "SRM Live Parameters": "SRM Sweep Live Parameters.gtype", "Counter": i32, "Full IV Data Array": "IV Full Raw Data.gtype"[], "Combobox Reference": "ComboBoxSelector reference", "Refresh now": bool, "Graph Reference": "Graph reference"}
uses:
  Rainbow Measurement Setup::Side Functions::Messages And Prompts::FGV Cancel Prompts until Finished Routine.gvi
  Rainbow Measurement Setup::Side Functions::Rainbow Sweep::Rainbow Sweep Param Generator.gvi
  Rainbow Measurement Setup::Side Functions::Instrument Control::Keithley::Keithley Set Constant Parameters.gvi
  Rainbow Measurement Setup::Main Functions::Rainbow Measurement::Cell Single Rainbow Measurement::SRM Extract Correct Calibration Data.gvi
  Rainbow Measurement Setup::Side Functions::Global Abort::FGV Global Abort.gvi
  Rainbow Measurement Setup::Main Functions::Rainbow Measurement::Cell Single Rainbow Measurement::SRM Extract Measured Power.gvi
  Rainbow Measurement Setup::Side Functions::Instrument Control::Keithley::Keithley Sweep Subroutine.gvi
  Rainbow Measurement Setup::Main Functions::Rainbow Measurement::Cell Single Rainbow Measurement::IV Calculations::IV to IJV Data.gvi
  Rainbow Measurement Setup::Main Functions::Rainbow Measurement::Cell Single Rainbow Measurement::SRM Live Parameters::SRM Sweep Live Parameters FGV.gvi
  Rainbow Measurement Setup::Side Functions::Utilities::Progress Handling::Progress General Calculator.gvi
  Rainbow Measurement Setup::Side Functions::Utilities::Progress Handling::Progress FGV.gvi
diagram:
  # This SubVI Takes the specified Parameters both for the sweep types and for the keithley electrical sweep and performs all the measurements while storing them on their
  # corresponding clusters, before outputing all the information within the Full IV Curve Data array.
  case ($"Error In") {
    frame Error, Default {
      w1 = $"Error In"
      w2 = default
      w3 = $"Instrument Coms Info In"
      w4 = $"Debugging Cluster In"
    }
    frame No Error {
      call "FGV Cancel Prompts until Finished Routine.gvi"(Error In=$"Error In", FGV Instructions="Reset State") -> (Error Out=w5)
      call "Rainbow Sweep Param Generator.gvi"(Rainbow Sweep Parameters=$"Rainbow Sweep Param Selector", Error In=w5) -> (Rainbow Sweep Parameters Array=w6, Error Out=w7)
      call "Keithley Set Constant Parameters.gvi"(Instrument Coms Info In=$"Instrument Coms Info In", Debugging Cluster In=$"Debugging Cluster In", SRM Specific Parameters In=$"SRM Specific Parameters", Error In=w7) -> (Instrument Coms Info Out=w8, Debugging Cluster Out=w9, SRM Specific Parameters Out=w10, Error Out=w11)
      s1 = w11  # shift register
      s2 = w8  # shift register
      s3 = w9  # shift register
      s4 = "IV Full Raw Data.gtype"[] []  # shift register
      s5 = 0  # shift register
      for (N -> w12) (iteration -> i1) {
        w13 = each element of w6
        Property Node(instance in=w13) -> ("Dividing Wavelength Array"=w14, "Rainbow Sweep Types"=w15)
        call "SRM Extract Correct Calibration Data.gvi"(Light Power Calibration Data In=$"Light Power Calibration Data", Rainbow Param Selector In=w13, Error In=s1) -> (Extracted Light Power Calibration Data=w16, Error Out=w17)
        s6 = w17  # shift register
        s7 = s2  # shift register
        s8 = s3  # shift register
        s9 = "IV Single Measurement.gtype"[] []  # shift register
        s10 = s5  # shift register
        for (N -> w18) (iteration -> i2) {
          w19 = each element of w14
          Multiply(w18, w12) -> w20
          call "FGV Global Abort.gvi"(Global Abort Instructions="Read Current State", Error In=s6) -> (Local Abort Out=w21, Global Abort Out=w22, Error Out=w23)
          call "SRM Extract Measured Power.gvi"(Dividing Wavelength In=w19, Light Power Calibration Data In=w16, Error In=w23) -> (IV Single Measurement Out=w24, Error Out=w25)
          call "Keithley Sweep Subroutine.gvi"(Instrument Coms Info In=s7, Debugging Cluster In=s8, IV Single Measurement In=w24, Error In=w25, SRM Specific Parameters In=w10) -> (Instrument Coms Info Out=w26, Debugging Cluster Out=w27, IV Single Measurement Out=w28, Error Out=w29)
          call "IV to IJV Data.gvi"(SRM Specific Parameters=w10, IV Single Measurement In=w28, Error In=w29) -> (IV Single Measurement Out=w30, Error Out=w31)
          w32 = "SRM Sweep Live Parameters.gtype" {"Current Wavelength (nm)"=0, "Rainbow Sweep Types"="Red Sweep Closing", "Finished Measurement?"=TRUE}
          Property Node(instance in=w32, "Current Wavelength (nm)"=w19, "Rainbow Sweep Types"=w15, "Finished Measurement?"=FALSE) -> (instance out=w33)
          Insert Into Array(inArray=s9, index0=i2, new=w30) -> w34
          w35 = "SRM Sweep Live Parameters FGV Cluster.gtype" {all zero or empty}
          Property Node(instance in=w35, "IV Single Measurement Array"=w34, "SRM Live Parameters"=w33) -> (instance out=w36)
          call "SRM Sweep Live Parameters FGV.gvi"(FGV Instructions="Set State", SRM sweep live parameters FGV Cluster In=w36, Error In=w31) -> (Error Out=w37)
          call "Progress General Calculator.gvi"(Starting Value=40, Ending Value=80, Number Of Steps=w20, Current Step=s10, Error In=w37) -> (Current Progress=w38, Error Out=w39)
          call "Progress FGV.gvi"(FGV Instructions="Set State", Progress In=w38, Error In=w39) -> (Error Out=w40)
          Logical Or(w21, w22) -> w41
          Increment(x=s10) -> w42
          Wait Until Next Multiple(multiple to wait=10)
          next s6 = w40
          next s7 = w26
          next s8 = w27
          next s9 = w34
          next s10 = w42
          stop if w41
        }
        Property Node(instance in="IV Full Raw Data.gtype" {all zero or empty}, "IV Raw Data Array"=s9, "Rainbow Sweep Types"=w15) -> (instance out=w43)
        Insert Into Array(inArray=s4, index0=i1, new=w43) -> w44
        w45 = "SRM Sweep Live Parameters FGV Cluster.gtype" {all zero or empty}
        Property Node(instance in=w45, "Full IV Data Array"=w44, "Refresh now"=TRUE) -> (instance out=w46)
        call "SRM Sweep Live Parameters FGV.gvi"(FGV Instructions="Set State", SRM sweep live parameters FGV Cluster In=w46, Error In=s6) -> (Error Out=w47)
        next s1 = w47
        next s2 = s7
        next s3 = s8
        next s4 = w44
        next s5 = s10
        stop if w41
      }
      w48 = "SRM Sweep Live Parameters FGV Cluster.gtype" {"SRM Live Parameters"={"Current Wavelength (nm)"=-1, "Rainbow Sweep Types"="Red Sweep Closing", "Finished Measurement?"=TRUE}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}
      call "SRM Sweep Live Parameters FGV.gvi"(FGV Instructions="Set State", SRM sweep live parameters FGV Cluster In=w48, Error In=s1) -> (Error Out=w1)
      w2 = s4
      w3 = s2
      w4 = s3
    }
  }
  $"Full IV Curve Raw Data" <- w2
  $"Instrument Coms Info Out" <- w3
  $"Debugging Cluster Out" <- w4
  $"Error Out" <- w1
