vi "Light Calibration file handling.gvi"   [LabVIEW NXG 5.0.0]
inputs:
  "Error In": error
  "Default Data Saving Location": path
  "Modify File Operation": "Modify File Operation.gtype" = "Save TXT"
  "Light Power Calibration Data In": "Light Power Calibration Data.gtype"[]
  "Cell Naming Cluster": "Cell Naming Cluster.gtype"
outputs:
  "Error Out": error
  "Light Power Calibration Data Out": "Light Power Calibration Data.gtype"[]
  "Found Any File?": bool
  "Canceled Loading?": bool
  "Loaded Files": string[]
  "Duplicate Calibration Files?": bool
types:
  "Modify File Operation.gtype" = enum{"Save TXT", "Load TXT"}
  T1 = cluster{"Dividing Wavelength Array": f64[], "Measured Power Array": f64[]}
  "Rainbow Sweep Types.gtype" = enum{"Red Sweep Closing", "Red Sweep Opening", "Blue Sweep Closing", "Blue Sweep Opening"}
  "Light Power Calibration Data.gtype" = cluster{"Single Light Calibration": T1, "Rainbow Sweep Types": "Rainbow Sweep Types.gtype"}
  "Cell Naming Cluster.gtype" = cluster{"Cell Label": string, "Sample Prefix": string, "Author Initials": string, "Current Date": string, "Batch Name": string}
uses:
  Rainbow Measurement Setup::Side Functions::Messages And Prompts::Select path prompt.gvi
  Rainbow Measurement Setup::Side Functions::Path Manipulation::File_FolderName Scan For Sweep.gvi
  Rainbow Measurement Setup::Main Functions::Modify TXT file::Modify Measurement TXT File.gvi
  Rainbow Measurement Setup::Side Functions::Utilities::Array Detect Duplicates.gvi
diagram:
  # This subVI Handles the Saving of all the Light Power Calibration Spectra Calibration Files. It can both save and load the files from a specified folder and to the user folder respectively
  case ($"Error In") {
    frame Error, Default {
      w1 = $"Error In"
      w2 = default
      w3 = $"Light Power Calibration Data In"
      w4 = default
      w5 = default
      w6 = default
    }
    frame No Error {
      case ($"Modify File Operation") {
        frame "Load TXT" {
          w7 = "Please Select the folder with all the Light Power Calibration Files you want to Load. "
          w8 = "(All available Calibration  Files Will be Loaded Automatically)"
          call "Select path prompt.gvi"(Main Message=w7, Sub message=w8, Error In=$"Error In", Cancel Available?=TRUE) -> (New Path=w9, Cancelled?=w10, Error Out=w11)
          case (w10) {
            frame True {
              w3 = default
              w1 = w11
              w4 = TRUE
              w5 = default
              w2 = TRUE
              w6 = default
            }
            frame False {
              List Folder(error in=w11, path=w9) -> (error out=w12, file names=w13, path out=w14)
              s1 = w12  # shift register
              s2 = 0  # shift register
              s3 = "Light Power Calibration Data.gtype"[] []  # shift register
              for {
                w15 = each element of w13
                Build Path(base path=w14, name or relative path=w15) -> (appended path=w18)
                Search And Replace String(error in (no error)=s1, input string=w15, search string="Power_Calibration") -> (error out=w19, number of replacements=w20)
                call "File_FolderName Scan For Sweep.gvi"(FileName/FolderName In=w15, Error In=w19) -> (Is File/Folder sweep type?=w21, Sweep Type=w22, Error Out=w23)
                Is Not Equal To 0(x=w20) -> w24
                Logical And(w24, w21) -> w25
                case (w25) {
                  frame False, Default {
                    w26 = s2
                    w27 = s3
                    w28 = w23
                    w29 = default
                    w30 = "Red Sweep Closing"
                  }
                  frame True {
                    Array Index(array=s3) -> (out0[s2]=w31)
                    call "Modify Measurement TXT File.gvi"(Filename to load/save=w18, Modify File Operation=$"Modify File Operation", Error In=w23, Measurement File Type="Light Calibration Power") -> (Loaded Data=w32, Error Out=w28)
                    Array Index(array=w32) -> (out0[_, 0]=w33, out1[_, 1]=w34)
                    Property Node(instance in=w31, "Single Light Calibration:Dividing Wavelength Array"=w33, "Single Light Calibration:Measured Power Array"=w34, "Rainbow Sweep Types"=w22) -> (instance out=w35)
                    Insert Into Array(inArray=s3, new=w35) -> w27
                    Increment(x=s2) -> w26
                    w29 = TRUE
                    w30 = w22
                  }
                }
                append w29 to w16
                append w15 to w5 if w25
                append w30 to w17 if w25
                next s1 = w28
                next s2 = w26
                next s3 = w27
              }
              Or Array Elements(Boolean array=w16) -> (logical OR=w2)
              call "Array Detect Duplicates.gvi"(Array In=w17, Error In=s1) -> (Repeated?=w6, Error Out=w1)
              w3 = s3
              w4 = default
            }
          }
        }
        frame "Save TXT", Default {
          s4 = $"Error In"  # shift register
          for {
            w36 = each element of $"Light Power Calibration Data In"
            Property Node(instance in=w36) -> ("Single Light Calibration"=w37, "Rainbow Sweep Types"=w38)
            Property Node(instance in=w37) -> ("Dividing Wavelength Array"=w39, "Measured Power Array"=w40)
            Build Array(w39, w40) -> w41
            Transpose 2D Array(2D array=w41) -> (transposed array=w42)
            call "Modify Measurement TXT File.gvi"(Rainbow Sweep Types=w38, Default Data Saving Location=$"Default Data Saving Location", Modify File Operation=$"Modify File Operation", Data To Save=w42, Error In=s4, Cell Naming Cluster=$"Cell Naming Cluster", Measurement File Type="Light Calibration Power") -> (Error Out=w43)
            next s4 = w43
          }
          w1 = s4
          w2 = default
          w3 = $"Light Power Calibration Data In"
          w4 = default
          w5 = default
          w6 = default
        }
      }
    }
  }
  $"Found Any File?" <- w2
  $"Light Power Calibration Data Out" <- w3
  $"Loaded Files" <- w5
  $"Canceled Loading?" <- w4
  $"Error Out" <- w1
  $"Duplicate Calibration Files?" <- w6
