vi "Light Calibration Live Parameters FGV.gvi"   [LabVIEW NXG 5.0.0]
inputs:
  "Error In": error
  "FGV Instructions": "General FGV Instructions.gtype" = "Read State", required
  "Light Calibration Live Parameters In": "LPC Sweep Live Parameters.gtype"
  "Graph Bundled data": T1[]
  "Light Power Calibration Graph In": cluster{"Wavelength": f64[], "Power": f64[]}[]
  "Set Names": bool
  "Graph Reference In": "Graph reference"
outputs:
  "Error Out": error
  "Light Calibration Parameters Out": "LPC Sweep Live Parameters.gtype"
  "Light Power Calibration Graph Out": cluster{"Wavelength": f64[], "Power": f64[]}[]
types:
  "General FGV Instructions.gtype" = enum{"Read State", "Set State", "Reset State"}
  "Rainbow Sweep Types.gtype" = enum{"Red Sweep Closing", "Red Sweep Opening", "Blue Sweep Closing", "Blue Sweep Opening"}
  "LPC Sweep Live Parameters.gtype" = cluster{"Light Power (W) ": f64, "Current Wavelength (nm)": f64, "Rainbow Sweep Types": "Rainbow Sweep Types.gtype"}
  T1 = cluster{"Element 1": f64[], "Element 2": f64[], "Element 3": "Rainbow Sweep Types.gtype"}
diagram:
  case ($"Error In") {
    frame Error, Default {
      w1 = $"Error In"
    }
    frame No Error {
      s1 = uninitialised  # shift register
      s2 = uninitialised  # shift register
      s3 = uninitialised  # shift register
      s4 = $"Error In"  # shift register
      s5 = uninitialised  # shift register
      s6 = uninitialised  # shift register
      while {
        case ($"FGV Instructions") {
          frame "Read State", Default {
            Increment(x=s6) -> w8
            Is Greater(x=w8, y=50) -> w9
            Logical And($"Set Names", w9) -> w10
            case (w10) {
              frame False, Default {
                w5 = s4
                w4 = $"Graph Reference In"
                w7 = w8
              }
              frame True {
                s7 = s4  # shift register
                for (iteration -> i1) {
                  w11 = each element of s5
                  Property Node(instance in=$"Graph Reference In", "ActivePlot"=i1, error in=s7) -> ("Plot"=w12, error out=w13)
                  Property Node(instance in=w11) -> ("Element 3"=w14)
                  Format Into String(w14) -> w15
                  Property Node(instance in=w12, "Name"=w15, error in=w13) -> (error out=w16, instance out=w4)
                  next s7 = w16
                }
                w5 = s7
                w7 = 0
              }
            }
            $"Light Calibration Parameters Out" <- s1
            $"Light Power Calibration Graph Out" <- s2
            w2 = s1
            w3 = s2
            w6 = s5
          }
          frame "Set State" {
            Is Empty Array(array=$"Graph Bundled data") -> w17
            Select(s=w17, t=s5, f=$"Graph Bundled data") -> w6
            Is Empty Array(array=$"Light Power Calibration Graph In") -> w18
            Select(s=w18, t=s2, f=$"Light Power Calibration Graph In") -> w3
            w2 = $"Light Calibration Live Parameters In"
            w4 = s3
            w5 = s4
            w7 = s6
          }
          frame "Reset State" {
            w2 = "LPC Sweep Live Parameters.gtype" {all zero or empty}
            w3 = cluster{"Wavelength": f64[], "Power": f64[]}[] []
            w4 = s3
            w5 = s4
            w6 = T1[] []
            w7 = 0
          }
        }
        next s1 = w2
        next s2 = w3
        next s3 = w4
        next s4 = w5
        next s5 = w6
        next s6 = w7
        stop if TRUE
      }
      w1 = s4
    }
  }
  $"Error Out" <- w1
