vi "Light Power Calibration Subroutine.gvi"   [LabVIEW NXG 5.0.0]
inputs:
  "Error In": error
  "Instrument Coms Info In": "Instrument Coms Info.gtype"
  "Debugging Cluster In": "Debugging Cluster.gtype"
  "Default Data Saving Location": path
  "Stand Alone?": bool
  "Light Power Calibration Data In": "Light Power Calibration Data.gtype"[]
  "Cell Naming Cluster": "Cell Naming Cluster.gtype"
  "Rainbow Sweep Param Selector": "Rainbow Sweep Param Selector.gtype" = {0, 1100, 300, 1, 1, 0}
outputs:
  "Error Out": error
  "Instuments Coms Info Out": "Instrument Coms Info.gtype"
  "Debugging Cluster Out": "Debugging Cluster.gtype"
  "Light Power Calibration Data Out": "Light Power Calibration Data.gtype"[]
panel controls:
  "Light Calibration Operation": "Light Power Operation Control.gtype" = "Save Calibration"
  "XZ All Position Cluster": "XZ All Position Cluster.gtype"
types:
  "Raibow Sweep Selector.gtype" = enum{"Red Sweep", "Blue Sweep", "Full Sweep Red First", "Full Sweep Blue First"}
  T1 = enum{"Red Sweep Closing", "Red Sweep Opening", "Red Sweep Both Ways"}
  T2 = enum{"Blue Sweep Opening", "Blue Sweep Closing", "Blue Sweep Both Ways"}
  "Rainbow Sweep Type Selector.gtype" = cluster{"Red Sweep Mode": T1, "Blue Sweep Mode": T2}
  "Rainbow Sweep Param Selector.gtype" = cluster{"Raibow Sweep Selector": "Raibow Sweep Selector.gtype", "Max Wavelength (nm)": f64, "Min Wavelength (nm)": f64, "Wavelength Step (nm)": f64, "Rainbow Sweep Type Selector": "Rainbow Sweep Type Selector.gtype"}
  "Insturment Debugging Cluster.gtype" = cluster{"Keithley": bool, "Arduinos": bool, "Thorlabs Motors": bool, "Photodetector": bool, "Flame Spectr": bool}
  "Debugging Cluster.gtype" = cluster{"Debugging mode?": bool, "Initialize App": bool, "Insturment Debugging": "Insturment Debugging Cluster.gtype"}
  T3 = cluster{"Element 1": "VISA Instr", "Element 2": string}
  "Arduino Detection cluster control.gtype" = cluster{"XZ Stage Arduino Address": "VISA Instr", "XZ Stage Arduino Detected?": bool, "Multiplexer Arduino Detected?": bool, "Multiplexer Arduino Address": "VISA Instr", "Arduinos List": T3[], "XZ Stage Log": string, "Multiplexer Log": string}
  "Thorlabs Motors Serial Number In.gtype" = cluster{"Thorlabs Blue Motor": string, "Thorlabs Red Motor": string, "Blue Motor Homed?": bool, "Red Motor Homed?": bool}
  "Instrument Coms Info.gtype" = cluster{"Arduino Coms Info": "Arduino Detection cluster control.gtype", "Photodetector Names": string[], "Keythley Address": "VISA Instr", "Photodetector Detected?": bool, "Thorlabs Motors Detected?": bool, "Keithley Detected?": bool, "Thorlabs Motors Serial Number": "Thorlabs Motors Serial Number In.gtype", "Photodetector IVI session": "Ivi IviDefault", "Flame ID": string, "Flame Detected?": bool, "Flame Wrapper ID": u64}
  "Cell Naming Cluster.gtype" = cluster{"Cell Label": string, "Sample Prefix": string, "Author Initials": string, "Current Date": string, "Batch Name": string}
  T4 = cluster{"Dividing Wavelength Array": f64[], "Measured Power Array": f64[]}
  "Rainbow Sweep Types.gtype" = enum{"Red Sweep Closing", "Red Sweep Opening", "Blue Sweep Closing", "Blue Sweep Opening"}
  "Light Power Calibration Data.gtype" = cluster{"Single Light Calibration": T4, "Rainbow Sweep Types": "Rainbow Sweep Types.gtype"}
  "Light Power Operation Control.gtype" = enum{"Save Calibration", "Load Calibration", "New Calibration"}
  T5 = cluster{"X Coordinate (mm)": f64, "Z Coordinate (mm)": f64}
  "XZ All Position Cluster.gtype" = cluster{"Cell R.01 Coordinates": T5, "Diffusor Coordinates": T5, "Photodetector Coordinates": T5}
uses:
  Rainbow Measurement Setup::Main Functions::Rainbow Measurement::Light Power Calibration::Light Power Operation FGV.gvi
  Rainbow Measurement Setup::Main Functions::Instruction Queue::Current State::FGV Current State.gvi
  Rainbow Measurement Setup::Side Functions::Global Abort::FGV Global Abort.gvi
  Rainbow Measurement Setup::Main Functions::Rainbow Measurement::Light Power Calibration::Light Calibration Start Calculator.gvi
  Rainbow Measurement Setup::Side Functions::Instrument Control::Thorlabs Motors::Dividing Wavelength Control::Dividing Wavelength Calibration Data FGV.gvi
  Rainbow Measurement Setup::Side Functions::Instrument Control::Debug Cluster Instrument Extractor.gvi
  Rainbow Measurement Setup::Main Functions::One Time Calibrations::Beam Power Density::Specific Detect Instruments Subroutine.gvi
  Rainbow Measurement Setup::Side Functions::Instrument Control::Thorlabs Motors::Movement::KCube Move to 0 or Home.gvi
  Rainbow Measurement Setup::Side Functions::Instrument Control::Arduino::XZ Stage Arduino::XZ Stage Initialize And Home.gvi
  Rainbow Measurement Setup::Side Functions::Instrument Control::Arduino::XZ Stage Arduino::XZ Stage Move to Position.gvi
  Rainbow Measurement Setup::Side Functions::Instrument Control::Photodetector::Photodetector Initialize.gvi
  Rainbow Measurement Setup::Main Functions::Rainbow Measurement::Light Power Calibration::Light Power Calibration Sweep.gvi
  Rainbow Measurement Setup::Side Functions::Instrument Control::Photodetector::Photodetector Close Coms.gvi
  Rainbow Measurement Setup::Side Functions::Instrument Control::Arduino::XZ Stage Arduino::XZ Stage Close Coms.gvi
  Rainbow Measurement Setup::Side Functions::Instrument Control::Thorlabs Motors::Movement::KCube Motors Close.gvi
  Rainbow Measurement Setup::Main Functions::Rainbow Measurement::Light Power Calibration::File Handling::Light power Calibration Save Graphs Prompt.gvi
  Rainbow Measurement Setup::Main Functions::Rainbow Measurement::Light Power Calibration::File Handling::Light Calibration file handling.gvi
  Rainbow Measurement Setup::Main Functions::Rainbow Measurement::Light Power Calibration::File Handling::Light Power Calibration Load Prompt.gvi
  Rainbow Measurement Setup::Side Functions::Messages And Prompts::General Simple Prompt.gvi
  Rainbow Measurement Setup::Side Functions::Utilities::Progress Handling::Progress FGV.gvi
diagram:
  w1 = $"XZ All Position Cluster"
  # This SubVI Measures the Light power for each motor position for each sweep type and outputs the data so that it can be plotted
  # on the main window for checking and for calibration purposes
  case ($"Error In") {
    frame Error, Default {
      w2 = $"Error In"
      w3 = default
      w4 = $"Instrument Coms Info In"
      w5 = $"Debugging Cluster In"
    }
    frame No Error {
      call "Light Power Operation FGV.gvi"(FGV Instructions="Read State", Error In=$"Error In") -> (Light Power Operation Out=w6, Error Out=w7)
      Select(s=$"Stand Alone?", t=$"Light Calibration Operation", f=w6) -> w8
      call "FGV Current State.gvi"(Current State Instructions="Set Current State and Substate", Current State="Light Power Calibration", Current Substate="", Error In=w7) -> (Error Out=w9)
      s1 = w9  # shift register
      s2 = "Start App"  # shift register
      s3 = $"Debugging Cluster In"  # shift register
      s4 = $"Instrument Coms Info In"  # shift register
      s5 = $"Light Power Calibration Data In"  # shift register
      while {
        call "FGV Global Abort.gvi"(Global Abort Instructions="Read Current State", Error In=s1) -> (Local Abort Out=w10, Global Abort Out=w11, Error Out=w12)
        Select(s=w10, t="Close Coms", f=s2) -> w13
        case (w13) {
          frame "Start App", Default {
            call "Light Calibration Start Calculator.gvi"(Operation Control=w8, Stand Alone?=$"Stand Alone?") -> (Output=w15)
            call "FGV Current State.gvi"(Current State Instructions="Set Current Substate", Current Substate="Starting Light Power Calibration", Error In=w12) -> (Error Out=w14)
            w16 = s3
            w17 = s4
            w18 = s5
            w19 = default
            w20 = 0
          }
          frame "Detect Instruments" {
            call "FGV Current State.gvi"(Current State Instructions="Set Current Substate", Current Substate="Detecting Instruments", Error In=w12) -> (Error Out=w21)
            call "Dividing Wavelength Calibration Data FGV.gvi"(General FGV Instructions="Set State", Error In=w21) -> (Error Out=w22)
            call "Debug Cluster Instrument Extractor.gvi"(Debugging Cluster In=s3, Error In=w22) -> (Debuging Cluster Out=w16, Instruments to Detect=w23, Error Out=w24)
            call "Specific Detect Instruments Subroutine.gvi"(Instrument Coms Info In=s4, Error In=w24, Instruments To Detect Array=w23) -> (Instrument Coms Info Out=w17, Error Out=w14)
            w15 = "Initialize Instruments"
            w18 = s5
            w19 = default
            w20 = 20
          }
          frame "Initialize Instruments" {
            Property Node(instance in=w1) -> ("Photodetector Coordinates"=w25)
            call "FGV Current State.gvi"(Current State Instructions="Set Current Substate", Current Substate="Initializing Instruments", Error In=w12) -> (Error Out=w26)
            call "KCube Move to 0 or Home.gvi"(Instrument Coms Info In=s4, Debugging Cluster In=s3, Error In=w26) -> (Instrument Coms Info Out=w27, Debugging Cluster Out=w28, Error Out=w29)
            call "XZ Stage Initialize And Home.gvi"(Instrument Coms Info In=w27, Debugging Cluster In=w28, Error In=w29) -> (Instrument Coms Info Out=w30, Debugging Cluster Out=w31, Error Out=w32)
            call "XZ Stage Move to Position.gvi"(Instrument Coms Info In=w30, Debugging Cluster In=w31, Error In=w32, XZ Coordinate Cluster In=w25) -> (Instrument Coms Info Out=w33, Debugging Cluster Out=w34, Error Out=w35)
            call "Photodetector Initialize.gvi"(Instrument Coms Info In=w33, Debugging Cluster In=w34, Error In=w35) -> (Instrument Coms Info Out=w17, Debugging Cluster Out=w16, Error Out=w14)
            w15 = "Rainbow Sweep"
            w18 = s5
            w19 = default
            w20 = 40
          }
          frame "Rainbow Sweep" {
            call "FGV Current State.gvi"(Current State Instructions="Set Current Substate", Current Substate="Acquiring Spectra", Error In=w12) -> (Error Out=w36)
            call "Light Power Calibration Sweep.gvi"(Instrument Coms Info In=s4, Debugging Cluster In=s3, Rainbow Sweep Param Selector=$"Rainbow Sweep Param Selector", Error In=w36) -> (Instrument Coms Info Out=w17, Debugging Cluster Out=w16, Light Power Calibration Data=w18, Error Out=w14)
            w15 = "Close Coms"
            w19 = default
            w20 = 80
          }
          frame "Close Coms" {
            call "FGV Current State.gvi"(Current State Instructions="Set Current Substate", Current Substate="Closing Coms", Error In=w12) -> (Error Out=w37)
            call "Photodetector Close Coms.gvi"(Instrument Coms Info In=s4, Debugging Cluster In=s3, Error In=w37) -> (Instrument Coms Info Out=w38, Debugging Cluster Out=w16, Error Out=w39)
            call "XZ Stage Close Coms.gvi"(Instrument Coms Info In=w38, Error In=w39) -> (Instrument Coms Info Out=w40, Error Out=w41)
            call "KCube Motors Close.gvi"(Instrument Coms Info In=w40, Error In=w41) -> (Instrument Coms Info Out=w17, Error Out=w42)
            call "Light power Calibration Save Graphs Prompt.gvi"(Error In=w42) -> (Desired State=w43, Error Out=w14)
            Select(s=w10, t="Stop App", f=w43) -> w15
            w18 = s5
            w19 = default
            w20 = 90
          }
          frame "Load Calibration" {
            call "FGV Current State.gvi"(Current State Instructions="Set Current Substate", Current Substate="Loading Calibration", Error In=w12) -> (Error Out=w44)
            call "Light Calibration file handling.gvi"(Modify File Operation="Load TXT", Error In=w44) -> (Duplicate Calibration Files?=w45, Light Power Calibration Data Out=w18, Found Any File?=w46, Loaded Files=w47, Error Out=w48, Canceled Loading?=w49)
            call "Light Power Calibration Load Prompt.gvi"(Duplicate Calibration Files?=w45, Found Any File?=w46, Stand Alone=$"Stand Alone?", Loaded Files=w47, Error In=w48, Canceled Loading?=w49) -> (Desired State=w15, Error Out=w14)
            w16 = s3
            w17 = s4
            w19 = default
            w20 = 40
          }
          frame "Save Graphs" {
            call "FGV Current State.gvi"(Current State Instructions="Set Current Substate", Current Substate="Saving Graphs", Error In=w12) -> (Error Out=w50)
            call "Light Calibration file handling.gvi"(Default Data Saving Location=$"Default Data Saving Location", Light Power Calibration Data In=s5, Modify File Operation="Save TXT", Error In=w50, Cell Naming Cluster=$"Cell Naming Cluster") -> (Light Power Calibration Data Out=w18, Error Out=w51)
            w52 = "Your Calibration Files Have been saved\npropperly on your personal data folder."
            call "General Simple Prompt.gvi"(Prompt Message=w52, Okay Button Message="Perfect Thanks :)", Error In=w51, Prompt?=TRUE) -> (Error Out=w14)
            w15 = "Stop App"
            w16 = s3
            w17 = s4
            w19 = default
            w20 = 95
          }
          frame "Stop App" {
            call "FGV Current State.gvi"(Current State Instructions="Set Current Substate", Current Substate="Stopping Apps", Error In=w12) -> (Error Out=w14)
            w15 = "Start App"
            w16 = s3
            w17 = s4
            w18 = s5
            w19 = TRUE
            w20 = 100
          }
        }
        call "Progress FGV.gvi"(FGV Instructions="Set State", Progress In=w20, Error In=w14) -> (Error Out=w53)
        Logical Or(w11, w53, w19) -> w54
        next s1 = w53
        next s2 = w15
        next s3 = w16
        next s4 = w17
        next s5 = w18
        stop if w54
      }
      w2 = s1
      w3 = s5
      w4 = s4
      w5 = s3
    }
  }
  $"Light Power Calibration Data Out" <- w3
  $"Instuments Coms Info Out" <- w4
  $"Debugging Cluster Out" <- w5
  $"Error Out" <- w2
