vi "Light Power Calibration Sweep.gvi"   [LabVIEW NXG 5.0.0]
inputs:
  "Error In": error
  "Instrument Control Mega Cluster In": "Instrument Control Mega Cluster.gtype"
  "LPC Mega Cluster In": "LPC Mega Cluster.gtype"
outputs:
  "Error Out": error
  "LPC Mega Cluster Out": "LPC Mega Cluster.gtype"
  "Instrument Control Mega Cluster Out": "Instrument Control Mega Cluster.gtype"
types:
  "Instrument Coms Info.gtype" = cluster{"Arduino Coms Info": "Arduino Detection cluster control.gtype", "Photodetector Names": string[], "Keythley Address": "VISA Instr", "Photodetector Detected?": bool, "Thorlabs Motors Detected?": bool, "Keithley Detected?": bool, "Thorlabs Motors Serial Number": "Thorlabs Motors Serial Number In.gtype", "Photodetector IVI session": "Ivi IviDefault", "Flame ID": string, "Flame Detected?": bool, "Flame Wrapper ID": u64}
  "Debugging Cluster.gtype" = cluster{"Debugging mode?": bool, "Initialize App": bool, "Insturment Debugging": "Insturment Debugging Cluster.gtype"}
  "Instrument Control Mega Cluster.gtype" = cluster{"Instruments Coms Info": "Instrument Coms Info.gtype", "Debugging Cluster": "Debugging Cluster.gtype"}
  "Raibow Sweep Selector.gtype" = enum{"Red Sweep", "Blue Sweep", "Full Sweep Red First", "Full Sweep Blue First"}
  "Rainbow Sweep Param Selector.gtype" = cluster{"Raibow Sweep Selector": "Raibow Sweep Selector.gtype", "Max Wavelength (nm)": f64, "Min Wavelength (nm)": f64, "Wavelength Step (nm)": f64, "Rainbow Sweep Type Selector": "Rainbow Sweep Type Selector.gtype"}
  "Light power Calibration Parameters.gtype" = cluster{"Powermeter Averages": f64}
  T1 = cluster{"Dividing Wavelength Array": f64[], "Measured Power Array": f64[]}
  "Rainbow Sweep Types.gtype" = enum{"Red Sweep Closing", "Red Sweep Opening", "Blue Sweep Closing", "Blue Sweep Opening"}
  "Light Power Calibration Data.gtype" = cluster{"Single Light Calibration": T1, "Rainbow Sweep Types": "Rainbow Sweep Types.gtype", "Total Light Power Density": f64}
  "LPC Mega Cluster.gtype" = cluster{"Rainbow Sweep Parameters LPC": "Rainbow Sweep Param Selector.gtype", "LPC Specific Parameters": "Light power Calibration Parameters.gtype", "Light Power Calibration Data": "Light Power Calibration Data.gtype"[]}
  "LPC Sweep Live Parameters.gtype" = cluster{"Light Power (W) ": f64, "Current Wavelength (nm)": f64, "Rainbow Sweep Types": "Rainbow Sweep Types.gtype"}
uses:
  Rainbow Measurement Setup::Side Functions::Messages And Prompts::FGV Cancel Prompts until Finished Routine.gvi
  Rainbow Measurement Setup::Side Functions::Instrument Control::Photodetector::Photodetector Measure Power.gvi
  Rainbow Measurement Setup::Side Functions::Rainbow Sweep::Rainbow Sweep Param Generator.gvi
  Rainbow Measurement Setup::Side Functions::Instrument Control::Thorlabs Motors::Dividing Wavelength Control::Dividing Wavelength Calibration Data FGV.gvi
  Rainbow Measurement Setup::Side Functions::Global Abort::FGV Global Abort.gvi
  Rainbow Measurement Setup::Side Functions::Instrument Control::Thorlabs Motors::Dividing Wavelength Control::KCube Dividing Wavelength Translator.gvi
  Rainbow Measurement Setup::Side Functions::Utilities::Wait ms.gvi
  Rainbow Measurement Setup::Side Functions::Graphing::Multiple Page Graph Adapter.gvi
  Rainbow Measurement Setup::Main Functions::Rainbow Measurement::Light Power Calibration::Light Calibration Live Parameters FGV.gvi
  Rainbow Measurement Setup::Side Functions::Utilities::Progress Handling::Progress General Calculator.gvi
  Rainbow Measurement Setup::Side Functions::Utilities::Progress Handling::Progress FGV.gvi
  Rainbow Measurement Setup::Side Functions::Instrument Control::Thorlabs Motors::Movement::KCube Move to 0 or Home.gvi
diagram:
  # This SubVI Performs a sweep moving the motors and measuring the power that reaches the detector and then it stores everything on an array so that it can be later saved.
  case ($"Error In") {
    frame Error, Default {
      w1 = $"Error In"
      w2 = $"Instrument Control Mega Cluster In"
      w3 = $"LPC Mega Cluster In"
    }
    frame No Error {
      Property Node(instance in=$"LPC Mega Cluster In") -> ("Rainbow Sweep Parameters LPC"=w4, instance out=w5)
      call "FGV Cancel Prompts until Finished Routine.gvi"(Error In=$"Error In", FGV Instructions="Reset State") -> (Error Out=w6)
      call "Photodetector Measure Power.gvi"(Instrument Control Mega Cluster In=$"Instrument Control Mega Cluster In", Error In=w6) -> (Instrument Control Mega Cluster Out=w7, Measured Power=w8, Error Out=w9)
      call "Rainbow Sweep Param Generator.gvi"(Rainbow Sweep Parameters=w4, Error In=w9) -> (Rainbow Sweep Parameters Array=w10, Error Out=w11)
      Property Node(instance in=w7) -> ("Debugging Cluster:Insturment Debugging:Photodetector"=w12, "Debugging Cluster:Debugging mode?"=w13, instance out=w14)
      Array Size(array=w10) -> (size(s)=w15)
      Initialize Array(element="Light Power Calibration Data.gtype" {all zero or empty}, size=w15) -> w16
      call "Dividing Wavelength Calibration Data FGV.gvi"(Div Wavelength FGV Instructions="Read Loaded Data", Error In=w11) -> (Dividing Wavelength Calibration Data Out=w17, Error Out=w18)
      Logical And[output inverted](not w12, w13) -> w19
      Property Node(instance in=w4) -> ("Wavelength Step (nm)"=w20)
      Multiply(w20, 1000) -> w21
      Select(s=w19, t=w21, f=1) -> w22
      s1 = w18  # shift register
      s2 = w14  # shift register
      s3 = w16  # shift register
      s4 = 0  # shift register
      for (N -> w23) (iteration -> i1) {
        w24 = each element of w10
        Property Node(instance in=w24) -> ("Dividing Wavelength Array"=w25, "Rainbow Sweep Types"=w26)
        s5 = s1  # shift register
        s6 = s2  # shift register
        s7 = s4  # shift register
        s8 = s3  # shift register
        for (N -> w27) {
          w28 = each element of w25
          Increment(x=s7) -> w29
          Multiply(w27, w23) -> w30
          call "FGV Global Abort.gvi"(Global Abort Instructions="Read Current State", Error In=s5) -> (Local Abort Out=w31, Global Abort Out=w32, Error Out=w33)
          call "KCube Dividing Wavelength Translator.gvi"(Dividing Wavelength=w28, Instrument Control Mega Cluster In=s6, Dividing Wavelength Calibration Data In=w17, Error In=w33, Rainbow Sweep Types=w26) -> (Real Dividing Wavelength=w34, Instrument Control Mega Cluster Out=w35, Error Out=w36)
          call "Wait ms.gvi"(Error In=w36, Milliseconds to Wait=w22) -> (Error Out=w37)
          call "Photodetector Measure Power.gvi"(Instrument Control Mega Cluster In=w35, Error In=w37) -> (Instrument Control Mega Cluster Out=w38, Measured Power=w39, Error Out=w40)
          Property Node(instance in="LPC Sweep Live Parameters.gtype" {all zero or empty}, "Light Power (W) "=w39, "Current Wavelength (nm)"=w34, "Rainbow Sweep Types"=w26) -> (instance out=w41)
          Array Index(array=s8) -> (out0[i1]=w42)
          Property Node(instance in=w42) -> ("Single Light Calibration"=w43, instance out=w44)
          Property Node(instance in=w43) -> ("Dividing Wavelength Array"=w45, "Measured Power Array"=w46, instance out=w47)
          Build Array(w45, w34) -> w48
          Build Array(w46, w39) -> w49
          Property Node(instance in=w47, "Dividing Wavelength Array"=w48, "Measured Power Array"=w49) -> (instance out=w50)
          Property Node(instance in=w44, "Single Light Calibration"=w50, "Rainbow Sweep Types"=w26, "Total Light Power Density"=w8) -> (instance out=w51)
          Replace Array Subset(inArray=s8, index=i1, new=w51) -> w52
          call "Multiple Page Graph Adapter.gvi"(Full Data Array=w52, Error In=w40) -> (Output Bundled Data=w53, Output Graph Ready Data=w54, Error Out=w55)
          call "Light Calibration Live Parameters FGV.gvi"(FGV Instructions="Set State", Light Calibration Live Parameters In=w41, Output Graph Ready Data=w54, Error In=w55, Graph Bundled data=w53) -> (Error Out=w56)
          call "Progress General Calculator.gvi"(Starting Value=40, Ending Value=80, Number Of Steps=w30, Current Step=s7, Error In=w56) -> (Current Progress=w57, Error Out=w58)
          call "Progress FGV.gvi"(FGV Instructions="Set State", Progress In=w57, Error In=w58) -> (Error Out=w59)
          Logical Or(w31, w32) -> w60
          next s5 = w59
          next s6 = w38
          next s7 = w29
          next s8 = w52
          stop if w60
        }
        call "Multiple Page Graph Adapter.gvi"(Full Data Array=s8, Error In=s5) -> (Output Bundled Data=w61, Output Graph Ready Data=w62, Error Out=w63)
        call "Light Calibration Live Parameters FGV.gvi"(FGV Instructions="Set State", Light Calibration Live Parameters In=w41, Output Graph Ready Data=w62, Error In=w63, Graph Bundled data=w61) -> (Error Out=w64)
        call "KCube Move to 0 or Home.gvi"(Instrument Control Mega Cluster In=s6, Error In=w64) -> (Instrument Control Mega Cluster Out=w65, Error Out=w66)
        next s1 = w66
        next s2 = w65
        next s3 = s8
        next s4 = s7
        stop if w60
      }
      Property Node(instance in=w5, "Light Power Calibration Data"=s3) -> (instance out=w3)
      call "Multiple Page Graph Adapter.gvi"(Full Data Array=s3, Error In=s1) -> (Output Bundled Data=w67, Output Graph Ready Data=w68, Error Out=w69)
      call "Light Calibration Live Parameters FGV.gvi"(FGV Instructions="Set State", Light Calibration Live Parameters In=w41, Output Graph Ready Data=w68, Error In=w69, Graph Bundled data=w67) -> (Error Out=w70)
      call "KCube Move to 0 or Home.gvi"(Instrument Control Mega Cluster In=s2, Error In=w70) -> (Instrument Control Mega Cluster Out=w2, Error Out=w1)
    }
  }
  $"LPC Mega Cluster Out" <- w3
  $"Instrument Control Mega Cluster Out" <- w2
  $"Error Out" <- w1
