vi "XZ Locking Movement Subroutine.gvi"   [LabVIEW NXG 5.0.0]
inputs:
  "Error In": error
  "Instrument Control Mega Cluster In": "Instrument Control Mega Cluster.gtype"
  "Misc Data Mega Cluster In": "Misc Data Mega Cluster.gtype"
outputs:
  "Error Out": error
  "Instrument Control Mega Cluster Out": "Instrument Control Mega Cluster.gtype"
types:
  "Instrument Coms Info.gtype" = cluster{"Arduino Coms Info": "Arduino Detection cluster control.gtype", "Photodetector Names": string[], "Keythley Address": "VISA Instr", "Photodetector Detected?": bool, "Thorlabs Motors Detected?": bool, "Keithley Detected?": bool, "Thorlabs Motors Serial Number": "Thorlabs Motors Serial Number In.gtype", "Photodetector IVI session": "Ivi IviDefault", "Flame ID": string, "Flame Detected?": bool, "Flame Wrapper ID": u64}
  "Debugging Cluster.gtype" = cluster{"Debugging mode?": bool, "Initialize App": bool, "Insturment Debugging": "Insturment Debugging Cluster.gtype"}
  "Instrument Control Mega Cluster.gtype" = cluster{"Instruments Coms Info": "Instrument Coms Info.gtype", "Debugging Cluster": "Debugging Cluster.gtype"}
  "Full Reference Cluster.gtype" = cluster{"Enum Reference Cluster": "Enum Control Reference Cluster.gtype", "Boolean Reference Cluster": "Boolean Control Reference Cluster.gtype", "Numeric Reference Cluster": "Numeric Control Reference Cluster.gtype", "Numeric Cluster Reference Cluster": "Numeric Cluster Reference Cluster.gtype", "Path Reference Cluster": "Path Reference Cluster.gtype", "Cluster Reference Cluster": "Cluster Reference Cluster.gtype", "XZ Stage Controls Reference Cluster": "XZ Stage Controls Reference Cluster.gtype"}
  "Cell Naming Cluster.gtype" = cluster{"Cell Label": string, "Sample Prefix": string, "Author Initials": string, "Current Date": string, "Batch Name": string}
  T1 = cluster{"X Coordinate (mm)": f64, "Z Coordinate (mm)": f64}
  T2 = cluster{"X Coordinate (mm)": f64, "Z Coordinate (mm)": f64, "Vertical Spacing (mm)": f64}
  "XZ All Position Cluster.gtype" = cluster{"Diffusor Coordinates": T1, "Photodetector Coordinates": T1, "Cell R.01 Coordinates": T2}
  T3 = cluster{"Thorlabs Motor Serial Number File Path": path, "Default Data Saving Location": path}
  "Misc Data Mega Cluster.gtype" = cluster{"Full Reference Cluster": "Full Reference Cluster.gtype", "Cell Naming Cluster": "Cell Naming Cluster.gtype", "All XZ Position Cluster": "XZ All Position Cluster.gtype", "All Paths": T3}
uses:
  Rainbow Measurement Setup::Main Functions::Instruction Queue::Current State::FGV Current State.gvi
  Rainbow Measurement Setup::Main Functions::XZ Stage Movements::Enable and Disable XZ Controls.gvi
  Rainbow Measurement Setup::Side Functions::Instrument Control::Arduino::XZ Stage Arduino::XZ Stage Initialize And Home.gvi
  Rainbow Measurement Setup::Main Functions::XZ Stage Movements::Check Current tab is XZ Stage.gvi
  Rainbow Measurement Setup::Side Functions::Instrument Control::Arduino::XZ Stage Arduino::XZ Stage Label to Coordinates.gvi
  Rainbow Measurement Setup::Side Functions::Instrument Control::Arduino::XZ Stage Arduino::XZ Stage Move to Position.gvi
  Rainbow Measurement Setup::Side Functions::Global Abort::FGV Global Abort.gvi
  Rainbow Measurement Setup::Side Functions::Instrument Control::Arduino::XZ Stage Arduino::XZ Stage Close Coms.gvi
diagram:
  # This SubVI Moves the XZ Stage to the desired position, which can be either a predetermined cell or a set of custom coordinates.
  case ($"Error In") {
    frame Error, Default {
      w1 = $"Error In"
      w2 = $"Instrument Control Mega Cluster In"
    }
    frame No Error {
      call "FGV Current State.gvi"(Current State Instructions="Set Current State", Current State="Move XZ Stage", Error In=$"Error In") -> (Error Out=w3)
      call "Enable and Disable XZ Controls.gvi"(Misc Data Mega Cluster In=$"Misc Data Mega Cluster In", Error In=w3, Activate Arduino?=TRUE) -> (Misc Data Mega Cluster Out=w4, Error Out=w5)
      call "XZ Stage Initialize And Home.gvi"(Instrument Control Mega Cluster In=$"Instrument Control Mega Cluster In", Error In=w5) -> (Instrument Control Mega Cluster Out=w6, Error Out=w7)
      s1 = w4  # shift register
      s2 = w6  # shift register
      s3 = w7  # shift register
      while {
        call "Check Current tab is XZ Stage.gvi"(Misc Data Mega Cluster In=s1, Error In=s3) -> (Misc Data Mega Cluster Out=w8, Not in tab?=w9, Error Out=w10)
        Property Node(instance in=w8) -> ("Full Reference Cluster:XZ Stage Controls Reference Cluster:Set Position"=w11, "Full Reference Cluster:XZ Stage Controls Reference Cluster:Custom Position"=w12, "Full Reference Cluster:XZ Stage Controls Reference Cluster:XZ Stage Cell Reference"=w13, "Full Reference Cluster:XZ Stage Controls Reference Cluster:XZ Coordinates"=w14, "Full Reference Cluster:XZ Stage Controls Reference Cluster:Release XZ Stage"=w15, instance out=w16)
        Property Node(instance in=w11, error in=w10) -> ("Value"=w17, error out=w18, instance out=w19)
        Property Node(instance in=w19, "Value"=FALSE, error in=w18) -> (error out=w20)
        Property Node(instance in=w15, error in=w20) -> ("Value"=w21, error out=w22, instance out=w23)
        Property Node(instance in=w23, "Value"=FALSE, error in=w22) -> (error out=w24)
        Property Node(instance in=w12, error in=w24) -> ("Value"=w25, error out=w26)
        Not(x=w25) -> w27
        Property Node(instance in=w14, "Disabled"=w27, error in=w26) -> ("Value"=w28, error out=w29)
        case (w17) {
          frame False, Default {
            w30 = s2
            w31 = w29
            w32 = w16
          }
          frame True {
            case (w25) {
              frame False, Default {
                Property Node(instance in=w13) -> ("Value"=w36)
                Format Into String(errIn=w29, w36) -> (outString=w37, errOut=w38)
                Concatenate Strings("Moving Arduino to ", w37) -> w35
                call "XZ Stage Label to Coordinates.gvi"(Cell Label=w37, Misc Data Mega Cluster In=w16, Error In=w38) -> (XZ Coordinate Out=w34, Error Out=w33)
                w32 = w16
              }
              frame True {
                Property Node(instance in=w28) -> ("X Coordinate (mm)"=w39, "Z Coordinate (mm)"=w40, instance out=w34)
                Number To Fractional String(number=w39, precision (6)=1, use system decimal point (T)=FALSE) -> (F-format string=w41)
                Number To Fractional String(number=w40, precision (6)=1, use system decimal point (T)=FALSE) -> (F-format string=w42)
                Concatenate Strings("Moving Arduino to X =  ", w41, " mm, Z = ", w42, " mm") -> w35
                w33 = w29
                w32 = w16
              }
            }
            call "FGV Current State.gvi"(Current State Instructions="Set Current Substate", Current Substate=w35, Error In=w33) -> (Error Out=w43)
            call "XZ Stage Move to Position.gvi"(Instrument Control Mega Cluster In=s2, Error In=w43, XZ Coordinate Cluster In=w34) -> (Instrument Control Mega Cluster Out=w30, Error Out=w31)
          }
        }
        call "FGV Global Abort.gvi"(Global Abort Instructions="Read Current State", Error In=w31) -> (Local Abort Out=w44, Global Abort Out=w45, Error Out=w46)
        Logical Or(w9, w44, w45, w21) -> w47
        Wait Until Next Multiple(multiple to wait=50)
        next s1 = w32
        next s2 = w30
        next s3 = w46
        stop if w47
      }
      call "XZ Stage Close Coms.gvi"(Instrument Control Mega Cluster In=s2, Error In=s3) -> (Instrument Control Mega Cluster Out=w2, Error Out=w48)
      call "Enable and Disable XZ Controls.gvi"(Misc Data Mega Cluster In=s1, Error In=w48, Activate Arduino?=FALSE) -> (Error Out=w1)
    }
  }
  $"Instrument Control Mega Cluster Out" <- w2
  $"Error Out" <- w1
