vi "Main Window.gvi"   [LabVIEW NXG 5.0.0]
panel controls:
  "Main Tab": i32
  "Light Calibration Tab": i32
  "New Spectrum Calibration": bool
  "Load Spectrum Calibration": bool
  "Save Spectrum Calibration": bool
  "Configuration Tab": i32
  "Abort Button": bool
  "Exit App Button": bool
  "Debugging Cluster": "Debugging Cluster.gtype"
  "Rainbow Measurement tab": i32
  "Instrument Coms Info": "Instrument Coms Info.gtype"
  "Rainbow Sweep Param Selector MSpot": "Rainbow Sweep Param Selector.gtype" = {0, 1100, 300, 1, 1, 0}
  "Check Dividing Wavelength Calibration": bool
  "New Dividing Wavelength Calibration": bool
  "Load Dividing Wavelength Calibration": bool
  "Desired MSpot Calibration Operation": "Calibration Operation Control.gtype" = "Check Calibration"
  "MSpot Sperctrum Calibration Parameters": "MSpot Spectrum Calibration Parameters.gtype" = {"Min Position (mm)"=0, "Max Position (mm)"=50, "Position step size (mm)"=0.1, "Manual Spectra?"=FALSE, "Flame Integration Time (us)"=1000, "Flame Scans to Average"=1000}
  "New Light Power Calibration": bool
  "Load Light Power Calibration": bool
  "Save Light Power Calibration": bool
  "Rainbow Sweep Parameters LPC": "Rainbow Sweep Param Selector.gtype" = {0, 900, 400, 1, 1, 0}
  "Default Data Saving Location": path = path "D:\\Rainbow Measurements"
  "Light Power Calibration Data": "Light Power Calibration Data.gtype"[]
  "Cell Naming Cluster": "Cell Naming Cluster.gtype"
  "Custom date": bool
  "Author Initials": string
  "Batch Name": string
  "Cell Number": string
  "Sample Comments": string
  "Current Date": string
  "Acquire Single Rainbow Button": bool
  "Load Single Measurement": bool
  "Save Single Measurement": bool
  "Rainbow Sweep Parameters SRM": "Rainbow Sweep Param Selector.gtype" = {0, 900, 400, 1, 1, 0}
  "LPC Parameters": "Light power Calibration Parameters.gtype" = {"Powermeter Averages"=3}
  "SRM Raw Plot Rainbow Sweep Selector": string
  "SRM Refined Plot Rainbow Sweep Types": string
  "Save Coordinates": bool
  "Main Tab": i32 = 1
  "SRM Plot Parameter Selector": "SRM Refined Plot Parameter Selector.gtype" = "Efficiency (%)"
  "SRM Specific Parameters": "SRM Specific Parameters.gtype" = {"Max (V)"=1.2, "Min (V)"=-0.2, "V Points"=100, "Current Range (A)"=0.1, "Autorange"=TRUE, "Sweep Dir"=FALSE, "Current Averages"=3, "Max (A)"=1, "Integration Time"=0.5, "Cell Area (m^2)"=8e-06}
  "Full Reference Cluster": "Full Reference Cluster.gtype"
  "Full Beam Multispectral Data Array": "Full MSpot Multispectral Data.gtype"[]
  "Activate XZ Stage": bool
  "Set Postion": bool
  "Release XZ Stage": bool
  "XZ Stage Active": bool
  "XZ Stage Cell": T6 = "L.01"
  "Custom Position": bool
  "Acquire Single Rainbow Button_2": bool
  "Load Single Measurement_2": bool
  "Save Single Measurement_2": bool
  "Rainbow Sweep Parameters MRM": "Rainbow Sweep Param Selector.gtype" = {0, 900, 400, 1, 1, 0}
  "MRM Raw Plot Rainbow Sweep Selector": string
  "MRM Specific Parameters": "MRM Specific Parameters.gtype" = {"Max (V)"=1.2, "Min (V)"=-0.5, "V Points"=100, "Curr Range (A)"=0, "Sweep Dir"=FALSE, "Current Avg"=3, "Max (A)"=0.1, "Integration Time"=0.5, "Cell Area (m^2)"=8e-06, "Autorange"=TRUE}
  "XZ All Position Cluster": "XZ All Position Cluster.gtype" = {188, 30, 39, 70, 146, 32.6, 0}
  "XZ Coordinate": "XZ Coordinate Cluster In.gtype"
  "Misc Data Mega Cluster": "Misc Data Mega Cluster.gtype"
  "Live And Plot Mega Cluster": "Live And Plot Mega Cluster.gtype"
  "Instrument Control Mega Cluster": "Instrument Control Mega Cluster.gtype"
  "MSpot Mega Cluster": "MSpot Mega Cluster.gtype"
panel indicators:
  "Irradiance Calibration": f64[]
  "Current State": "Queue Instructions Control.gtype"
  "Current Sub State": string
  "Beam Power Density": f64[][]
  "Path Where the Calibration Files Will Be Stored (Can't Be Changed)": path
  "Light Power Calibration": cluster{"Wavelength": f64[], "Power": f64[]}[]
  "Sample Prefix": string
  "Progress %": f64
  "Progress counter": f64
  "State": string
  "Substate": string
  "Label Info Error Label": string
  "Label Info Missing Error": bool
  "IV Plot Out": "SRM Single Plot Cluster.gtype"[]
  "SRM Full IV data Array": "IV Full Data Cluster.gtype"[]
  "IV Extracted Parameter Plot": T5
  "Sweep Live Parameters LPC": "LPC Sweep Live Parameters.gtype"
  "Sweep Live Parameters RSM": "SRM Sweep Live Parameters.gtype"
  "IV Plot Out Multiple": "SRM Single Plot Cluster.gtype"[]
types:
  "Queue Instructions Control.gtype" = enum{"Undefined State", "Debug Check", "Initialize App", "Idle", "Light Power Calibration", "Rainbow Single Measurement", "Light Calibration Irradiance", "Light Calibration Spectral Density", "Light Calibration Power Density", "MSpot Spectrum Calibration", "Move XZ Stage", "Update All Info Meta Cluster", "Access TXT File", "Stop App"}
  "Insturment Debugging Cluster.gtype" = cluster{"Keithley": bool, "Arduinos": bool, "Thorlabs Motors": bool, "Photodetector": bool, "Flame Spectr": bool}
  "Debugging Cluster.gtype" = cluster{"Debugging mode?": bool, "Initialize App": bool, "Insturment Debugging": "Insturment Debugging Cluster.gtype"}
  T1 = cluster{"Element 1": "VISA Instr", "Element 2": string}
  "Arduino Detection cluster control.gtype" = cluster{"XZ Stage Arduino Address": "VISA Instr", "XZ Stage Arduino Detected?": bool, "Multiplexer Arduino Detected?": bool, "Multiplexer Arduino Address": "VISA Instr", "Arduinos List": T1[], "XZ Stage Log": string, "Multiplexer Log": string}
  "Thorlabs Motors Serial Number In.gtype" = cluster{"Thorlabs Blue Motor": string, "Thorlabs Red Motor": string, "Blue Motor Homed?": bool, "Red Motor Homed?": bool}
  "Instrument Coms Info.gtype" = cluster{"Arduino Coms Info": "Arduino Detection cluster control.gtype", "Photodetector Names": string[], "Keythley Address": "VISA Instr", "Photodetector Detected?": bool, "Thorlabs Motors Detected?": bool, "Keithley Detected?": bool, "Thorlabs Motors Serial Number": "Thorlabs Motors Serial Number In.gtype", "Photodetector IVI session": "Ivi IviDefault", "Flame ID": string, "Flame Detected?": bool, "Flame Wrapper ID": u64}
  "Raibow Sweep Selector.gtype" = enum{"Red Sweep", "Blue Sweep", "Full Sweep Red First", "Full Sweep Blue First"}
  T2 = enum{"Red Sweep Closing", "Red Sweep Opening", "Red Sweep Both Ways"}
  T3 = enum{"Blue Sweep Opening", "Blue Sweep Closing", "Blue Sweep Both Ways"}
  "Rainbow Sweep Type Selector.gtype" = cluster{"Red Sweep Mode": T2, "Blue Sweep Mode": T3}
  "Rainbow Sweep Param Selector.gtype" = cluster{"Raibow Sweep Selector": "Raibow Sweep Selector.gtype", "Max Wavelength (nm)": f64, "Min Wavelength (nm)": f64, "Wavelength Step (nm)": f64, "Rainbow Sweep Type Selector": "Rainbow Sweep Type Selector.gtype"}
  "Calibration Operation Control.gtype" = enum{"Check Calibration", "Load Calibration", "New Calibration"}
  "MSpot Spectrum Calibration Parameters.gtype" = cluster{"Min Position (mm)": f64, "Max Position (mm)": f64, "Position step size (mm)": f64, "Manual Spectra?": bool, "Flame Integration Time (us)": f64, "Flame Scans to Average": u32}
  T4 = cluster{"Dividing Wavelength Array": f64[], "Measured Power Array": f64[]}
  "Rainbow Sweep Types.gtype" = enum{"Red Sweep Closing", "Red Sweep Opening", "Blue Sweep Closing", "Blue Sweep Opening"}
  "Light Power Calibration Data.gtype" = cluster{"Single Light Calibration": T4, "Rainbow Sweep Types": "Rainbow Sweep Types.gtype"}
  "Cell Naming Cluster.gtype" = cluster{"Cell Label": string, "Sample Prefix": string, "Author Initials": string, "Current Date": string, "Batch Name": string}
  "SRM Single Plot Cluster.gtype" = cluster{"Voltage": f64[], "Current Density": f64[]}
  "Light power Calibration Parameters.gtype" = cluster{"Powermeter Averages": f64}
  "IV Single Measurement.gtype" = cluster{"Voltage": f64[], "Current": f64[], "Current Density": f64[], "Dividing Wavelength": f64, "Light Power": f64}
  "IV Refined Full Sweep Data.gtype" = cluster{"Rs (Ω/m^2)": f64[], "Rsh (Ω/m^2)": f64[], "Jsc (A/m^2)": f64[], "Voc (V)": f64[], "FF (%)": f64[], "Efficiency (%)": f64[], "Dividing Wavelength (nm)": f64[], "Light Power (W)": f64[]}
  "IV Full Data Cluster.gtype" = cluster{"IV Measurements Array": "IV Single Measurement.gtype"[], "Rainbow Sweep Types": "Rainbow Sweep Types.gtype", "IV Refined Data": "IV Refined Full Sweep Data.gtype"}
  T5 = cluster{"Dividing Wavelength (nm)": f64[], "Element 2": f64[]}
  "LPC Sweep Live Parameters.gtype" = cluster{"Light Power (W) ": f64, "Current Wavelength (nm)": f64, "Rainbow Sweep Types": "Rainbow Sweep Types.gtype"}
  "SRM Refined Plot Parameter Selector.gtype" = enum{"Efficiency (%)", "Jsc (A)", "Voc (V)", "Light Power (W)", "FF (%)", "Rs (Ω/m^2)", "Rsh (Ω/m^2)"}
  "SRM Specific Parameters.gtype" = cluster{"Max (V)": f64, "Min (V)": f64, "V Points": u32, "Current Range (A)": f64, "Autorange": bool, "Sweep Dir": bool, "Current Averages": u32, "Max (A)": f64, "Integration Time": f64, "Cell Area (m^2)": f64}
  "Enum Control Reference Cluster.gtype" = cluster{"Main Tab": "TabControl reference", "Rainbow Measurement tab": "TabControl reference", "Configuration tab": "TabControl reference", "Light Calibration tab": "TabControl reference", "SRM Plot Parameter Selector": "EnumSelector reference"}
  "Boolean Control Reference Cluster.gtype" = cluster{"Custem date": "CheckBox reference", "Label Info Missing Error": "BooleanControl reference"}
  "Numeric Control Reference Cluster.gtype" = cluster{"Beam Power Density": "IntensityGraph reference"[][], "Irradiance Calibration": "Graph reference"[]}
  "Numeric Cluster Reference Cluster.gtype" = cluster{"LPC Parameters": "Cluster reference", "Sweep Live Parameters LPC": "Cluster reference"}
  "Path Reference Cluster.gtype" = cluster{"Calibration Files Path": "PathSelector reference", "Default Data Saving Location": "PathSelector reference"}
  "Cluster Reference Cluster.gtype" = cluster{"Light Power Calibration": "Graph reference", "Light Power Calibration Data": "ArrayViewer reference", "Rainbow Sweep Parameters RSM": "Cluster reference", "Rainbow Sweep Param Selector MSpot": "Cluster reference", "MSpot Spectrum Calibration Parameters": "Cluster reference", "SRM Raw Plot Rainbow Sweep Selector": "ComboBoxSelector reference", "SRM Refined Plot Rainbow Sweep Types": "ComboBoxSelector reference", "SRM Specific Parameters": "Cluster reference", "Label Info Error Label": "StringControl reference", "Sample Comments": "StringControl reference", "Cell Number": "StringControl reference", "Author Initials": "ComboBoxSelector reference", "Batch Name": "StringControl reference", "IV Plot Out ": "Graph reference", "Sweep Live Parameters RSM": "Cluster reference", "Rainbow Sweep Parameters LPC": "Cluster reference", "XZ All Position Cluster": "Cluster reference"}
  "XZ Stage Controls Reference Cluster.gtype" = cluster{"Cell Label": "EnumSelector reference", "Custom Position": "BooleanControl reference", "Set Position": "BooleanControl reference", "XZ Stage Active": "BooleanControl reference", "Release XZ Stage": "BooleanControl reference", "XZ Coordinates": "Cluster reference", "Activate XZ Stage": "BooleanControl reference"}
  "Full Reference Cluster.gtype" = cluster{"Enum Reference Cluster": "Enum Control Reference Cluster.gtype", "Boolean Reference Cluster": "Boolean Control Reference Cluster.gtype", "Numeric Reference Cluster": "Numeric Control Reference Cluster.gtype", "Numeric Cluster Reference Cluster": "Numeric Cluster Reference Cluster.gtype", "Path Reference Cluster": "Path Reference Cluster.gtype", "Cluster Reference Cluster": "Cluster Reference Cluster.gtype", "XZ Stage Controls Reference Cluster": "XZ Stage Controls Reference Cluster.gtype"}
  "SRM Sweep Live Parameters.gtype" = cluster{"Current Wavelength (nm)": f64, "Rainbow Sweep Types": "Rainbow Sweep Types.gtype", "Finished Measurement?": bool}
  "MSpot Spectrum Data.gtype" = cluster{"M Spot Spectrum": cluster{"Wavelength": f64[], "Counts": f64[]}, "Blue Motor Position (mm)": f64, "Red Motor Position (mm)": f64, "Dividing Wavelength (nm)": f64}
  "Full MSpot Multispectral Data.gtype" = cluster{"MSpot Spectrum Data Array": "MSpot Spectrum Data.gtype"[], "Rainbow Sweep Types": "Rainbow Sweep Types.gtype"}
  T6 = enum{"L.01", "L.02", "L.03", "L.04", "L.05", "L.06", "L.07", "L.08", "L.09", "L.10", "L.11", "L.12", "R.01", "R.02", "R.03", "R.04", "R.05", "R.06", "R.07", "R.08", "R.09", "R.10", "R.11", "R.12"}
  "MRM Specific Parameters.gtype" = cluster{"Max (V)": f64, "Min (V)": f64, "V Points": u32, "Curr Range (A)": f64, "Sweep Dir": bool, "Current Avg": u32, "Max (A)": f64, "Integration Time": f64, "Cell Area (m^2)": f64, "Autorange": bool}
  T7 = cluster{"X Coordinate (mm)": f64, "Z Coordinate (mm)": f64}
  T8 = cluster{"X Coordinate (mm)": f64, "Z Coordinate (mm)": f64, "Vertical Spacing (mm)": f64}
  "XZ All Position Cluster.gtype" = cluster{"Diffusor Coordinates": T7, "Photodetector Coordinates": T7, "Cell R.01 Coordinates": T8}
  "XZ Coordinate Cluster In.gtype" = cluster{"X Coordinate (mm)": f64, "Z Coordinate (mm)": f64}
  T9 = cluster{"Thorlabs Motor Serial Number File Path": path, "Default Data Saving Location": path}
  "Misc Data Mega Cluster.gtype" = cluster{"Full Reference Cluster": "Full Reference Cluster.gtype", "Cell Naming Cluster": "Cell Naming Cluster.gtype", "All XZ Position Cluster": "XZ All Position Cluster.gtype", "All Paths": T9}
  "Live And Plot Mega Cluster.gtype" = cluster{"Sweep Live Parameters RSM": "SRM Sweep Live Parameters.gtype", "IV Plot Out": "SRM Single Plot Cluster.gtype"[], "IV Extracted Parameter Plot": T5, "Sweep Live Parameters LPC": "LPC Sweep Live Parameters.gtype", "Light Power Calibration": cluster{"Wavelength": f64[], "Power": f64[]}[]}
  "Instrument Control Mega Cluster.gtype" = cluster{"Instruments Coms Info": "Instrument Coms Info.gtype", "Debugging Cluster": "Debugging Cluster.gtype"}
  "MSpot Mega Cluster.gtype" = cluster{"Rainbow Sweep Parameters MSpot": "Rainbow Sweep Param Selector.gtype", "MSpot Sperctrum Calibration Parameters": "MSpot Spectrum Calibration Parameters.gtype", "Full Beam Multispectral Data Array": "Full MSpot Multispectral Data.gtype"[]}
  "Sample Naming Cluster.gtype" = cluster{"Author Initials": string, "Batch Name": string, "Sample Comments": string, "Main Tab control": i32, "Rainbow Measurement tab": i32, "Cell Number": string, "Cell Number ref": "StringControl reference", "Custom date": bool, "Current Date": string, "Current Date ref": "StringControl reference"}
uses:
  Rainbow Measurement Setup::Side Functions::Global Abort::FGV Global Abort.gvi
  Rainbow Measurement Setup::Main Functions::Instruction Queue::Current State::FGV Current State.gvi
  Rainbow Measurement Setup::Main Functions::Debugging::Debugging Prompt.gvi
  Rainbow Measurement Setup::Main Functions::Initialize App::Initialize app subroutine.gvi
  Rainbow Measurement Setup::Side Functions::Utilities::Progress Handling::Progress FGV.gvi
  Rainbow Measurement Setup::Main Functions::One Time Calibrations::MSpot Spectrum::File Handling::MSpot Folder Check.gvi
  Rainbow Measurement Setup::Main Functions::One Time Calibrations::MSpot Spectrum::MSpot Spectrum Calibration Subroutine.gvi
  Rainbow Measurement Setup::Main Functions::Rainbow Measurement::Light Power Calibration::Light Power Calibration Subroutine.gvi
  Rainbow Measurement Setup::Main Functions::XZ Stage Movements::XZ Locking Movement Subroutine.gvi
  Rainbow Measurement Setup::Main Functions::Rainbow Measurement::Cell Single Rainbow Measurement::Single Rainbow Measurement Subroutine.gvi
  NI::G Core::Error::Is Error.gvi
  Rainbow Measurement Setup::Side Functions::Global Abort::Global Abort Sequence.gvi
  Rainbow Measurement Setup::Side Functions::Timeout Sequence.gvi
  Rainbow Measurement Setup::Side Functions::Timeout Read FGV Data Subroutine.gvi
  Rainbow Measurement Setup::Side Functions::Exit App Sequence.gvi
  Rainbow Measurement Setup::Main Functions::Instruction Queue::Check Queue And Label.gvi
  Rainbow Measurement Setup::Main Functions::Instruction Queue::Conditional Enqueue.gvi
  Rainbow Measurement Setup::Main Functions::One Time Calibrations::MSpot Spectrum::MSpot Calibration Operation Translator.gvi
  Rainbow Measurement Setup::Side Functions::Sample Naming::Sample Name Checkup Subroutine.gvi
  Rainbow Measurement Setup::Side Functions::Sample Naming::Sample Prefix FGV.gvi
  Rainbow Measurement Setup::Main Functions::Rainbow Measurement::Light Power Calibration::Light Power Calibration Operation Translator.gvi
  Rainbow Measurement Setup::Main Functions::Rainbow Measurement::Cell Single Rainbow Measurement::SRM Operation Translator.gvi
  Rainbow Measurement Setup::Side Functions::Instrument Control::Arduino::XZ Stage Arduino::XZ Move Requisites.gvi
  NI::G Core::Error::Multiplex Errors.gvi
  NI::G Core::Error::Display Error.gvi
diagram:
  case (TRUE) {
    frame False, Default {
      w1 = no error
    }
    frame True {
      Property Node(instance in="Enum Control Reference Cluster.gtype" {all zero or empty}, "Main Tab"=reference to "Main Tab", "Rainbow Measurement tab"=reference to "Rainbow Measurement tab", "Configuration tab"=reference to "Configuration Tab", "Light Calibration tab"=reference to "Light Calibration Tab", "SRM Plot Parameter Selector"=reference to "SRM Plot Parameter Selector") -> (instance out=w2)
      w3 = "Boolean Control Reference Cluster.gtype" {all zero or empty}
      Property Node(instance in=w3, "Custem date"=reference to "Custom date", "Label Info Missing Error"=reference to "Label Info Missing Error") -> (instance out=w4)
      w5 = "Numeric Control Reference Cluster.gtype" {all zero or empty}
      Property Node(instance in=w5, "Beam Power Density"=reference to "Beam Power Density", "Irradiance Calibration"=reference to "Irradiance Calibration") -> (instance out=w6)
      w7 = "Numeric Cluster Reference Cluster.gtype" {all zero or empty}
      Property Node(instance in=w7, "LPC Parameters"=reference to "LPC Parameters", "Sweep Live Parameters LPC"=reference to "Sweep Live Parameters LPC") -> (instance out=w8)
      w9 = reference to "Path Where the Calibration Files Will Be Stored (Can't Be Changed)"
      Property Node(instance in="Path Reference Cluster.gtype" {all zero or empty}, "Calibration Files Path"=w9, "Default Data Saving Location"=reference to "Default Data Saving Location") -> (instance out=w10)
      Property Node(instance in="Cluster Reference Cluster.gtype" {all zero or empty}, "Light Power Calibration"=reference to "Light Power Calibration", "Light Power Calibration Data"=reference to "Light Power Calibration Data", "Rainbow Sweep Parameters LPC"=reference to "Rainbow Sweep Parameters LPC", "Rainbow Sweep Parameters RSM"=reference to "Rainbow Sweep Parameters SRM", "Rainbow Sweep Param Selector MSpot"=reference to "Rainbow Sweep Param Selector MSpot", "MSpot Spectrum Calibration Parameters"=reference to "MSpot Sperctrum Calibration Parameters", "SRM Raw Plot Rainbow Sweep Selector"=reference to "SRM Raw Plot Rainbow Sweep Selector", "SRM Refined Plot Rainbow Sweep Types"=reference to "SRM Refined Plot Rainbow Sweep Types", "SRM Specific Parameters"=reference to "SRM Specific Parameters", "Sweep Live Parameters RSM"=reference to "Sweep Live Parameters RSM", "XZ All Position Cluster"=reference to "XZ All Position Cluster", "Label Info Error Label"=reference to "Label Info Error Label", "Sample Comments"=reference to "Sample Comments", "Cell Number"=reference to "Cell Number", "Author Initials"=reference to "Author Initials", "Batch Name"=reference to "Batch Name", "IV Plot Out "=reference to "IV Plot Out") -> (instance out=w11)
      w12 = "XZ Stage Controls Reference Cluster.gtype" {all zero or empty}
      Property Node(instance in=w12, "Cell Label"=reference to "XZ Stage Cell", "XZ Coordinates"=reference to "XZ Coordinate", "Custom Position"=reference to "Custom Position", "Set Position"=reference to "Set Postion", "XZ Stage Active"=reference to "XZ Stage Active", "Release XZ Stage"=reference to "Release XZ Stage", "Activate XZ Stage"=reference to "Activate XZ Stage") -> (instance out=w13)
      Property Node(instance in="Full Reference Cluster.gtype" {all zero or empty}, "Enum Reference Cluster"=w2, "Boolean Reference Cluster"=w4, "Numeric Reference Cluster"=w6, "Numeric Cluster Reference Cluster"=w8, "Path Reference Cluster"=w10, "Cluster Reference Cluster"=w11, "XZ Stage Controls Reference Cluster"=w13) -> (instance out=w14)
      Property Node(instance in=$"Misc Data Mega Cluster", "Full Reference Cluster"=w14) -> (instance out=w15)
      $"Misc Data Mega Cluster" <- w15
      w1 = default
    }
  }
  call "FGV Global Abort.gvi"(Global Abort Instructions="Reset State", Error In=w1) -> (Error Out=w16)
  call "FGV Current State.gvi"(Current State Instructions="Set Current State and Substate", Current State="Undefined State", Current Substate="Starting Up", Error In=w16) -> (Error Out=w17)
  Obtain Queue(create if not found=TRUE, element data type="Queue Instructions Control.gtype" "Undefined State", error in=w17, name="Instruction Queue") -> (error out=w18, queue out=w19)
  Enqueue Element(element="Debug Check", error in=w18, queue=w19) -> (error out=w20, queue out=w21)
  s1 = w21  # shift register
  s2 = w20  # shift register
  while {
    # This is the consumer loop, it takes enqueued instructions and performs the ne required actions
    case (s2) {
      frame Error, Default {
        w22 = s2
        w23 = s1
        w24 = TRUE
      }
      frame No Error {
        Dequeue Element(error in=s2, queue=s1) -> (element=w25, error out=w26, queue out=w27)
        case (w25) {
          frame "Undefined State" {
            w22 = w26
            w23 = w27
            w24 = default
          }
          frame "Debug Check" {
            call "Debugging Prompt.gvi"(Instrument Control Mega Cluster In=$"Instrument Control Mega Cluster", Error In=w26) -> (Instrument Control Mega Cluster Out=w28, Error Out=w29)
            Enqueue Element(element="Initialize App", error in=w29, queue=w27) -> (error out=w22, queue out=w23)
            $"Instrument Control Mega Cluster" <- w28
            w24 = default
          }
          frame "Initialize App" {
            call "Initialize app subroutine.gvi"(Instrument Control Mega Cluster In=$"Instrument Control Mega Cluster", Misc Data Mega Cluster In=$"Misc Data Mega Cluster", Error In=w26) -> (Instrument Control Mega Cluster Out=w30, Misc Data Mega Cluster Out=w31, Error Out=w32)
            $"Misc Data Mega Cluster" <- w31
            Enqueue Element(element="Idle", error in=w32, queue=w27) -> (error out=w22, queue out=w23)
            $"Instrument Control Mega Cluster" <- w30
            w24 = default
          }
          frame "Idle", Default {
            call "FGV Global Abort.gvi"(Global Abort Instructions="Reset State", Error In=w26) -> (Error Out=w33)
            call "FGV Current State.gvi"(Current State Instructions="Set Current State and Substate", Current State="Idle", Current Substate="Idle", Error In=w33) -> (Error Out=w34)
            call "Progress FGV.gvi"(FGV Instructions="Reset State", Error In=w34) -> (Error Out=w22)
            w23 = w27
            w24 = default
          }
          frame "MSpot Spectrum Calibration" {
            call "MSpot Folder Check.gvi"(Error In=w26) -> (Calibration Files Folder=w35, Error Out=w36)
            call "MSpot Spectrum Calibration Subroutine.gvi"(Full Beam Multispectral Data Array In=$"Full Beam Multispectral Data Array", XZ All Position Cluster=$"XZ All Position Cluster", Instrument Coms Info In=$"Instrument Coms Info", Rainbow Sweep Param Selector=$"Rainbow Sweep Param Selector MSpot", MSpot Spectrum Calibration Parameters In=$"MSpot Sperctrum Calibration Parameters", Debugging Cluster In=$"Debugging Cluster", Error In=w36, Stand Alone?=FALSE) -> (Instrument Coms Info Out=w37, Full Beam Multispectral Data Array Out=w38, Debugging Cluster Out=w39, Error Out=w40)
            $"Instrument Coms Info" <- w37
            $"Full Beam Multispectral Data Array" <- w38
            $"Debugging Cluster" <- w39
            Enqueue Element(element="Idle", error in=w40, queue=w27) -> (error out=w22, queue out=w23)
            $"Path Where the Calibration Files Will Be Stored (Can't Be Changed)" <- w35
            w24 = default
          }
          frame "Light Power Calibration" {
            call "Light Power Calibration Subroutine.gvi"(Instrument Coms Info In=$"Instrument Coms Info", Debugging Cluster In=$"Debugging Cluster", Rainbow Sweep Param Selector=$"Rainbow Sweep Parameters LPC", Light Power Calibration Data In=$"Light Power Calibration Data", Cell Naming Cluster=$"Cell Naming Cluster", XZ All Position Cluster=$"XZ All Position Cluster", Error In=w26, Default Data Saving Location=$"Default Data Saving Location", Stand Alone?=FALSE) -> (Instuments Coms Info Out=w41, Debugging Cluster Out=w42, Light Power Calibration Data Out=w43, Error Out=w44)
            $"Instrument Coms Info" <- w41
            $"Debugging Cluster" <- w42
            Enqueue Element(element="Idle", error in=w44, queue=w27) -> (error out=w22, queue out=w23)
            $"Light Power Calibration Data" <- w43
            w24 = default
          }
          frame "Move XZ Stage" {
            call "XZ Locking Movement Subroutine.gvi"(Instrument Coms Info=$"Instrument Coms Info", Debugging Cluster In=$"Debugging Cluster", Full Reference Cluster=$"Full Reference Cluster", XZ All Position Cluster=$"XZ All Position Cluster", Error In=w26) -> (Instrument Coms Out=w45, Debugging Cluster Out=w46, Error Out=w22)
            $"Instrument Coms Info" <- w45
            $"Debugging Cluster" <- w46
            w23 = w27
            w24 = default
          }
          frame "Rainbow Single Measurement" {
            call "Single Rainbow Measurement Subroutine.gvi"(XZ All Position Cluster=$"XZ All Position Cluster", Instrument Coms Info In=$"Instrument Coms Info", Debugging Cluster In=$"Debugging Cluster", Light Power Calibration Data=$"Light Power Calibration Data", Instruction Queue In=w27, Default Data Saving Location=$"Default Data Saving Location", Cell Naming Cluster=$"Cell Naming Cluster", Rainbow Sweep Param Selector=$"Rainbow Sweep Parameters SRM", SRM Specific Parameters=$"SRM Specific Parameters", Error In=w26, Stand Alone?=FALSE, Full Reference Cluster=$"Full Reference Cluster") -> (Instuments Coms Info Out=w47, Debugging Cluster Out=w48, Instruction Queue Out=w49, FulL IV data Cluster=w50, SRM Rainbow Parameters=w51, Error Out=w52)
            $"SRM Full IV data Array" <- w50
            $"Debugging Cluster" <- w48
            Enqueue Element(element="Idle", error in=w52, queue=w49) -> (error out=w22, queue out=w23)
            $"Rainbow Sweep Parameters LPC" <- w51
            $"Instrument Coms Info" <- w47
            w24 = default
          }
          frame "Stop App" {
            call "FGV Current State.gvi"(Current State Instructions="Set Current State and Substate", Current State="Stop App", Current Substate="Bye Bye :D", Error In=w26) -> (Error Out=w22)
            w23 = w27
            w24 = TRUE
          }
        }
      }
    }
    call "Is Error.gvi"(error in=w22) -> (error?=w53)
    Logical Or(w53, w24) -> w54
    call "FGV Global Abort.gvi"(Global Abort Instructions="Set State", Global Abort=w54, Error In=w22) -> (Error Out=w55)
    next s1 = w23
    next s2 = w55
    stop if w54
  }
  s3 = w21  # shift register
  s4 = w20  # shift register
  while {
    event (timeout = 100) {
      on "Timeout" {
        call "FGV Global Abort.gvi"(Global Abort Instructions="Read Current State", Error In=s4) -> (Global Abort Out=w59, Error Out=w60)
        Preview Queue Element(error in=w60, queue=s3, timeout in ms=100) -> (element=w61, error out=w56, queue out=w57)
        Is Equal(x=w61, y="Stop App") -> w62
        Logical Or(w62, w59) -> w58
      }
      on "Abort Button" Value changed {
        call "Global Abort Sequence.gvi"(Queue In=s3, Global Abort=$"Abort Button", Error In=s4) -> (Queue Out=w57, Error Out=w56)
        w58 = default
      }
    }
    next s3 = w57
    next s4 = w56
    stop if w58
  }
  Enqueue Element(element="Stop App", error in=s4, queue=s3) -> (error out=w63)
  # This is the main window it takes instructions from the main pannel introduced by the user and
  # performs the corresponding necessary actions
  s5 = w21  # shift register
  s6 = w20  # shift register
  while {
    # This is the producer loop that takes the commands and if possible enqueues them so that the
    # slave loop can perform the corresponding actions
    event (timeout = 100) {
      on "Timeout" {
        call "Progress FGV.gvi"(FGV Instructions="Read State") -> (Progress Out=w67, Error Out=w68)
        call "Timeout Sequence.gvi"(Queue In=s5, Error In=w68) -> (Stop App?=w66, Queue Out=w64, Current State Out=w69, Current SubState Out=w70, State=w71, Error Out=w72)
        $"Current State" <- w69
        $Substate <- w70
        $"Current Sub State" <- w70
        call "Timeout Read FGV Data Subroutine.gvi"(Live And Plot Mega Cluster In=$"Live And Plot Mega Cluster", Misc Data Mega Cluster=$"Misc Data Mega Cluster", Current State=w69, Error In=w72) -> (Live And Plot Mega Cluster Out=w73, Error Out=w65)
        $"Live And Plot Mega Cluster" <- w73
        $State <- w71
        Property Node(instance in=w73) -> ("Sweep Live Parameters RSM"=w74, "IV Plot Out"=w75, "IV Extracted Parameter Plot"=w76, "Sweep Live Parameters LPC"=w77, "Light Power Calibration"=w78)
        $"Sweep Live Parameters RSM" <- w74
        $"Sweep Live Parameters LPC" <- w77
        $"Light Power Calibration" <- w78
        $"Progress %" <- w67
        $"IV Plot Out" <- w75
        $"Progress counter" <- w67
        $"IV Extracted Parameter Plot" <- w76
      }
      on "Exit App Button" Value changed {
        call "Exit App Sequence.gvi"(Queue In=s5, Exit App=$"Exit App Button", Error In=s6) -> (Queue Out=w64, Error Out=w65)
        w66 = default
      }
      on "Check Dividing Wavelength Calibration" Value changed; "Load Dividing Wavelength Calibration" Value changed; "New Dividing Wavelength Calibration" Value changed {
        call "Check Queue And Label.gvi"(Error In=s6) -> (Proceed to enqueue=w79, Error Out=w80)
        call "Conditional Enqueue.gvi"(Queue In=s5, Queue Instruction In="MSpot Spectrum Calibration", Error Out=w80, Equeue?=w79) -> (Queue Out=w64, Error In=w81)
        call "MSpot Calibration Operation Translator.gvi"(Check Dividing Wavelength Calibration=$"Check Dividing Wavelength Calibration", New Dividing Wavelength Calibration=$"New Dividing Wavelength Calibration", Load Dividing Wavelength Calibration=$"Load Dividing Wavelength Calibration", Error In=w81) -> (Error Out=w65)
        w66 = default
      }
      on "Author Initials" Value changed; "Batch Name" Value changed; "Cell Number" Value changed; "Current Date" Value changed; "Custom date" Value changed; "Main Tab" Value changed; "Rainbow Measurement tab" Value changed; "Sample Comments" Value changed; "Sample Prefix" Value changed {
        Property Node(instance in="Sample Naming Cluster.gtype" {all zero or empty}, "Author Initials"=$"Author Initials", "Batch Name"=$"Batch Name", "Sample Comments"=$"Sample Comments", "Main Tab control"=$"Main Tab", "Rainbow Measurement tab"=$"Rainbow Measurement tab", "Cell Number"=$"Cell Number", "Cell Number ref"=reference to "Cell Number", "Custom date"=$"Custom date", "Current Date"=$"Current Date", "Current Date ref"=reference to "Current Date") -> (instance out=w82)
        call "Sample Name Checkup Subroutine.gvi"(Sample Naming Cluster=w82, Error In=s6) -> (Current Date=w83, Sample Prefix=w84, Label Info Error Label=w85, Label Info Missing Error=w86, Error Out=w87, Cell Naming Cluster=w88)
        $"Cell Naming Cluster" <- w88
        $"Sample Prefix" <- w84
        $"Label Info Error Label" <- w85
        call "Sample Prefix FGV.gvi"(FGV Instructions="Set State", Sample Prefix In=w84, Error In=w87) -> (Error Out=w65)
        $"Label Info Missing Error" <- w86
        $"Current Date" <- w83
        w64 = s5
        w66 = default
      }
      on "Load Light Power Calibration" Value changed; "New Light Power Calibration" Value changed; "Save Light Power Calibration" Value changed {
        call "Check Queue And Label.gvi"(Label Info Missing Error=$"Label Info Missing Error", Label Info Error Label=$"Label Info Error Label", Error In=s6, Is Label Necessary?=TRUE) -> (Proceed to enqueue=w89, Error Out=w90)
        call "Conditional Enqueue.gvi"(Queue In=s5, Queue Instruction In="Light Power Calibration", Error Out=w90, Equeue?=w89) -> (Queue Out=w64, Error In=w91)
        call "Light Power Calibration Operation Translator.gvi"(New Light Power Calibration=$"New Light Power Calibration", Load Light Power Calibration=$"Load Light Power Calibration", Save Light Power Calibration=$"Save Light Power Calibration", Error In=w91) -> (Error Out=w65)
        w66 = default
      }
      on "Acquire Single Rainbow Button" Value changed; "Load Single Measurement" Value changed; "Save Single Measurement" Value changed {
        call "Check Queue And Label.gvi"(Label Info Missing Error=$"Label Info Missing Error", Label Info Error Label=$"Label Info Error Label", Error In=s6, Is Label Necessary?=TRUE) -> (Proceed to enqueue=w92, Error Out=w93)
        call "Conditional Enqueue.gvi"(Queue In=s5, Queue Instruction In="Rainbow Single Measurement", Error Out=w93, Equeue?=w92) -> (Queue Out=w64, Error In=w94)
        call "SRM Operation Translator.gvi"(Acquire Single Rainbow Button=$"Acquire Single Rainbow Button", Load Single Measurement=$"Load Single Measurement", Save Single Measurement=$"Save Single Measurement", Error In=w94) -> (Error Out=w65)
        w66 = default
      }
      on "Activate XZ Stage" Value changed {
        call "XZ Move Requisites.gvi"(Debugging Cluster=$"Debugging Cluster", Queue In=s5, Activate XZ Stage=$"Activate XZ Stage", Instrument Coms Info=$"Instrument Coms Info", Error In=s6) -> (Queue Out=w64, Error Out=w65)
        w66 = default
      }
    }
    Logical Or(w65, w66) -> w95
    next s5 = w64
    next s6 = w65
    stop if w95
  }
  Enqueue Element(element="Stop App", error in=s6, queue=s5) -> (error out=w96)
  call "Multiplex Errors.gvi"(error in 1=w96, error in 2=s2, error in 3=w63) -> (error out=w97)
  Flush Queue(error in=w97, queue=s1) -> (error out=w98, queue out=w99)
  Release Queue(error in=w98, queue=w99) -> (error out=w100)
  case (w100) {
    frame Error, Default {
      # In case there is an error
      # put out an error handler
      call "Display Error.gvi"(error in=w100)
    }
    frame No Error { }
  }
