vi "Arduino Detector.gvi"   [LabVIEW NXG 5.0.0]
inputs:
  "Error In": error
outputs:
  "Error Out": error
  "Arduino Detection info Out": "Arduino Detection cluster control.gtype"
panel indicators:
  "Found Resources": string[]
types:
  T1 = cluster{"Element 1": "VISA Instr", "Element 2": string}
  "Arduino Detection cluster control.gtype" = cluster{"XZ Stage Arduino Address": "VISA Instr", "XZ Stage Arduino Detected?": bool, "Multiplexer Arduino Detected?": bool, "Multiplexer Arduino Address": "VISA Instr", "Arduinos List": T1[], "XZ Stage Log": string, "Multiplexer Log": string}
uses:
  Rainbow Measurement Setup::Main Functions::Instruction Queue::Current State::FGV Current State.gvi
  NI::VISA::Find Resource (Search Resources).gvi
  NI::VISA::Open (Instr).gvi
  NI::VISA::Clear (Instr).gvi
  NI::VISA::Read (Instr, String).gvi
  NI::VISA::Close (Instr).gvi
  NI::G Core::Error::Clear Error Cluster.gvi
diagram:
  # This loop scans all the VISA found sources and queries them in search for the arduino VISA addresses.
  # Once it finds the desired arduino it outputs the address into the Predefined cluster and the program finishes.
  case ($"Error In") {
    frame Error, Default {
      w1 = $"Error In"
    }
    frame No Error {
      s1 = $"Error In"  # shift register
      for {
        w2 = each element of [9600, 115200]
        call "FGV Current State.gvi"(Current State Instructions="Set Current Substate", Current Substate="Detecting Arduinos", Error In=s1) -> (Error Out=w3)
        call "Find Resource (Search Resources).gvi"() -> (found resources=w4)
        for {
          w5 = each element of w4
          Search And Replace String(error in (no error)=w3, input string=w5, search string="ASRL") -> (error out=w11, number of replacements=w12)
          Is Not Equal To 0(x=w12) -> w13
          case (w13) {
            frame False, Default {
              w14 = w11
              w15 = ""
              w16 = ""
            }
            frame True {
              call "Open (Instr).gvi"(resource name=w5, error in=w11, open timeout=300) -> (session out=w17, error out=w18)
              Property Node(instance in=w17, "ASRL Baud"=w2, error in=w18) -> (error out=w19, instance out=w20)
              call "Clear (Instr).gvi"(session in=w20, error in=w19) -> (session out=w21, error out=w22)
              call "Read (Instr, String).gvi"(session in=w21, error in=w22, byte count=50) -> (session out=w16, error out=w23, read buffer=w15)
              call "Close (Instr).gvi"(session in=w16, error in=w23) -> (error out=w24)
              call "Clear Error Cluster.gvi"(error in=w24) -> (error out=w14)
            }
          }
          Build Cluster(w16, w15) -> w25
          Search And Replace String(error in (no error)=w14, input string=w15, search string="Arduin") -> (error out=w26, number of replacements=w27)
          Is Not Equal To 0(x=w27) -> w28
          Logical And(w28, w13) -> w29
          Search And Replace String(error in (no error)=w26, input string=w15, search string="XZ") -> (error out=w30, number of replacements=w31)
          Is Not Equal To 0(x=w31) -> w32
          Search And Replace String(error in (no error)=w30, input string=w15, search string="Multiplex") -> (error out=w33, number of replacements=w34)
          Is Not Equal To 0(x=w34) -> w35
          append w25 to w6 if w29
          append w32 to w7
          append w35 to w8
          w9 = w16 if w32
          w10 = w16 if w35
        }
        Or Array Elements(Boolean array=w7) -> (logical OR=w36)
        Or Array Elements(Boolean array=w8) -> (logical OR=w37)
        w38 = "Arduino Detection cluster control.gtype" {all zero or empty}
        Property Node(instance in=w38, "XZ Stage Arduino Address"=w9, "XZ Stage Arduino Detected?"=w36, "Multiplexer Arduino Detected?"=w37, "Multiplexer Arduino Address"=w10, "Arduinos List"=w6) -> (instance out=w39)
        Logical And(w36, w37) -> w40
        $"Found Resources" <- w4
        next s1 = w33
        stop if w40
      }
      $"Arduino Detection info Out" <- w39
      w1 = s1
    }
  }
  $"Error Out" <- w1
