vi "XZ Stage Initialize.gvi"   [LabVIEW NXG 5.0.0]
inputs:
  "Error In": error
  "XZ Carriage Arduino Adress In": "VISA Instr"
outputs:
  "Error Out": error
  "XZ Carriage Arduino Visa Session Out": "VISA Instr"
  "XZ Carriage Arduino Log": string
uses:
  Rainbow Measurement Setup::Main Functions::Instruction Queue::Current State::FGV Current State.gvi
  NI::VISA::Open (Instr).gvi
  NI::VISA::Read (Instr, String).gvi
diagram:
  # This SubVI initializes the XZ Stage Arduino basically reading on the serial so that
  # the welcome message can be flushed.
  case ($"Error In") {
    frame Error, Default {
      w1 = $"Error In"
    }
    frame No Error {
      call "FGV Current State.gvi"(Current State Instructions="Set Current Substate", Current Substate="Initializing XZ Stage", Error In=$"Error In") -> (Error Out=w2)
      call "Open (Instr).gvi"(resource name=$"XZ Carriage Arduino Adress In", error in=w2, access mode="VISA Defaults"(0), open timeout=1000) -> (session out=w3, error out=w4)
      Property Node(instance in=w3, "ASRL Baud"=115200, error in=w4) -> (error out=w5, instance out=w6)
      s1 = ""  # shift register
      while (iteration -> i1) {
        Property Node(instance in=w6, error in=w5) -> ("ASRL Bytes at Port"=w7, error out=w8, instance out=w9)
        call "Read (Instr, String).gvi"(session in=w9, error in=w8, byte count=w7) -> (session out=w10, error out=w1, read buffer=w11)
        Concatenate Strings(s1, w11) -> w12
        Wait Until Next Multiple(multiple to wait=100)
        Is Greater(x=i1, y=50) -> w13
        next s1 = w12
        stop if w13
      }
      $"XZ Carriage Arduino Visa Session Out" <- w10
      $"XZ Carriage Arduino Log" <- s1
    }
  }
  $"Error Out" <- w1
