vi "XZ Move Requisites.gvi"   [LabVIEW NXG 5.0.0]
inputs:
  "Error In": error
  "Activate XZ Stage": bool
  "Queue In": Queue<"Queue Instructions Control.gtype">
  "Instrument Control Mega Cluster": "Instrument Control Mega Cluster.gtype"
outputs:
  "Error Out": error
  "Queue Out": Queue<"Queue Instructions Control.gtype">
types:
  "Queue Instructions Control.gtype" = enum{"Undefined State", "Debug Check", "Initialize App", "Idle", "Light Power Calibration", "Rainbow Single Measurement", "Light Calibration Irradiance", "Light Calibration Spectral Density", "Light Calibration Power Density", "MSpot Spectrum Calibration", "Move XZ Stage", "Update All Info Meta Cluster", "Access TXT File", "Stop App"}
  "Instrument Coms Info.gtype" = cluster{"Arduino Coms Info": "Arduino Detection cluster control.gtype", "Photodetector Names": string[], "Keythley Address": "VISA Instr", "Photodetector Detected?": bool, "Thorlabs Motors Detected?": bool, "Keithley Detected?": bool, "Thorlabs Motors Serial Number": "Thorlabs Motors Serial Number In.gtype", "Photodetector IVI session": "Ivi IviDefault", "Flame ID": string, "Flame Detected?": bool, "Flame Wrapper ID": u64}
  "Debugging Cluster.gtype" = cluster{"Debugging mode?": bool, "Initialize App": bool, "Insturment Debugging": "Insturment Debugging Cluster.gtype"}
  "Instrument Control Mega Cluster.gtype" = cluster{"Instruments Coms Info": "Instrument Coms Info.gtype", "Debugging Cluster": "Debugging Cluster.gtype"}
diagram:
  # This SubVI checks if the XZ Stage is connected, if not
  # it does not allow you to use the XZ Stage Move feature
  # except if we are debugging.
  case ($"Error In") {
    frame Error, Default {
      w1 = $"Error In"
      w2 = $"Queue In"
    }
    frame No Error {
      Property Node(instance in=$"Instrument Control Mega Cluster") -> ("Instruments Coms Info:Arduino Coms Info:XZ Stage Arduino Detected?"=w3, "Debugging Cluster:Debugging mode?"=w4)
      Logical Or(w3, w4) -> w5
      case (w5) {
        frame False {
          w6 = "The XZ Stage has not\nbeen detected please connect\nit propperly restart the app\nand try again."
          One Button Dialog(button name ("OK")="Okay I'll do that", message=w6)
          w2 = $"Queue In"
          w1 = $"Error In"
        }
        frame True {
          Enqueue Element(element="Move XZ Stage", error in=$"Error In", queue=$"Queue In") -> (error out=w1, queue out=w2)
        }
      }
    }
  }
  $"Queue Out" <- w2
  $"Error Out" <- w1
