vi "XZ Stage Label to Coordinates.gvi"   [LabVIEW NXG 5.0.0]
inputs:
  "Error In": error
  "Cell Label": string
  "XZ All Position Cluster": "XZ All Position Cluster.gtype"
outputs:
  "Error Out": error
  "Gcode Instruction Out": string
  "XZ Coordinate Out": "XZ Coordinate Cluster In.gtype"
panel indicators:
  "X coordinate out": f64
  "Z coordinate out": f64
types:
  T1 = cluster{"X Coordinate (mm)": f64, "Z Coordinate (mm)": f64}
  T2 = cluster{"X Coordinate (mm)": f64, "Z Coordinate (mm)": f64, "Vertical Spacing (mm)": f64}
  "XZ All Position Cluster.gtype" = cluster{"Diffusor Coordinates": T1, "Photodetector Coordinates": T1, "Cell R.01 Coordinates": T2}
  "XZ Coordinate Cluster In.gtype" = cluster{"X Coordinate (mm)": f64, "Z Coordinate (mm)": f64}
diagram:
  # This subVI Takes a cell label (i.e L.03) and converts it into the gcode command for the XZ Stage needed to move to that specific location.
  case ($"Error In") {
    frame Error, Default {
      w1 = $"Error In"
      w2 = default
      w3 = default
      w4 = default
      w5 = default
    }
    frame No Error {
      Property Node(instance in=$"XZ All Position Cluster") -> ("Cell R.01 Coordinates"=w6)
      Search And Replace String(error in (no error)=$"Error In", input string=$"Cell Label", search string="R.") -> (error out=w7, number of replacements=w8)
      Is Not Equal To 0(x=w8) -> w9
      Search And Replace String(error in (no error)=w7, input string=$"Cell Label", search string="L.") -> (error out=w1, number of replacements=w10)
      Is Not Equal To 0(x=w10) -> w11
      Logical Exclusive Or(w9, w11) -> w12
      String Length(string=$"Cell Label") -> (length=w13)
      Is Equal(x=w13, y=4) -> w14
      Logical And(w14, w12) -> w15
      case (w15) {
        frame False, Default {
          Wait Until Next Multiple(multiple to wait=1000)
          w16 = """There was a problem reading
the cell labels on XZ Carriage 
label to Coordinate. Please contact
Martí (minusmages@hotmail.com)
because this error is not supposed
to happen, like, ever."""
          One Button Dialog(button name ("OK")="Okay, but who is Martí?", message=w16)
          w2 = default
          w3 = default
          w4 = default
          w5 = default
        }
        frame True {
          String Subset(offset (0)=2, string=$"Cell Label") -> w17
          Decimal String To Number(string=w17) -> (number=w18)
          Property Node(instance in=w6) -> ("X Coordinate (mm)"=w19, "Z Coordinate (mm)"=w20, "Vertical Spacing (mm)"=w21)
          In Range And Coerce(lower limit=1, upper limit=13, x=w18) -> (In Range?=w22)
          case (w22) {
            frame True {
              Decrement(x=w18) -> w23
              To Double Precision Float(number=w23) -> w24
              Multiply(w24, 5.08) -> w25
              Add(w25, w19) -> w4
            }
            frame False {
              w26 = "Cell out of range,\nthere is no R.13\nthe range is from\n1 to 12"
              One Button Dialog(button name ("OK")="Oh, sorry", message=w26)
              w4 = w19
            }
          }
          String Subset(length (rest)=1, string=$"Cell Label") -> w27
          case (w27) {
            frame "", Default {
              w28 = """There was a problem reading
the cell labels on XZ Carriage 
label to Coordinate. Please contact
Martí (minusmages@hotmail.com)
because this error is not supposed
to happen, like, ever."""
              One Button Dialog(button name ("OK")="Okay, but who is Martí?", message=w28)
              w3 = w20
            }
            frame "L" {
              Add(w20, w21) -> w3
            }
            frame "R" {
              w3 = w20
            }
          }
          Property Node(instance in="XZ Coordinate Cluster In.gtype" {all zero or empty}, "X Coordinate (mm)"=w4, "Z Coordinate (mm)"=w3) -> (instance out=w5)
          Number To Fractional String(number=w3, precision (6)=2, use system decimal point (T)=FALSE) -> (F-format string=w29)
          Number To Fractional String(number=w4, precision (6)=2, use system decimal point (T)=FALSE) -> (F-format string=w30)
          Concatenate Strings("G1 X", w30, " Z", w29) -> w2
        }
      }
    }
  }
  $"XZ Coordinate Out" <- w5
  $"X coordinate out" <- w4
  $"Gcode Instruction Out" <- w2
  $"Z coordinate out" <- w3
  $"Error Out" <- w1
