vi "Instrument Detector.gvi"   [LabVIEW NXG 5.0.0]
inputs:
  "Error In": error
  "Instruments To Detect control": "Instruments To Detect control.gtype" = "Photodetector", required
  "Instrument Addresses In": "Instrument Coms Info.gtype"
  "Stand Alone?": bool
outputs:
  "Error Out": error
  "Instrument Addresses Out": "Instrument Coms Info.gtype"
types:
  "Instruments To Detect control.gtype" = enum{"Photodetector", "Keithley", "Arduinos", "Thorlabs Motors"}
  T1 = cluster{"Element 1": "VISA Instr", "Element 2": string}
  "Arduino Detection cluster control.gtype" = cluster{"XZ Stage Arduino Address": "VISA Instr", "XZ Stage Arduino Detected?": bool, "Multiplexer Arduino Detected?": bool, "Multiplexer Arduino Address": "VISA Instr", "Arduinos List": T1[], "XZ Stage Log": string, "Multiplexer Log": string}
  "Thorlabs Motors Serial Number In.gtype" = cluster{"Thorlabs Blue Motor": string, "Thorlabs Red Motor": string, "Blue Motor Homed?": bool, "Red Motor Homed?": bool}
  "Instrument Coms Info.gtype" = cluster{"Arduino Coms Info": "Arduino Detection cluster control.gtype", "Photodetector Names": string[], "Keythley Address": "VISA Instr", "Photodetector Detected?": bool, "Thorlabs Motors Detected?": bool, "Keithley Detected?": bool, "Thorlabs Motors Serial Number": "Thorlabs Motors Serial Number In.gtype", "Photodetector IVI session": "Ivi IviDefault"}
uses:
  Rainbow Measurement Setup::Main Functions::Instruction Queue::Current State::FGV Current State.gvi
  Rainbow Measurement Setup::Side Functions::Instrument Control::Photodetector::Photodetector Detection Subroutine.gvi
  Rainbow Measurement Setup::Side Functions::Instrument Control::Keithley::Keithley Detection Subroutine.gvi
  Rainbow Measurement Setup::Side Functions::Instrument Control::Arduino::Arduino Detection Subroutine.gvi
  Rainbow Measurement Setup::Side Functions::Instrument Control::Thorlabs Motors::Detection::Thorlabs Serial Number Check.gvi
  Rainbow Measurement Setup::Side Functions::Instrument Control::Thorlabs Motors::Detection::Thorlabs motor Detector.gvi
diagram:
  case ($"Error In") {
    frame Error, Default {
      w1 = $"Error In"
    }
    frame No Error {
      case ($"Instruments To Detect control") {
        frame "Photodetector", Default {
          call "FGV Current State.gvi"(Current State Instructions="Set Current Substate", Current Substate="Detecting Photodetector", Error In=$"Error In") -> (Error Out=w3)
          call "Photodetector Detection Subroutine.gvi"(Error In=w3) -> (Photodetector Names=w4, Detected?=w5, Error Out=w1)
          Property Node(instance in=$"Instrument Addresses In", "Photodetector Names"=w4, "Photodetector Detected?"=w5) -> (instance out=w2)
        }
        frame "Keithley" {
          call "FGV Current State.gvi"(Current State Instructions="Set Current Substate", Current Substate="Detecting Keithley", Error In=$"Error In") -> (Error Out=w6)
          call "Keithley Detection Subroutine.gvi"(Error In=w6) -> (Keythley Address Out=w7, Detected?=w8, Error Out=w1)
          Property Node(instance in=$"Instrument Addresses In", "Keythley Address"=w7, "Keithley Detected?"=w8) -> (instance out=w2)
        }
        frame "Arduinos" {
          call "FGV Current State.gvi"(Current State Instructions="Set Current Substate", Current Substate="Detecting Arduinos", Error In=$"Error In") -> (Error Out=w9)
          call "Arduino Detection Subroutine.gvi"(Error In=w9) -> (Arduino Detection Cluster Info Out=w10, Error Out=w1)
          Property Node(instance in=$"Instrument Addresses In", "Arduino Coms Info"=w10) -> (instance out=w2)
        }
        frame "Thorlabs Motors" {
          Property Node(instance in=$"Instrument Addresses In") -> ("Thorlabs Motors Serial Number"=w11, instance out=w12)
          call "FGV Current State.gvi"(Current State Instructions="Set Current Substate", Current Substate="Detecting Thorlabs Motors", Error In=$"Error In") -> (Error Out=w13)
          case ($"Stand Alone?") {
            frame False, Default {
              w14 = w13
              w15 = w11
            }
            frame True {
              call "Thorlabs Serial Number Check.gvi"(Error In=w13) -> (Thorlabs Motors Serial Number Out=w15, Error Out=w14)
            }
          }
          call "Thorlabs motor Detector.gvi"(Thorlabs Motors Serial Number In=w15, Error In=w14) -> (Detected?=w16, Thorlabs Motors Serial Number Out=w17, Error Out=w1)
          Property Node(instance in=w12, "Thorlabs Motors Detected?"=w16, "Thorlabs Motors Serial Number"=w17) -> (instance out=w2)
        }
      }
      $"Instrument Addresses Out" <- w2
    }
  }
  $"Error Out" <- w1
