vi "Keithley Set Constant Parameters.gvi"   [LabVIEW NXG 5.0.0]
inputs:
  "Error In": error
  "Instrument Coms Info In": "Instrument Coms Info.gtype"
  "Debugging Cluster In": "Debugging Cluster.gtype"
  "SRM Specific Parameters In": "SRM Specific Parameters.gtype"
outputs:
  "Error Out": error
  "Instrument Coms Info Out": "Instrument Coms Info.gtype"
  "Debugging Cluster Out": "Debugging Cluster.gtype"
  "SRM Specific Parameters Out": "SRM Specific Parameters.gtype"
types:
  T1 = cluster{"Element 1": "VISA Instr", "Element 2": string}
  "Arduino Detection cluster control.gtype" = cluster{"XZ Stage Arduino Address": "VISA Instr", "XZ Stage Arduino Detected?": bool, "Multiplexer Arduino Detected?": bool, "Multiplexer Arduino Address": "VISA Instr", "Arduinos List": T1[], "XZ Stage Log": string, "Multiplexer Log": string}
  "Thorlabs Motors Serial Number In.gtype" = cluster{"Thorlabs Blue Motor": string, "Thorlabs Red Motor": string, "Blue Motor Homed?": bool, "Red Motor Homed?": bool}
  "Instrument Coms Info.gtype" = cluster{"Arduino Coms Info": "Arduino Detection cluster control.gtype", "Photodetector Names": string[], "Keythley Address": "VISA Instr", "Photodetector Detected?": bool, "Thorlabs Motors Detected?": bool, "Keithley Detected?": bool, "Thorlabs Motors Serial Number": "Thorlabs Motors Serial Number In.gtype", "Photodetector IVI session": "Ivi IviDefault", "Flame ID": string, "Flame Detected?": bool, "Flame Wrapper ID": u64}
  "Insturment Debugging Cluster.gtype" = cluster{"Keithley": bool, "Arduinos": bool, "Thorlabs Motors": bool, "Photodetector": bool, "Flame Spectr": bool}
  "Debugging Cluster.gtype" = cluster{"Debugging mode?": bool, "Initialize App": bool, "Insturment Debugging": "Insturment Debugging Cluster.gtype"}
  "SRM Specific Parameters.gtype" = cluster{"Max Voltage (V)": f64, "Min Voltage (V)": f64, "Voltage Points": u32, "Current Range (A)": f64, "Autorange": bool, "Sweep Direction": bool, "Current Averages": u32, "Max Current (A)": f64, "Integration Time": f64}
  T2 = cluster{"Start ": f64, "Stop ": f64, "Number of Points (5)": u32}
uses:
  Rainbow Measurement Setup::Main Functions::Instruction Queue::Current State::FGV Current State.gvi
  Rainbow Measurement Setup::Side Functions::Instrument Control::Keithley::Voltage Direction Calculator.gvi
  Rainbow Measurement Setup::Side Functions::Utilities::Order of Magnitude Extractor.gvi
  Labview_NXG_Keithley_SMU_2450_2460_2461::Configure::Configure Measurement Range.gvi
  Labview_NXG_Keithley_SMU_2450_2460_2461::Configure::Configure Output.gvi
  Labview_NXG_Keithley_SMU_2450_2460_2461::Configure::Configure Source Function.gvi
  Labview_NXG_Keithley_SMU_2450_2460_2461::Configure::Configure Measurement Function.gvi
  Labview_NXG_Keithley_SMU_2450_2460_2461::Configure::Configure Integration Filter.gvi
  Labview_NXG_Keithley_SMU_2450_2460_2461::Configure::Configure Linear Mode Sweep.gvi
diagram:
  # This SubVI Sets all the desired parameter for the keitley sweep
  case ($"Error In") {
    frame Error, Default {
      w1 = $"Error In"
      w2 = $"Instrument Coms Info In"
      w3 = $"Debugging Cluster In"
      w4 = $"SRM Specific Parameters In"
    }
    frame No Error {
      Property Node(instance in=$"Debugging Cluster In") -> ("Debugging mode?"=w5, "Insturment Debugging:Keithley"=w6, instance out=w3)
      Logical And[output inverted](w5, not w6) -> w7
      case (w7) {
        frame False, Default {
          w2 = $"Instrument Coms Info In"
          w1 = $"Error In"
          w4 = $"SRM Specific Parameters In"
        }
        frame True {
          Property Node(instance in=$"Instrument Coms Info In") -> ("Keythley Address"=w8, instance out=w9)
          Property Node(instance in=$"SRM Specific Parameters In") -> ("Current Range (A)"=w10, "Autorange"=w11, "Max Current (A)"=w12, "Integration Time"=w13, "Max Voltage (V)"=w14, "Min Voltage (V)"=w15, "Voltage Points"=w16, "Sweep Direction"=w17, instance out=w4)
          call "FGV Current State.gvi"(Current State Instructions="Set Current Substate", Current Substate="Setting Keithley Parameters", Error In=$"Error In") -> (Error Out=w18)
          call "Voltage Direction Calculator.gvi"(Max Voltage (V)=w14, Min Voltage (V)=w15, Error In=w18, Sweep Direction=w17) -> (Start=w19, End=w20, Error Out=w21)
          Property Node(instance in=T2 {"Start "=1, "Stop "=0, "Number of Points (5)"=5}, "Start "=w19, "Stop "=w20, "Number of Points (5)"=w16) -> (instance out=w22)
          In Range And Coerce(lower limit=1e-08, upper limit=1, x=w10) -> (coerced(x)=w23)
          Select(s=w11, t=w12, f=w23) -> w24
          call "Order of Magnitude Extractor.gvi"(Number to extract order of magnitude=w23, Error In=w21) -> (Error Out=w25)
          call "Configure Measurement Range.gvi"(VISA resource name=w8, Function (0: Volts)="Volts"(0), Enable Auto Range (T:Enable)=TRUE, error in (no error)=w25) -> (VISA resource name out=w26, error out=w27)
          call "Configure Measurement Range.gvi"(Manual Range (1.0)=w24, VISA resource name=w26, Function (0: Volts)="Current"(1), Enable Auto Range (T:Enable)=w11, error in (no error)=w27) -> (VISA resource name out=w28, error out=w29)
          call "Configure Output.gvi"(VISA resource name=w28, Source Mode (0: Voltage)="Voltage"(0), error in (no error)=w29) -> (VISA resource name out=w30, error out=w31)
          call "Configure Source Function.gvi"(VISA resource name=w30, Function (0: Volts)="Volts"(0), error in (no error)=w31) -> (VISA resource name out=w32, error out=w33)
          call "Configure Measurement Function.gvi"(VISA resource name=w32, Function (0: Volts)="Current"(1), error in (no error)=w33) -> (VISA resource name out=w34, error out=w35)
          call "Configure Integration Filter.gvi"(VISA resource name=w34, Function (0: Volts)="Volts"(0), Measurement Speed (1 PLC)=w13, error in (no error)=w35) -> (VISA resource name out=w36, error out=w37)
          call "Configure Linear Mode Sweep.gvi"(VISA resource name=w36, Source Mode (0: Voltage)="Voltage"(0), Sweep Points=w22, Delay (0)=0, error in (no error)=w37) -> (VISA resource name out=w38, error out=w1)
          Property Node(instance in=w9, "Keythley Address"=w38) -> (instance out=w2)
        }
      }
    }
  }
  $"SRM Specific Parameters Out" <- w4
  $"Instrument Coms Info Out" <- w2
  $"Error Out" <- w1
  $"Debugging Cluster Out" <- w3
