vi "Keithley Sweep Subroutine.gvi"   [LabVIEW NXG 5.0.0]
inputs:
  "Error In": error
  "Instrument Control Mega Cluster In": "Instrument Control Mega Cluster.gtype"
  "SRM Mega Cluster In": "SRM Mega Cluster.gtype"
  "IV Single Measurement In": "IV Single Measurement.gtype"
outputs:
  "Error Out": error
  "Instrument Control Mega Cluster Out": "Instrument Control Mega Cluster.gtype"
  "SRM Mega Cluster Out": "SRM Mega Cluster.gtype"
  "IV Single Measurement Out": "IV Single Measurement.gtype"
types:
  "IV Single Measurement.gtype" = cluster{"Voltage (V)": f64[], "Current (A)": f64[], "Current Density (A/m^2)": f64[], "Dividing Wavelength (nm)": f64, "Light Power Density (W/m^2)": f64, "Total Light Power Density (W/m^2)": f64}
  "SRM Specific Parameters.gtype" = cluster{"Max (V)": f64, "Min (V)": f64, "V Points": u32, "Current Range (A)": f64, "Autorange": bool, "Sweep Dir": bool, "Current Averages": u32, "Max (A)": f64, "Integration Time": f64, "Cell Area (m^2)": f64, "Full Spctr Ref": bool}
  "Raibow Sweep Selector.gtype" = enum{"Red Sweep", "Blue Sweep", "Full Sweep Red First", "Full Sweep Blue First"}
  "Rainbow Sweep Param Selector.gtype" = cluster{"Raibow Sweep Selector": "Raibow Sweep Selector.gtype", "Max Wavelength (nm)": f64, "Min Wavelength (nm)": f64, "Wavelength Step (nm)": f64, "Rainbow Sweep Type Selector": "Rainbow Sweep Type Selector.gtype"}
  "Rainbow Sweep Types.gtype" = enum{"Red Sweep Closing", "Red Sweep Opening", "Blue Sweep Closing", "Blue Sweep Opening"}
  "IV Full Data Cluster.gtype" = cluster{"IV Measurements Array": "IV Single Measurement.gtype"[], "Rainbow Sweep Types": "Rainbow Sweep Types.gtype", "IV Refined Data": "IV Refined Full Sweep Data.gtype", "Total Light Power Density (W/m^2)": f64}
  "IV Full Raw Data.gtype" = cluster{"Rainbow Sweep Types": "Rainbow Sweep Types.gtype", "IV Raw Data Array": "IV Single Measurement.gtype"[]}
  "SRM Mega Cluster.gtype" = cluster{"SRM Specific Parameters": "SRM Specific Parameters.gtype", "Rainbow Sweep Parameters SRM": "Rainbow Sweep Param Selector.gtype", "SRM Full IV data Array": "IV Full Data Cluster.gtype"[], "Full IV Curve Raw Data": "IV Full Raw Data.gtype"[]}
  "Instrument Coms Info.gtype" = cluster{"Arduino Coms Info": "Arduino Detection cluster control.gtype", "Photodetector Names": string[], "Keythley Address": "VISA Instr", "Photodetector Detected?": bool, "Thorlabs Motors Detected?": bool, "Keithley Detected?": bool, "Thorlabs Motors Serial Number": "Thorlabs Motors Serial Number In.gtype", "Photodetector IVI session": "Ivi IviDefault", "Flame ID": string, "Flame Detected?": bool, "Flame Wrapper ID": u64}
  "Debugging Cluster.gtype" = cluster{"Debugging mode?": bool, "Initialize App": bool, "Insturment Debugging": "Insturment Debugging Cluster.gtype"}
  "Instrument Control Mega Cluster.gtype" = cluster{"Instruments Coms Info": "Instrument Coms Info.gtype", "Debugging Cluster": "Debugging Cluster.gtype"}
uses:
  Rainbow Measurement Setup::Side Functions::Instrument Control::Keithley::Random IV Curve Generator.gvi
  Rainbow Measurement Setup::Main Functions::Instruction Queue::Current State::FGV Current State.gvi
  Labview_NXG_Keithley_SMU_2450_2460_2461::Configure::Clear Buffer.gvi
  Labview_NXG_Keithley_SMU_2450_2460_2461::Action Status::Enable Output.gvi
  Labview_NXG_Keithley_SMU_2450_2460_2461::Data::Low Level::Initiate.gvi
  Rainbow Measurement Setup::Side Functions::Instrument Control::Keithley::FGV Keithley timeout.gvi
  Labview_NXG_Keithley_SMU_2450_2460_2461::Data::Low Level::Wait for Operation Complete.gvi
  Labview_NXG_Keithley_SMU_2450_2460_2461::Data::Read (Multiple Points).gvi
  Rainbow Measurement Setup::Side Functions::Instrument Control::Keithley::Keithley Timeout Check.gvi
  NI::VISA::Write (Instr, String).gvi
diagram:
  # This SubVI Initializes the Keithley Comunication In case the debugging allows it to do so
  case ($"Error In") {
    frame Error, Default {
      w1 = $"Error In"
      w2 = $"Instrument Control Mega Cluster In"
      w3 = $"IV Single Measurement In"
      w4 = $"SRM Mega Cluster In"
    }
    frame No Error {
      Property Node(instance in=$"Instrument Control Mega Cluster In") -> ("Debugging Cluster:Debugging mode?"=w5, "Debugging Cluster:Insturment Debugging:Keithley"=w6, instance out=w7)
      Logical And[output inverted](w5, not w6) -> w8
      case (w8) {
        frame False, Default {
          call "Random IV Curve Generator.gvi"(SRM Mega Cluster In=$"SRM Mega Cluster In", Intensity Constant=1, Light Intensity=-1.7, Error In=$"Error In") -> (Voltage=w9, Current=w10, Error Out=w1)
          Property Node(instance in=$"IV Single Measurement In", "Voltage (V)"=w9, "Current (A)"=w10) -> (instance out=w3)
          w2 = w7
          w4 = $"SRM Mega Cluster In"
        }
        frame True {
          Property Node(instance in=$"SRM Mega Cluster In") -> ("SRM Specific Parameters:V Points"=w11, instance out=w4)
          # Clears all event registers and Error Queue
          Property Node(instance in=w7) -> ("Instruments Coms Info:Keythley Address"=w12, instance out=w13)
          call "FGV Current State.gvi"(Current State Instructions="Set Current Substate", Current Substate="Sweeping Keithley", Error In=$"Error In") -> (Error Out=w14)
          call "Clear Buffer.gvi"(VISA resource name=w12, error in (no error)=w14) -> (VISA resource name out=w15, error out=w16)
          call "Enable Output.gvi"(VISA resource name=w15, Enable Output (T: Enable)=TRUE, error in (no error)=w16) -> (VISA resource name out=w17, error out=w18)
          call "Initiate.gvi"(VISA resource name=w17, error in (no error)=w18) -> (VISA resource name out=w19, error out=w20)
          call "FGV Keithley timeout.gvi"(FGV Instructions="Read State", Error In=w20) -> (Timeout in ms Out=w21, Error Out=w22)
          call "Wait for Operation Complete.gvi"(VISA resource name=w19, Timeout (10000 ms)=w21, error in (no error)=w22) -> (VISA resource name out=w23, error out=w24)
          call "Read (Multiple Points).gvi"(VISA resource name=w23, Start Index (1)=1, End Index (1)=w11, error in (no error)=w24, Buffer Elements="SOUR, READ") -> (VISA resource name out=w25, Data out=w26, error out=w27)
          Spreadsheet String To Array(array type=f64[] [], delimiter=",", format string="%s", spreadsheet string=w26) -> (array=w28)
          Decimate Array(array=w28) -> (out0=w29, out1=w30)
          Property Node(instance in=$"IV Single Measurement In", "Voltage (V)"=w29, "Current (A)"=w30) -> (instance out=w3)
          call "Keithley Timeout Check.gvi"(Error In=w27) -> (Error Out=w31)
          call "Enable Output.gvi"(VISA resource name=w25, Enable Output (T: Enable)=FALSE, error in (no error)=w31) -> (VISA resource name out=w32, error out=w33)
          call "Write (Instr, String).gvi"(session in=w32, error in=w33, write buffer="*CLS;") -> (session out=w34, error out=w1)
          Property Node(instance in=w13, "Instruments Coms Info:Keythley Address"=w34) -> (instance out=w2)
        }
      }
    }
  }
  $"IV Single Measurement Out" <- w3
  $"Instrument Control Mega Cluster Out" <- w2
  $"Error Out" <- w1
  $"SRM Mega Cluster Out" <- w4
