vi "Random IV Curve Generator.gvi"   [LabVIEW NXG 5.0.0]
inputs:
  "Error In": error
  "SRM Specific Parameters In": "SRM Specific Parameters.gtype"
  "Intensity Constant": f64
  "Light Intensity": f64
outputs:
  "Error Out": error
  "Voltage": f64[]
  "Current": f64[]
types:
  "SRM Specific Parameters.gtype" = cluster{"Max (V)": f64, "Min (V)": f64, "V Points": u32, "Current Range (A)": f64, "Autorange": bool, "Sweep Dir": bool, "Current Averages": u32, "Max (A)": f64, "Integration Time": f64, "Cell Area (m^2)": f64}
uses:
  Rainbow Measurement Setup::Side Functions::Instrument Control::Keithley::Keithley Sweep Parameters Calculator.gvi
  NI::G Core::Numeric::Random Number (Range) DBL.gvi
diagram:
  case ($"Error In") {
    frame Error, Default {
      w1 = $"Error In"
      w2 = f64[] []
      w3 = f64[] []
    }
    frame No Error {
      call "Keithley Sweep Parameters Calculator.gvi"(SRM Parameters in=$"SRM Specific Parameters In", Error In=$"Error In") -> (Sweep Points=w4, Error Out=w1)
      Property Node(instance in=w4) -> ("Start "=w5, "Stop "=w6, "Number of Points (5)"=w7)
      call "Random Number (Range) DBL.gvi"(upper bound=1.2, lower bound=0.8) -> (number=w8)
      Multiply(w8, $"Light Intensity") -> w9
      Multiply($"Intensity Constant", w8) -> w10
      Subtract(x=w6, y=w5) -> w11
      Divide(x=w11, y=w7) -> w12
      for (N = w7) (iteration -> i1) {
        Multiply(w12, i1) -> w13
        Add(w5, w13) -> w14
        To Double Precision Float(number=w14) -> w15
        Exponential(x=w14) -> w16
        Multiply(w16, w10) -> w17
        Add(w9, w17) -> w18
        append w15 to w2
        append w18 to w3
      }
    }
  }
  $Voltage <- w2
  $Current <- w3
  $"Error Out" <- w1
