vi "Full Smart Sweep.gvi"   [LabVIEW NXG 5.0.0]
inputs:
  "Error In": error
  "VISA resource name in": "VISA Instr"
  "Smart Sweep Mega Cluster In": "Smart Sweep Mega Cluster.gtype"
  "High Speed": bool
outputs:
  "Error Out": error
  "VISA resource name Out": "VISA Instr"
  "Smart Sweep Mega Cluster Out": "Smart Sweep Mega Cluster.gtype"
  "Elapsed Time (ms)": u32
types:
  T1 = cluster{"Isc Rsh Sweep Points": u32, "Voc Rs Sweep Points": u32, "VImpp Rough Sweep Points": u32, "VImpp Fine Sweep Points": u32, "Isc Rsh Sweep Direction": bool, "Voc Rs Sweep Direction": bool, "VImpp Rough Sweep Direction": bool, "VImpp Fine Sweep Direction": bool, "Isc Sweep Width (1=Voc)": f64, "Voc Sweep Height (1=Isc)": f64, "Vmpp Sweep Width Above (1=Voc)": f64, "Vmpp Sweep Width Below (1=Voc)": f64}
  T2 = cluster{"Isc (A)": f64, "Voc (V)": f64, "FF (%)": f64, "Rs (Ω)": f64, "Rsh (Ω)": f64, "Voltage Array (V)": f64[], "Current Array (A)": f64[]}
  T3 = cluster{"Rough Vmpp (V)": f64, "Rough Isc (A)": f64, "Rough Voc (V)": f64, "Rough Jmpp (V)": f64, "Averages Rough Isc (A)": u32, "Averages Rough Voc (V)": u32}
  "Smart Sweep Mega Cluster.gtype" = cluster{"Sweep Parameters": T1, "Measurement Speed (1 PLC)": f64, "High Speed": bool, "IV Data": T2, "Rough Readings": T3}
uses:
  Rainbow Measurement Setup::Side Functions::Utilities::Time Related Operations::Time at Point.gvi
  Rainbow Measurement Setup::Side Functions::Instrument Control::Keithley::Set Keythley to Fast.gvi
  Rainbow Measurement Setup::Side Functions::Instrument Control::Keithley::Smart Sweep::Smart Sweep Subroutine.gvi
diagram:
  # This SubVI Performs a smart sweep that measures the Voc and the Jsc and then sweeps along
  # the entirety of the IV curve to roughly determine the Vmpp, and then repeats with more accuracy
  # around that point.
  case ($"Error In") {
    frame Error, Default {
      w1 = $"Error In"
      w2 = $"VISA resource name in"
      w3 = $"Smart Sweep Mega Cluster In"
      w4 = default
    }
    frame No Error {
      call "Time at Point.gvi"(Error In=$"Error In") -> (ms Count=w5, Error Out=w6)
      Property Node(instance in=$"Smart Sweep Mega Cluster In") -> ("High Speed"=w7, instance out=w8)
      Logical Or(w7, $"High Speed") -> w9
      case (w9) {
        frame False, Default {
          w10 = w6
          w11 = $"VISA resource name in"
        }
        frame True {
          call "Set Keythley to Fast.gvi"(Visa Resource Name In=$"VISA resource name in", Error In=w6) -> (Visa Resource Name Out=w11, Error Out=w10)
        }
      }
      call "Smart Sweep Subroutine.gvi"(Smart Sweep Mega Cluster In=w8, VISA resource name in=w11, Error In=w10) -> (Smart Sweep Mega Cluster Out=w3, VISA resource name out=w2, Error Out=w12)
      call "Time at Point.gvi"(Error In=w12) -> (ms Count=w13, Error Out=w1)
      Subtract(x=w13, y=w5) -> w4
    }
  }
  $"Smart Sweep Mega Cluster Out" <- w3
  $"VISA resource name Out" <- w2
  $"Error Out" <- w1
  $"Elapsed Time (ms)" <- w4
