vi "Rs_Voc Rsh_Isc Accurate Sweep.gvi"   [LabVIEW NXG 5.0.0]
inputs:
  "Error In": error
  "VISA resource name in": "VISA Instr"
  "Smart Sweep Mega Cluster In": "Smart Sweep Mega Cluster.gtype"
  "Voc Jsc Operation Control": "Voc Jsc Operation Control.gtype" = "Voc"
outputs:
  "Error Out": error
  "VISA resource name out": "VISA Instr"
  "Smart Sweep Mega Cluster Out": "Smart Sweep Mega Cluster.gtype"
types:
  "Voc Jsc Operation Control.gtype" = enum{"Voc", "Isc"}
  T1 = cluster{"Rough Vmpp (V)": f64, "Rough Isc (A)": f64, "Rough Voc (V)": f64, "Rough Jmpp (V)": f64, "Averages Rough Isc (A)": u32, "Averages Rough Voc (V)": u32}
  T2 = cluster{"Isc (A)": f64, "Voc (V)": f64, "FF (%)": f64, "Rs (Ω)": f64, "Rsh (Ω)": f64, "Voltage Array (V)": f64[], "Current Array (A)": f64[]}
  T3 = cluster{"Isc Rsh Sweep Points": u32, "Voc Rs Sweep Points": u32, "VImpp Rough Sweep Points": u32, "VImpp Fine Sweep Points": u32, "Isc Rsh Sweep Direction": bool, "Voc Rs Sweep Direction": bool, "VImpp Rough Sweep Direction": bool, "VImpp Fine Sweep Direction": bool, "Isc Sweep Width (1=Voc)": f64, "Voc Sweep Height (1=Isc)": f64, "Vmpp Sweep Width Above (1=Voc)": f64, "Vmpp Sweep Width Below (1=Voc)": f64}
  "Smart Sweep Mega Cluster.gtype" = cluster{"Rough Readings": T1, "IV Data": T2, "Sweep Parameters": T3, "Measurement Speed (1 PLC)": f64}
  T4 = cluster{"Start ": f64, "Stop ": f64, "Number of Points (5)": u32}
uses:
  Rainbow Measurement Setup::Side Functions::Instrument Control::Keithley::Voltage Direction Calculator.gvi
  Labview_NXG_Keithley_SMU_2450_2460_2461::Configure::Clear Buffer.gvi
  Labview_NXG_Keithley_SMU_2450_2460_2461::Configure::Configure Source Function.gvi
  Labview_NXG_Keithley_SMU_2450_2460_2461::Configure::Configure Measurement Range.gvi
  Labview_NXG_Keithley_SMU_2450_2460_2461::Configure::Configure Measurement Function.gvi
  Labview_NXG_Keithley_SMU_2450_2460_2461::Configure::Configure Integration Filter.gvi
  Labview_NXG_Keithley_SMU_2450_2460_2461::Configure::Configure Linear Mode Sweep.gvi
  Labview_NXG_Keithley_SMU_2450_2460_2461::Action Status::Enable Output.gvi
  Labview_NXG_Keithley_SMU_2450_2460_2461::Data::Low Level::Initiate.gvi
  Labview_NXG_Keithley_SMU_2450_2460_2461::Data::Low Level::Wait for Operation Complete.gvi
  Labview_NXG_Keithley_SMU_2450_2460_2461::Data::Read (Multiple Points).gvi
  NI::VISA::Write (Instr, String).gvi
  Rainbow Measurement Setup::Side Functions::Instrument Control::Keithley::Smart Sweep::Voc_Rs Isc_Rsh Calculator.gvi
diagram:
  # This SubVI performs a sweep around the Voc and the Jsc points to more accurately determine these two parameters as well as to determine the
  # Rs and the Rsh through the slope of the curves.
  case ($"Error In") {
    frame Error, Default {
      w1 = $"Error In"
      w2 = $"VISA resource name in"
      w3 = $"Smart Sweep Mega Cluster In"
    }
    frame No Error {
      case ($"Voc Jsc Operation Control") {
        frame "Voc", Default {
          Property Node(instance in=$"Smart Sweep Mega Cluster In") -> ("Sweep Parameters:Voc Rs Sweep Direction"=w8, "Rough Readings:Rough Isc (A)"=w9, "Measurement Speed (1 PLC)"=w10, "Sweep Parameters:Voc Rs Sweep Points"=w11, "Sweep Parameters:Voc Sweep Height (1=Isc)"=w12, "Rough Readings:Rough Voc (V)"=w13, instance out=w14)
          Property Node(instance in=w14) -> ("IV Data:Voltage Array (V)"=w15, "IV Data:Current Array (A)"=w16, instance out=w17)
          Multiply(w9, w12) -> w18
          Negate(x=w18) -> w19
          call "Voltage Direction Calculator.gvi"(Max Voltage (V)=w18, Min Voltage (V)=w19, Error In=$"Error In", Sweep Direction=w8) -> (Start=w20, End=w21, Error Out=w22)
          Property Node(instance in=T4 {"Start "=0, "Stop "=0, "Number of Points (5)"=1}, "Start "=w20, "Stop "=w21, "Number of Points (5)"=w11) -> (instance out=w23)
          Absolute Value(x=w13) -> w24
          In Range And Coerce(lower limit=0.02, upper limit=200, x=w24) -> (coerced(x)=w25)
          call "Clear Buffer.gvi"(VISA resource name=$"VISA resource name in", error in (no error)=w22) -> (VISA resource name out=w26, error out=w27)
          call "Configure Source Function.gvi"(VISA resource name=w26, Function (0: Volts)="Current"(1), error in (no error)=w27) -> (VISA resource name out=w28, error out=w29)
          call "Configure Measurement Range.gvi"(VISA resource name=w28, Function (0: Volts)="Current"(1), Enable Auto Range (T:Enable)=TRUE, error in (no error)=w29) -> (VISA resource name out=w30, error out=w31)
          call "Configure Measurement Range.gvi"(Manual Range (1.0)=w25, VISA resource name=w30, Function (0: Volts)="Volts"(0), Enable Auto Range (T:Enable)=FALSE, error in (no error)=w31) -> (VISA resource name out=w32, error out=w33)
          call "Configure Measurement Function.gvi"(VISA resource name=w32, Function (0: Volts)="Volts"(0), error in (no error)=w33) -> (VISA resource name out=w34, error out=w35)
          call "Configure Integration Filter.gvi"(VISA resource name=w34, Function (0: Volts)="Volts"(0), Measurement Speed (1 PLC)=w10, error in (no error)=w35) -> (VISA resource name out=w36, error out=w37)
          call "Configure Linear Mode Sweep.gvi"(VISA resource name=w36, Source Mode (0: Voltage)="Current"(1), Sweep Points=w23, Delay (0)=0, error in (no error)=w37, Fail Abort (T:ON)=FALSE) -> (VISA resource name out=w38, error out=w39)
          call "Enable Output.gvi"(VISA resource name=w38, Enable Output (T: Enable)=TRUE, error in (no error)=w39) -> (VISA resource name out=w40, error out=w41)
          call "Initiate.gvi"(VISA resource name=w40, error in (no error)=w41) -> (VISA resource name out=w42, error out=w43)
          call "Wait for Operation Complete.gvi"(VISA resource name=w42, Timeout (10000 ms)=60000, error in (no error)=w43) -> (VISA resource name out=w44, error out=w45)
          call "Read (Multiple Points).gvi"(VISA resource name=w44, Start Index (1)=1, End Index (1)=w11, error in (no error)=w45, Buffer Elements="SOUR, READ") -> (VISA resource name out=w46, Data out=w47, error out=w48)
          Spreadsheet String To Array(array type=f64[] [], delimiter=",", format string="%s", spreadsheet string=w47) -> (array=w49)
          Decimate Array(array=w49) -> (out0=w7, out1=w6)
          Build Array(w15, w6) -> w50
          Build Array(w16, w7) -> w51
          Property Node(instance in=w17, "IV Data:Voltage Array (V)"=w50, "IV Data:Current Array (A)"=w51) -> (instance out=w5)
          call "Enable Output.gvi"(VISA resource name=w46, Enable Output (T: Enable)=FALSE, error in (no error)=w48) -> (VISA resource name out=w52, error out=w53)
          call "Clear Buffer.gvi"(VISA resource name=w52, error in (no error)=w53) -> (VISA resource name out=w54, error out=w55)
          call "Write (Instr, String).gvi"(session in=w54, error in=w55, write buffer="*CLS;") -> (session out=w2, error out=w4)
        }
        frame "Isc" {
          Property Node(instance in=$"Smart Sweep Mega Cluster In") -> ("Sweep Parameters:Isc Sweep Width (1=Voc)"=w56, "Rough Readings:Rough Voc (V)"=w57, "Sweep Parameters:Isc Rsh Sweep Points"=w58, "Sweep Parameters:Isc Rsh Sweep Direction"=w59, "Measurement Speed (1 PLC)"=w60, "Rough Readings:Rough Isc (A)"=w61, instance out=w62)
          # w7: Current Data
          Property Node(instance in=w62) -> ("IV Data:Voltage Array (V)"=w63, "IV Data:Current Array (A)"=w64, instance out=w65)
          Multiply(w57, w56) -> w66
          Negate(x=w66) -> w67
          call "Voltage Direction Calculator.gvi"(Max Voltage (V)=w66, Min Voltage (V)=w67, Error In=$"Error In", Sweep Direction=w59) -> (Start=w68, End=w69, Error Out=w70)
          Property Node(instance in=T4 {"Start "=0, "Stop "=0, "Number of Points (5)"=1}, "Start "=w68, "Stop "=w69, "Number of Points (5)"=w58) -> (instance out=w71)
          Absolute Value(x=w61) -> w72
          In Range And Coerce(lower limit=1e-08, upper limit=1, x=w72) -> (coerced(x)=w73)
          call "Clear Buffer.gvi"(VISA resource name=$"VISA resource name in", error in (no error)=w70) -> (VISA resource name out=w74, error out=w75)
          call "Configure Source Function.gvi"(VISA resource name=w74, Function (0: Volts)="Volts"(0), error in (no error)=w75) -> (VISA resource name out=w76, error out=w77)
          call "Configure Measurement Function.gvi"(VISA resource name=w76, Function (0: Volts)="Current"(1), error in (no error)=w77) -> (VISA resource name out=w78, error out=w79)
          call "Configure Measurement Range.gvi"(VISA resource name=w78, Function (0: Volts)="Volts"(0), Enable Auto Range (T:Enable)=TRUE, error in (no error)=w79) -> (VISA resource name out=w80, error out=w81)
          call "Configure Measurement Range.gvi"(Manual Range (1.0)=w73, VISA resource name=w80, Function (0: Volts)="Current"(1), Enable Auto Range (T:Enable)=FALSE, error in (no error)=w81) -> (VISA resource name out=w82, error out=w83)
          call "Configure Integration Filter.gvi"(VISA resource name=w82, Function (0: Volts)="Current"(1), Measurement Speed (1 PLC)=w60, error in (no error)=w83) -> (VISA resource name out=w84, error out=w85)
          call "Configure Linear Mode Sweep.gvi"(VISA resource name=w84, Source Mode (0: Voltage)="Voltage"(0), Sweep Points=w71, Delay (0)=0, error in (no error)=w85, Fail Abort (T:ON)=FALSE) -> (VISA resource name out=w86, error out=w87)
          call "Enable Output.gvi"(VISA resource name=w86, Enable Output (T: Enable)=TRUE, error in (no error)=w87) -> (VISA resource name out=w88, error out=w89)
          call "Initiate.gvi"(VISA resource name=w88, error in (no error)=w89) -> (VISA resource name out=w90, error out=w91)
          call "Wait for Operation Complete.gvi"(VISA resource name=w90, Timeout (10000 ms)=60000, error in (no error)=w91) -> (VISA resource name out=w92, error out=w93)
          call "Read (Multiple Points).gvi"(VISA resource name=w92, Start Index (1)=1, End Index (1)=w58, error in (no error)=w93, Buffer Elements="SOUR, READ") -> (VISA resource name out=w94, Data out=w95, error out=w96)
          Spreadsheet String To Array(array type=f64[] [], delimiter=",", format string="%s", spreadsheet string=w95) -> (array=w97)
          # w6: Voltage Data
          Decimate Array(array=w97) -> (out0=w6, out1=w7)
          Build Array(w63, w6) -> w98
          Build Array(w64, w7) -> w99
          Property Node(instance in=w65, "IV Data:Voltage Array (V)"=w98, "IV Data:Current Array (A)"=w99) -> (instance out=w5)
          call "Enable Output.gvi"(VISA resource name=w94, Enable Output (T: Enable)=FALSE, error in (no error)=w96) -> (VISA resource name out=w100, error out=w101)
          call "Clear Buffer.gvi"(VISA resource name=w100, error in (no error)=w101) -> (VISA resource name out=w102, error out=w103)
          call "Write (Instr, String).gvi"(session in=w102, error in=w103, write buffer="*CLS;") -> (session out=w2, error out=w4)
        }
      }
      call "Voc_Rs Isc_Rsh Calculator.gvi"(Smart Sweep Mega Cluster In=w5, Voltage Array=w6, Current Array=w7, Error In=w4, Voc Jsc Operation Control=$"Voc Jsc Operation Control") -> (Smart Sweep Mega Cluster Out=w3, Error Out=w1)
    }
  }
  $"Smart Sweep Mega Cluster Out" <- w3
  $"Error Out" <- w1
  $"VISA resource name out" <- w2
