vi "Thorlabs Serial Number Check.gvi"   [LabVIEW NXG 5.0.0]
inputs:
  "Error In": error
  "Initialize App Bundle Cluster In": "Initialize App Bundle Cluster.gtype"
outputs:
  "Error Out": error
  "Thorlabs Motors Serial Number Out": "Thorlabs Motors Serial Number In.gtype"
  "Initialize App Bundle Cluster Out": "Initialize App Bundle Cluster.gtype"
panel indicators:
  "Thorlabs Motor Serial Number File Path": path
types:
  "Thorlabs Motors Serial Number In.gtype" = cluster{"Thorlabs Blue Motor": string, "Thorlabs Red Motor": string, "Blue Motor Homed?": bool, "Red Motor Homed?": bool}
  "All Paths Cluster.gtype" = cluster{"Thorlabs Motor Serial Number File Path": path}
  "Instrument Coms Info.gtype" = cluster{"Arduino Coms Info": "Arduino Detection cluster control.gtype", "Photodetector Names": string[], "Keythley Address": "VISA Instr", "Photodetector Detected?": bool, "Thorlabs Motors Detected?": bool, "Keithley Detected?": bool, "Thorlabs Motors Serial Number": "Thorlabs Motors Serial Number In.gtype", "Photodetector IVI session": "Ivi IviDefault"}
  "Initialize App Bundle Cluster.gtype" = cluster{"All Paths": "All Paths Cluster.gtype", "Instrument Addresses": "Instrument Coms Info.gtype"}
uses:
  NI::G Core::File IO (General)::Check if File or Folder Exists.gvi
  Rainbow Measurement Setup::Side Functions::Messages And Prompts::Select file prompt.gvi
  Rainbow Measurement Setup::Side Functions::Instrument Control::Thorlabs Motors::Detection::Thorlabs motor Detector.gvi
  NI::G Core::Strings::1D String Array to Delimited String.gvi
  NI::G Core::File IO (General)::Create Directory Recursive.gvi
  Rainbow Measurement Setup::Side Functions::Instrument Control::Thorlabs Motors::Detection::Modify Thorlabs File.gvi
diagram:
  # This SubVI Checks if there is any Thorlabs Motor Serial Number reference file. If there is it just reads and outputs the serial numbers for the red and blue motors. If there isn't it prompts the user with various options:
  # They can either create it themselves, they can locate the file elsewhere or a new file can be created with the currently connected motors. It is VERY IMPORTANT that if one chooses the latter option ONLY 2 motors are
  # connected and no active simulations are in place, otherwise the stored serial numbers will be wrong and they will have to be modified.
  case ($"Error In") {
    frame Error, Default {
      w1 = $"Error In"
      w2 = $"Initialize App Bundle Cluster In"
    }
    frame No Error {
      Get Component Directory() -> (Path=w3)
      Strip Path(path=w3) -> (stripped path=w4)
      Build Path(base path=w4, name or relative path="Extra installers\\Thorlabs_Motors_Serial_Number.txt") -> (appended path=w5)
      s1 = w5  # shift register
      while (iteration -> i1) {
        Wait Until Next Multiple(multiple to wait=500)
        call "Check if File or Folder Exists.gvi"(file or folder=s1, error in=$"Error In") -> (file or folder exists?=w6, error out=w7)
        case (w6) {
          frame False, Default {
            Path To String(path=s1) -> (string=w11)
            w12 = "I could not find the Thorlabs_Motors_Serial_Number file in \nthis location:\n"
            w13 = """
Please make sure that the file is put back on that
location, provide an alternative path with the file or,
if you want, we can generate a file with the currently
detected Motor Serial Number Values."""
            Concatenate Strings(w12, w11, w13) -> w14
            w15 = "I will make sure\nthe file is placed\nback where it \nbelongs"
            Three Button Dialog(Allow user to close window? (TRUE)=FALSE, Center Button Text ("No")=w15, Left Button Text ("Yes")="I will provide an\nalternative path", Right Button Text ("Cancel")="Create a New File, i\ndo not know where the\nother is.", Window Title (" ")="Thorlabs_Motors_Serial_Number.txt not found", message=w14) -> (Which Button?=w16)
            case (w16) {
              frame "center button" {
                Wait Until Next Multiple(multiple to wait=20000)
                w9 = w7
                w10 = s1
              }
              frame "left button", Default {
                call "Select file prompt.gvi"(Main Message="Please select the Thorlabs_Motors_Serial_Number.txt file.", Sub message="It is usually on the extra installers folder", Error In=w7) -> (New Path=w10, Error Out=w9)
              }
              frame "right button" {
                call "Thorlabs motor Detector.gvi"(First Write Detection=TRUE, Prompt Iterations=2, Error In=w7) -> (Thorlabs Motor Serial Nº Array=w17, Detected?=w18, Error Out=w19)
                case (w18) {
                  frame False, Default {
                    w20 = """We have not detected any
motors, please make sure you
have properly connected them
before asking to create a file with
the currently detected Motor Serial
Number Values."""
                    One Button Dialog(button name ("OK")="Sorry I did not realise", message=w20)
                    w10 = s1
                    w9 = w19
                  }
                  frame True {
                    call "1D String Array to Delimited String.gvi"(string array=w17, delimiter=", ") -> (delimited string=w21)
                    w22 = """
Are you SURE that these are the correct Serial
Numbers and you want to store them for future
use?
(You can always manually modify them in case 
of changing the motors or if they have been reversed)"""
                    Concatenate Strings("These are the connected Motors Serial Number.\n", w21, w22) -> w23
                    Two Button Dialog(F button name ("Cancel")="No please these are not the\ncorrect serial numbers", T button name ("OK")="Yes, I am certain", message=w23) -> (T Button?=w24)
                    case (w24) {
                      frame False, Default {
                        w25 = "Then either create the file yourself \nor connect the right motors please."
                        One Button Dialog(button name ("OK")="Okay sorry.", message=w25)
                        w10 = s1
                        w9 = w19
                      }
                      frame True {
                        Array Index(array=w17) -> (out0[0]=w26, out1[1]=w27)
                        Property Node(instance in="Thorlabs Motors Serial Number In.gtype" {all zero or empty}, "Thorlabs Blue Motor"=w26, "Thorlabs Red Motor"=w27) -> (instance out=w28)
                        Strip Path(path=s1) -> (stripped path=w29)
                        call "Create Directory Recursive.gvi"(folder=w29, error in=w19) -> (error out=w30)
                        call "Modify Thorlabs File.gvi"(Path In=s1, Thorlabs Motor Serial Number File Operations="Write", Thorlabs Motors Serial Number In=w28, Error In=w30) -> (Path Out=w10, Error Out=w9)
                      }
                    }
                  }
                }
              }
            }
            w8 = FALSE
          }
          frame True {
            w8 = TRUE
            w9 = w7
            w10 = s1
          }
        }
        Is Greater(x=i1, y=2) -> w31
        case (w31) {
          frame False, Default {
            w32 = w9
            w33 = FALSE
          }
          frame True {
            w34 = """Seems you're having some trouble
finding the Thorlabs_Motors_Serial_Number.txt
file, do you want to proceed without it
and hope for the best?
(WARNING: some functionalities might
be compromized, or the entire program 
can crash)"""
            Two Button Dialog(F button name ("Cancel")="Oh dear no, I'd rather ask for help", T button name ("OK")="Yes please, I like to live dangerously", message=w34) -> (T Button?=w33)
            w32 = w9
          }
        }
        Logical Or(w33, w8) -> w35
        next s1 = w10
        stop if w35
      }
      call "Modify Thorlabs File.gvi"(Path In=s1, Thorlabs Motor Serial Number File Operations="Read", Error In=w32) -> (Path Out=w36, Thorlabs Motors Serial Number Out=w37, Error Out=w1)
      $"Thorlabs Motor Serial Number File Path" <- w36
      Property Node(instance in=$"Initialize App Bundle Cluster In") -> ("All Paths"=w38, "Instrument Addresses"=w39)
      Property Node(instance in=w38, "Thorlabs Motor Serial Number File Path"=w36) -> (instance out=w40)
      Property Node(instance in=w39, "Thorlabs Motors Serial Number"=w37) -> (instance out=w41)
      Property Node(instance in=$"Initialize App Bundle Cluster In", "All Paths"=w40, "Instrument Addresses"=w41) -> (instance out=w2)
      $"Thorlabs Motors Serial Number Out" <- w37
    }
  }
  $"Initialize App Bundle Cluster Out" <- w2
  $"Error Out" <- w1
