vi "KCube Dividing Wavelength Translator.gvi"   [LabVIEW NXG 5.0.0]
inputs:
  "Error In": error
  "Dividing Wavelength": f64
  "Rainbow Sweep Types": "Rainbow Sweep Types.gtype" = "Red Sweep Closing"
  "Dividing Wavelength Calibration Data In": "Dividing Wavelength Calibration Data.gtype"
  "Instrument Coms Info In": "Instrument Coms Info.gtype"
  "Debugging Cluster": "Debugging Cluster.gtype"
outputs:
  "Error Out": error
  "KCube Coordinates": "KCube Coordinates.gtype"
  "Instrument Coms Info Out": "Instrument Coms Info.gtype"
  "Real Dividing Wavelength": f64
types:
  "Rainbow Sweep Types.gtype" = enum{"Red Sweep Closing", "Red Sweep Opening", "Blue Sweep Closing", "Blue Sweep Opening"}
  "KCube Coordinates.gtype" = cluster{"Blue Motor Position to move to (mm)": f64, "Red Motor Position to move to (mm)": f64}
  "Dividing Wavelength Calibration Data.gtype" = cluster{"Dividing Wavelength (nm) Array": f64[], "Blue Motor Position (mm) Array": f64[], "Red Motor Position (mm) Array": f64[]}
  T1 = cluster{"Element 1": "VISA Instr", "Element 2": string}
  "Arduino Detection cluster control.gtype" = cluster{"XZ Stage Arduino Address": "VISA Instr", "XZ Stage Arduino Detected?": bool, "Multiplexer Arduino Detected?": bool, "Multiplexer Arduino Address": "VISA Instr", "Arduinos List": T1[], "XZ Stage Log": string, "Multiplexer Log": string}
  "Thorlabs Motors Serial Number In.gtype" = cluster{"Thorlabs Blue Motor": string, "Thorlabs Red Motor": string, "Blue Motor Homed?": bool, "Red Motor Homed?": bool}
  "Instrument Coms Info.gtype" = cluster{"Arduino Coms Info": "Arduino Detection cluster control.gtype", "Photodetector Names": string[], "Keythley Address": "VISA Instr", "Photodetector Detected?": bool, "Thorlabs Motors Detected?": bool, "Keithley Detected?": bool, "Thorlabs Motors Serial Number": "Thorlabs Motors Serial Number In.gtype", "Photodetector IVI session": "Ivi IviDefault"}
  "Insturment Debugging Cluster.gtype" = cluster{"Keithley": bool, "Arduinos": bool, "Thorlabs Motors": bool, "Photodetector": bool}
  "Debugging Cluster.gtype" = cluster{"Debugging mode?": bool, "Initialize App": bool, "Insturment Debugging": "Insturment Debugging Cluster.gtype"}
uses:
  Rainbow Measurement Setup::Side Functions::Utilities::Find Closest In Array.gvi
  NXG_KCube_DC_Servo_Control::Utilities::Move To Position.gvi
diagram:
  # This subVI takes the dividing wavelength calibration data and the dividing wavelength and calculates
  # the position of the guillotine motors so as to have that exact wavelength. It looks for the closest value within
  # the array and gives out that closest value as well as the coordinates for that value.
  # All that only if the debugging allows for it.
  case ($"Error In") {
    frame Error, Default {
      w1 = $"Error In"
      w2 = default
      w3 = $"Instrument Coms Info In"
      w4 = $"Dividing Wavelength"
    }
    frame No Error {
      Property Node(instance in=$"Dividing Wavelength Calibration Data In") -> ("Dividing Wavelength (nm) Array"=w5, "Blue Motor Position (mm) Array"=w6, "Red Motor Position (mm) Array"=w7)
      call "Find Closest In Array.gvi"(Array In=w5, Desired Value=$"Dividing Wavelength", Error In=$"Error In") -> (Closest Value Index=w8, Closest Value=w4, Error Out=w9)
      Is Less Than 0(x=w8) -> w10
      case (w10) {
        frame False, Default { }
        frame True {
          w11 = """Dividing wavelength not in the calibration file
please extend either the range or the resolution
of the calibration file or contact Martí 
Problem in KCube Dividing Wavelength Translator)"""
          One Button Dialog(button name ("OK")="Okay I will", message=w11)
        }
      }
      Property Node(instance in=$"Debugging Cluster") -> ("Debugging mode?"=w12, "Insturment Debugging:Thorlabs Motors"=w13)
      Logical And[output inverted](w12, not w13) -> w14
      case (w14) {
        frame False, Default {
          w1 = w9
          w3 = $"Instrument Coms Info In"
          w2 = "KCube Coordinates.gtype" {all zero or empty}
        }
        frame True {
          case ($"Rainbow Sweep Types") {
            frame "Red Sweep Closing", Default {
              Array Index(array=w6) -> (out0[w8]=w15)
              Property Node(instance in="KCube Coordinates.gtype" {all zero or empty}, "Blue Motor Position to move to (mm)"=w15) -> (instance out=w2)
              Property Node(instance in=$"Instrument Coms Info In") -> ("Thorlabs Motors Serial Number:Thorlabs Blue Motor"=w16, instance out=w3)
              call "Move To Position.gvi"(Motor Serial Number In=w16, Position to move in mm=w15, Error In=w9) -> (Error Out=w1)
            }
            frame "Red Sweep Opening" {
              Array Index(array=w6) -> (out0[w8]=w17)
              Property Node(instance in="KCube Coordinates.gtype" {all zero or empty}, "Blue Motor Position to move to (mm)"=w17) -> (instance out=w2)
              Property Node(instance in=$"Instrument Coms Info In") -> ("Thorlabs Motors Serial Number:Thorlabs Blue Motor"=w18, instance out=w3)
              call "Move To Position.gvi"(Motor Serial Number In=w18, Position to move in mm=w17, Error In=w9) -> (Error Out=w1)
            }
            frame "Blue Sweep Closing" {
              Array Index(array=w7) -> (out0[w8]=w19)
              Property Node(instance in="KCube Coordinates.gtype" {all zero or empty}, "Red Motor Position to move to (mm)"=w19) -> (instance out=w2)
              Property Node(instance in=$"Instrument Coms Info In") -> ("Thorlabs Motors Serial Number:Thorlabs Red Motor"=w20, instance out=w3)
              call "Move To Position.gvi"(Motor Serial Number In=w20, Position to move in mm=w19, Error In=w9) -> (Error Out=w1)
            }
            frame "Blue Sweep Opening" {
              Array Index(array=w7) -> (out0[w8]=w21)
              Property Node(instance in="KCube Coordinates.gtype" {all zero or empty}, "Red Motor Position to move to (mm)"=w21) -> (instance out=w2)
              Property Node(instance in=$"Instrument Coms Info In") -> ("Thorlabs Motors Serial Number:Thorlabs Red Motor"=w22, instance out=w3)
              call "Move To Position.gvi"(Motor Serial Number In=w22, Position to move in mm=w21, Error In=w9) -> (Error Out=w1)
            }
          }
        }
      }
    }
  }
  $"Instrument Coms Info Out" <- w3
  $"KCube Coordinates" <- w2
  $"Error Out" <- w1
  $"Real Dividing Wavelength" <- w4
