vi "KCube Motors Home sequence.gvi"   [LabVIEW NXG 5.0.0]
inputs:
  "Error In": error
  "Instrument Coms Info In": "Instrument Coms Info.gtype"
outputs:
  "Error Out": error
  "Homed?": bool
  "Instrument Coms Info Out": "Instrument Coms Info.gtype"
types:
  T1 = cluster{"Element 1": "VISA Instr", "Element 2": string}
  "Arduino Detection cluster control.gtype" = cluster{"XZ Stage Arduino Address": "VISA Instr", "XZ Stage Arduino Detected?": bool, "Multiplexer Arduino Detected?": bool, "Multiplexer Arduino Address": "VISA Instr", "Arduinos List": T1[], "XZ Stage Log": string, "Multiplexer Log": string}
  "Thorlabs Motors Serial Number In.gtype" = cluster{"Thorlabs Blue Motor": string, "Thorlabs Red Motor": string}
  "Instrument Coms Info.gtype" = cluster{"Arduino Coms Info": "Arduino Detection cluster control.gtype", "Photodetector Names": string[], "Keythley Address": "VISA Instr", "Photodetector Detected?": bool, "Thorlabs Motors Detected?": bool, "Keithley Detected?": bool, "Thorlabs Motors Serial Number": "Thorlabs Motors Serial Number In.gtype", "Photodetector IVI session": "Ivi IviDefault"}
uses:
  NXG_KCube_DC_Servo_Control::Utilities::Home Subroutine.gvi
  Rainbow Measurement Setup::Side Functions::Messages And Prompts::General Failed Loop Prompt.gvi
diagram:
  # This SubVI Homes both motors and prompts the user when the motor homing
  # process has some problems giving him the oportunity to decide if he wants to
  # continue or if he wants to stop.
  case ($"Error In") {
    frame Error, Default {
      w1 = $"Error In"
      w2 = $"Instrument Coms Info In"
    }
    frame No Error {
      Property Node(instance in=$"Instrument Coms Info In") -> ("Thorlabs Motors Serial Number:Thorlabs Blue Motor"=w3, "Thorlabs Motors Serial Number:Thorlabs Red Motor"=w4, instance out=w2)
      while (iteration -> i1) {
        call "Home Subroutine.gvi"(Motor Serial Number In=w3, Error In=$"Error In") -> (Homed?=w5, Error Out=w6)
        call "Home Subroutine.gvi"(Motor Serial Number In=w4, Error In=w6) -> (Homed?=w7, Error Out=w8)
        Logical And(w5, w7) -> w9
        w10 = """It seems like the KCube Motors
are having some problems homing.
Make sure the connections are still
okay and they are powered on. 
(You can try to unplug and replug
them.
You might have to restart the software)"""
        w11 = """Seems you're having some trouble
homing the thorlabs motors, do you 
want to proceed without homing them
and hope for the best?
(WARNING: some functionalities might
be compromized, ONLY ADVANCED USERS)"""
        call "General Failed Loop Prompt.gvi"(Call to Action Message=w11, Call To Action True / Left Answer="Yes please, I like to live dangerously", Call To Action False / Center Answer="Oh dear no, I'd rather ask for help", General Failed Loop Prompt Call to Action Selector="Two Button Action", Succesful loop?=w9, Failed Loop Message=w10, Failed Loop Messager Response="Okay I will", Error In=w8, Call to action Iterations=2, Loop Iterations=i1) -> (Call To Action Boolean Answer=w12, Error Out=w1)
        Logical Or(w9, w12) -> w13
        stop if w13
      }
      $"Homed?" <- w9
    }
  }
  $"Instrument Coms Info Out" <- w2
  $"Error Out" <- w1
