vi "KCube Move to 0 or Home.gvi"   [LabVIEW NXG 5.0.0]
inputs:
  "Error In": error
  "Instrument Coms Info In": "Instrument Coms Info.gtype"
  "Debugging Cluster In": "Debugging Cluster.gtype"
outputs:
  "Error Out": error
  "Instrument Coms Info Out": "Instrument Coms Info.gtype"
  "Debugging Cluster Out": "Debugging Cluster.gtype"
types:
  T1 = cluster{"Element 1": "VISA Instr", "Element 2": string}
  "Arduino Detection cluster control.gtype" = cluster{"XZ Stage Arduino Address": "VISA Instr", "XZ Stage Arduino Detected?": bool, "Multiplexer Arduino Detected?": bool, "Multiplexer Arduino Address": "VISA Instr", "Arduinos List": T1[], "XZ Stage Log": string, "Multiplexer Log": string}
  "Thorlabs Motors Serial Number In.gtype" = cluster{"Thorlabs Blue Motor": string, "Thorlabs Red Motor": string, "Blue Motor Homed?": bool, "Red Motor Homed?": bool}
  "Instrument Coms Info.gtype" = cluster{"Arduino Coms Info": "Arduino Detection cluster control.gtype", "Photodetector Names": string[], "Keythley Address": "VISA Instr", "Photodetector Detected?": bool, "Thorlabs Motors Detected?": bool, "Keithley Detected?": bool, "Thorlabs Motors Serial Number": "Thorlabs Motors Serial Number In.gtype", "Photodetector IVI session": "Ivi IviDefault"}
  "Insturment Debugging Cluster.gtype" = cluster{"Keithley": bool, "Arduinos": bool, "Thorlabs Motors": bool, "Photodetector": bool}
  "Debugging Cluster.gtype" = cluster{"Debugging mode?": bool, "Initialize App": bool, "Insturment Debugging": "Insturment Debugging Cluster.gtype"}
uses:
  Rainbow Measurement Setup::Side Functions::Instrument Control::Thorlabs Motors::Movement::KCube Motors Initialize.gvi
  Rainbow Measurement Setup::Side Functions::Instrument Control::Thorlabs Motors::Movement::KCube Motors Move to Position.gvi
  Rainbow Measurement Setup::Side Functions::Instrument Control::Thorlabs Motors::Movement::KCube Motors Home sequence.gvi
  Rainbow Measurement Setup::Side Functions::Instrument Control::Thorlabs Motors::Movement::KCube Motors Close.gvi
diagram:
  # This subVI moves the motors to 0 or homes them in case they are not homed yet
  # to reset the position of the guillotine.
  # It also checks if the debugging is on and if the user wants to use the motors or not
  case ($"Error In") {
    frame Error, Default {
      w1 = $"Error In"
      w2 = $"Instrument Coms Info In"
      w3 = $"Debugging Cluster In"
    }
    frame No Error {
      Property Node(instance in=$"Debugging Cluster In") -> ("Debugging mode?"=w4, "Insturment Debugging:Thorlabs Motors"=w5, instance out=w3)
      Logical And[output inverted](w4, not w5) -> w6
      case (w6) {
        frame False, Default {
          w1 = $"Error In"
          w2 = $"Instrument Coms Info In"
        }
        frame True {
          Property Node(instance in=$"Instrument Coms Info In") -> ("Thorlabs Motors Serial Number:Blue Motor Homed?"=w7, "Thorlabs Motors Serial Number:Red Motor Homed?"=w8, instance out=w9)
          call "KCube Motors Initialize.gvi"(Instrument Coms Info In=w9, Error In=$"Error In") -> (Instrument Coms Info Out=w10, Error Out=w11)
          Logical And(w7, w8) -> w12
          case (w12) {
            frame True {
              call "KCube Motors Move to Position.gvi"(Instrument Coms Info In=w10, Error In=w11) -> (Instrument Coms Info Out=w13, Error Out=w14)
            }
            frame False {
              call "KCube Motors Home sequence.gvi"(Instrument Coms Info In=w10, Error In=w11) -> (Instrument Coms Info Out=w13, Error Out=w14)
            }
          }
          call "KCube Motors Close.gvi"(Instrument Coms Info In=w13, Error In=w14) -> (Instrument Coms Info Out=w2, Error Out=w1)
        }
      }
    }
  }
  $"Instrument Coms Info Out" <- w2
  $"Error Out" <- w1
  $"Debugging Cluster Out" <- w3
