vi "Path Check & Generation.gvi"   [LabVIEW NXG 5.0.0]
inputs:
  "Error In": error
  "Default Data Saving Location": path
  "Measurement File Type": "Measurement File Type.gtype" = "Single Cell Rainbow"
  "Cell Naming Cluster": "Cell Naming Cluster.gtype"
outputs:
  "Error Out": error
  "File path": path
  "Folder to save data": path
types:
  "Measurement File Type.gtype" = enum{"Single Cell Rainbow", "Multiple Cell Rainbow", "Light Calibration Power", "Light Calibration Spectral Density", "Light Calibration Power Density", "Light Calibration Dividing Wavelength Spectrum", "Dividing Wavelength To Motor Position"}
  "Cell Naming Cluster.gtype" = cluster{"Cell Label": string, "Sample Prefix": string, "Author Initials": string, "Current Date": string, "Batch Name": string}
uses:
  NI::G Core::File IO (General)::Check if File or Folder Exists.gvi
  Rainbow Measurement Setup::Side Functions::Messages And Prompts::Select path prompt.gvi
  Rainbow Measurement Setup::Side Functions::Path Manipulation::Create or Open Folder.gvi
  Rainbow Measurement Setup::Side Functions::Utilities::Cell Naming::txt Extension adder.gvi
  NI::G Core::File IO (General)::Create Directory Recursive.gvi
diagram:
  case ($"Error In") {
    frame Error, Default {
      w1 = $"Error In"
      w2 = default
      w3 = $"Default Data Saving Location"
    }
    frame No Error {
      case ($"Measurement File Type") {
        frame "Single Cell Rainbow", Default {
          Property Node(instance in=$"Cell Naming Cluster") -> ("Author Initials"=w4, "Current Date"=w5, "Batch Name"=w6, "Sample Prefix"=w7)
          Concatenate Strings("Device ", w6) -> w8
          call "Check if File or Folder Exists.gvi"(file or folder=$"Default Data Saving Location", error in=$"Error In") -> (file or folder exists?=w9, error out=w10)
          Is Empty String Or Path(string/path=$"Default Data Saving Location") -> w11
          Logical Or(w11, not w9) -> w12
          case (w12) {
            frame False {
              w3 = $"Default Data Saving Location"
              w13 = w10
            }
            frame True {
              w14 = "Please specify the path where you want to save all your measurements:"
              call "Select path prompt.gvi"(Main Message=w14, Sub message="Sub paths with your name, date and device will be created", Error In=w10) -> (New Path=w3, Error Out=w13)
            }
          }
          call "Create or Open Folder.gvi"(Folder Root Path=w3, Folder Name=w4, Error In=w13) -> (New Folder's Path=w15, Error Out=w16)
          call "Create or Open Folder.gvi"(Folder Root Path=w15, Folder Name=w5, Error In=w16) -> (New Folder's Path=w17, Error Out=w18)
          call "Create or Open Folder.gvi"(Folder Root Path=w17, Folder Name=w8, Error In=w18) -> (New Folder's Path=w19, Error Out=w20)
          call "Create or Open Folder.gvi"(Folder Root Path=w19, Folder Name="TXT files", Error In=w20) -> (New Folder's Path=w21, Error Out=w22)
          call "txt Extension adder.gvi"(Name without .txt=w7, Error In=w22) -> (Name with .txt=w23, Error Out=w1)
          Build Path(base path=w21, name or relative path=w23) -> (appended path=w2)
        }
        frame "Multiple Cell Rainbow" {
          Property Node(instance in=$"Cell Naming Cluster") -> ("Author Initials"=w24, "Current Date"=w25, "Batch Name"=w26, "Cell Label"=w27, "Sample Prefix"=w28)
          call "Check if File or Folder Exists.gvi"(file or folder=$"Default Data Saving Location", error in=$"Error In") -> (file or folder exists?=w29, error out=w30)
          Is Empty String Or Path(string/path=$"Default Data Saving Location") -> w31
          Logical Or(w31, not w29) -> w32
          case (w32) {
            frame False {
              w3 = $"Default Data Saving Location"
              w33 = w30
            }
            frame True {
              w34 = "Please specify the path where you want to save all your measurements:"
              call "Select path prompt.gvi"(Main Message=w34, Sub message="Sub paths with your name, date and device will be created", Error In=w30) -> (New Path=w3, Error Out=w33)
            }
          }
          call "Create or Open Folder.gvi"(Folder Root Path=w3, Folder Name=w24, Error In=w33) -> (New Folder's Path=w35, Error Out=w36)
          call "Create or Open Folder.gvi"(Folder Root Path=w35, Folder Name=w25, Error In=w36) -> (New Folder's Path=w37, Error Out=w38)
          Concatenate Strings("Device ", w26) -> w39
          call "Create or Open Folder.gvi"(Folder Root Path=w37, Folder Name=w39, Error In=w38) -> (New Folder's Path=w40, Error Out=w41)
          call "Create or Open Folder.gvi"(Folder Root Path=w40, Folder Name="TXT files", Error In=w41) -> (New Folder's Path=w42, Error Out=w43)
          Concatenate Strings(w28, w27) -> w44
          call "txt Extension adder.gvi"(Name without .txt=w44, Error In=w43) -> (Name with .txt=w45, Error Out=w1)
          Build Path(base path=w42, name or relative path=w45) -> (appended path=w2)
        }
        frame "Light Calibration Power" {
          Property Node(instance in=$"Cell Naming Cluster") -> ("Author Initials"=w46, "Current Date"=w47, "Batch Name"=w48, "Sample Prefix"=w49)
          call "Check if File or Folder Exists.gvi"(file or folder=$"Default Data Saving Location", error in=$"Error In") -> (file or folder exists?=w50, error out=w51)
          Is Empty String Or Path(string/path=$"Default Data Saving Location") -> w52
          Logical Or(w52, not w50) -> w53
          case (w53) {
            frame False {
              w3 = $"Default Data Saving Location"
              w54 = w51
            }
            frame True {
              w55 = "Please specify the path where you want to save all your measurements:"
              call "Select path prompt.gvi"(Main Message=w55, Sub message="Sub paths with your name, date and device will be created", Error In=w51) -> (New Path=w3, Error Out=w54)
            }
          }
          call "Create or Open Folder.gvi"(Folder Root Path=w3, Folder Name=w46, Error In=w54) -> (New Folder's Path=w56, Error Out=w57)
          call "Create or Open Folder.gvi"(Folder Root Path=w56, Folder Name=w47, Error In=w57) -> (New Folder's Path=w58, Error Out=w59)
          Concatenate Strings("Device ", w48) -> w60
          call "Create or Open Folder.gvi"(Folder Root Path=w58, Folder Name=w60, Error In=w59) -> (New Folder's Path=w61, Error Out=w62)
          call "Create or Open Folder.gvi"(Folder Root Path=w61, Folder Name="TXT files", Error In=w62) -> (New Folder's Path=w63, Error Out=w64)
          Concatenate Strings(w49, "Power_Calibration") -> w65
          call "txt Extension adder.gvi"(Name without .txt=w65, Error In=w64) -> (Name with .txt=w66, Error Out=w1)
          Build Path(base path=w63, name or relative path=w66) -> (appended path=w2)
        }
        frame "Light Calibration Spectral Density" {
          Get Component Directory() -> (Path=w67)
          Strip Path(path=w67) -> (stripped path=w68)
          Build Path(base path=w68, name or relative path="Extra installers\\Calibration_Files") -> (appended path=w69)
          call "Check if File or Folder Exists.gvi"(file or folder=w69, error in=$"Error In") -> (file or folder exists?=w70, error out=w71)
          Is Empty String Or Path(string/path=w69) -> w72
          Logical Or(w72, not w70) -> w73
          case (w73) {
            frame False {
              w3 = w69
              w74 = w71
            }
            frame True {
              call "Create Directory Recursive.gvi"(folder=w69, error in=w71) -> (error out=w74)
              w3 = w69
            }
          }
          call "txt Extension adder.gvi"(Name without .txt="Spectral_Density_Calibration", Error In=w74) -> (Name with .txt=w75, Error Out=w1)
          Build Path(base path=w3, name or relative path=w75) -> (appended path=w2)
        }
        frame "Light Calibration Power Density" {
          Get Component Directory() -> (Path=w76)
          Strip Path(path=w76) -> (stripped path=w77)
          Build Path(base path=w77, name or relative path="Extra installers\\Calibration_Files") -> (appended path=w78)
          call "Check if File or Folder Exists.gvi"(file or folder=w78, error in=$"Error In") -> (file or folder exists?=w79, error out=w80)
          Is Empty String Or Path(string/path=w78) -> w81
          Logical Or(w81, not w79) -> w82
          case (w82) {
            frame False {
              w3 = w78
              w83 = w80
            }
            frame True {
              call "Create Directory Recursive.gvi"(folder=w78, error in=w80) -> (error out=w83)
              w3 = w78
            }
          }
          call "txt Extension adder.gvi"(Name without .txt="Power_Density_Calibration", Error In=w83) -> (Name with .txt=w84, Error Out=w1)
          Build Path(base path=w3, name or relative path=w84) -> (appended path=w2)
        }
        frame "Light Calibration Dividing Wavelength Spectrum" {
          Get Component Directory() -> (Path=w85)
          Strip Path(path=w85) -> (stripped path=w86)
          Build Path(base path=w86, name or relative path="Extra installers\\Calibration_Files") -> (appended path=w87)
          call "Check if File or Folder Exists.gvi"(file or folder=w87, error in=$"Error In") -> (file or folder exists?=w88, error out=w89)
          Is Empty String Or Path(string/path=w87) -> w90
          Logical Or(w90, not w88) -> w91
          case (w91) {
            frame False {
              w3 = w87
              w92 = w89
            }
            frame True {
              call "Create Directory Recursive.gvi"(folder=w87, error in=w89) -> (error out=w92)
              w3 = w87
            }
          }
          call "txt Extension adder.gvi"(Name without .txt="Beam_Spectrum_Calibration", Error In=w92) -> (Name with .txt=w93, Error Out=w1)
          Build Path(base path=w3, name or relative path=w93) -> (appended path=w2)
        }
        frame "Dividing Wavelength To Motor Position" {
          Get Component Directory() -> (Path=w94)
          Strip Path(path=w94) -> (stripped path=w95)
          Build Path(base path=w95, name or relative path="Extra installers\\Calibration_Files") -> (appended path=w96)
          call "Check if File or Folder Exists.gvi"(file or folder=w96, error in=$"Error In") -> (file or folder exists?=w97, error out=w98)
          Is Empty String Or Path(string/path=w96) -> w99
          Logical Or(w99, not w97) -> w100
          case (w100) {
            frame False {
              w3 = w96
              w101 = w98
            }
            frame True {
              call "Create Directory Recursive.gvi"(folder=w96, error in=w98) -> (error out=w101)
              w3 = w96
            }
          }
          call "txt Extension adder.gvi"(Name without .txt="Dividing Wavelength To Motor Position Calibration File", Error In=w101) -> (Name with .txt=w102, Error Out=w1)
          Build Path(base path=w3, name or relative path=w102) -> (appended path=w2)
        }
      }
    }
  }
  $"Folder to save data" <- w3
  $"File path" <- w2
  $"Error Out" <- w1
