vi "Rainbow Sweep Param Generator.gvi"   [LabVIEW NXG 5.0.0]
inputs:
  "Error In": error
  "Rainbow Sweep Parameters": "Rainbow Sweep Param Selector.gtype"
outputs:
  "Error Out": error
  "Rainbow Sweep Parameters Array": "Rainbow Sweep Parameters.gtype"[]
types:
  "Raibow Sweep Selector.gtype" = enum{"Red Sweep", "Blue Sweep", "Full Sweep Red First", "Full Sweep Blue First"}
  T1 = enum{"Red Sweep Closing", "Red Sweep Opening", "Red Sweep Both Ways"}
  T2 = enum{"Blue Sweep Opening", "Blue Sweep Closing", "Blue Sweep Both Ways"}
  "Rainbow Sweep Type Selector.gtype" = cluster{"Red Sweep Mode": T1, "Blue Sweep Mode": T2}
  "Rainbow Sweep Param Selector.gtype" = cluster{"Raibow Sweep Selector": "Raibow Sweep Selector.gtype", "Max Wavelength (nm)": f64, "Min Wavelength (nm)": f64, "Wavelength Step (nm)": f64, "Rainbow Sweep Type Selector": "Rainbow Sweep Type Selector.gtype"}
  "Rainbow Sweep Types.gtype" = enum{"Red Sweep Closing", "Red Sweep Opening", "Blue Sweep Closing", "Blue Sweep Opening"}
  "Rainbow Sweep Parameters.gtype" = cluster{"Dividing Wavelength Array": f64[], "Rainbow Sweep Types": "Rainbow Sweep Types.gtype"}
uses:
  Rainbow Measurement Setup::Side Functions::Rainbow Sweep::Rainbow Sweep Type Extractor.gvi
diagram:
  # This SubVI Takes the desired wavelength range as well as the wavelength steps and the type of Rainbow Sweep that we want to perform and it outputs an array
  # that contains a cluster with the dividing wavelength array as well as the type of Rainbow sweep. It is an array because we might want to perform more than one sweep
  # per measurement.
  case ($"Error In") {
    frame Error, Default {
      w1 = $"Error In"
      w2 = default
    }
    frame No Error {
      Property Node(instance in=$"Rainbow Sweep Parameters") -> ("Max Wavelength (nm)"=w3, "Min Wavelength (nm)"=w4, "Wavelength Step (nm)"=w5)
      In Range And Coerce[IncludeHighLimit=True](lower limit=0.1, upper limit=100, x=w5) -> (coerced(x)=w6)
      Subtract(x=w3, y=w4) -> w7
      Absolute Value(x=w7) -> w8
      Divide(x=w8, y=w6) -> w9
      Round Toward Negative Infinity(x=w9) -> w10
      Increment(x=w10) -> w11
      call "Rainbow Sweep Type Extractor.gvi"(Rainbow Sweep Parameters=$"Rainbow Sweep Parameters", Error In=$"Error In") -> (Rainbow Sweep Array=w12, Error Out=w13)
      To Signed 32 Bit Integer(number=w11) -> w14
      s1 = w13  # shift register
      for {
        w15 = each element of w12
        # w3: Max Wavelength
        # w4: Min Wavelength
        # w11: Ammount of Steps
        # w6: Wavelength Step
        case (w15) {
          frame "Red Sweep Opening", Default {
            for (N = w14) (iteration -> i1) {
              To Double Precision Float(number=i1) -> w18
              Multiply(w6, w18) -> w19
              Subtract(x=w3, y=w19) -> w20
              append w20 to w17
            }
            Property Node(instance in="Rainbow Sweep Parameters.gtype" {all zero or empty}, "Dividing Wavelength Array"=w17, "Rainbow Sweep Types"=w15) -> (instance out=w16)
          }
          frame "Red Sweep Closing" {
            for (N = w14) (iteration -> i2) {
              To Double Precision Float(number=i2) -> w22
              Multiply(w6, w22) -> w23
              Add(w4, w23) -> w24
              append w24 to w21
            }
            Property Node(instance in="Rainbow Sweep Parameters.gtype" {all zero or empty}, "Dividing Wavelength Array"=w21, "Rainbow Sweep Types"=w15) -> (instance out=w16)
          }
          frame "Blue Sweep Closing" {
            for (N = w14) (iteration -> i3) {
              To Double Precision Float(number=i3) -> w26
              Multiply(w6, w26) -> w27
              Subtract(x=w3, y=w27) -> w28
              append w28 to w25
            }
            Property Node(instance in="Rainbow Sweep Parameters.gtype" {all zero or empty}, "Dividing Wavelength Array"=w25, "Rainbow Sweep Types"=w15) -> (instance out=w16)
          }
          frame "Blue Sweep Opening" {
            for (N = w14) (iteration -> i4) {
              To Double Precision Float(number=i4) -> w30
              Multiply(w6, w30) -> w31
              Add(w4, w31) -> w32
              append w32 to w29
            }
            Property Node(instance in="Rainbow Sweep Parameters.gtype" {all zero or empty}, "Dividing Wavelength Array"=w29, "Rainbow Sweep Types"=w15) -> (instance out=w16)
          }
        }
        append w16 to w2
      }
      w1 = s1
    }
  }
  $"Error Out" <- w1
  $"Rainbow Sweep Parameters Array" <- w2
