vi "Prefix Generator.gvi"   [LabVIEW NXG 5.0.0]
inputs:
  "Error In": error
  "Author Initials": string
  "Current Date": string
  "Batch Name": string
  "Cell Number": string
  "Sample Comments": string
  "Cell number required?": bool
outputs:
  "Error Out": error
  "Sample Prefix": string
  "Missing Error": bool
  "Error Label": string
diagram:
  # This SubVI takes all the needed Parameters and creates the cell prefix.
  # It also creates an error label in case there is something wrong with the
  # name such as missing labels or forbidden characters
  case ($"Error In") {
    frame Error, Default {
      w1 = $"Error In"
      w2 = ""
      w3 = ""
      w4 = default
    }
    frame No Error {
      Is Empty String Or Path(string/path=$"Cell Number") -> w5
      Logical And($"Cell number required?", w5) -> w6
      case (w6) {
        frame False, Default {
          w7 = ""
        }
        frame True {
          w7 = "I'm missing the Cell Name.\n"
        }
      }
      Is Empty String Or Path(string/path=$"Author Initials") -> w8
      case (w8) {
        frame False, Default {
          w9 = ""
        }
        frame True {
          w9 = "I'm missing the author's initials.\n"
        }
      }
      Is Empty String Or Path(string/path=$"Current Date") -> w10
      case (w10) {
        frame False, Default {
          w11 = ""
        }
        frame True {
          w11 = "I'm missing the Current Date.\n"
        }
      }
      Is Empty String Or Path(string/path=$"Batch Name") -> w12
      case (w12) {
        frame False, Default {
          w13 = ""
        }
        frame True {
          w13 = "I'm missing the Batch Name.\n"
        }
      }
      Build Array($"Author Initials", $"Current Date", $"Batch Name", $"Sample Comments", $"Cell Number") -> w14
      s1 = ""  # shift register
      for {
        w15 = each element of w14
        Is Empty String Or Path(string/path=w15) -> w16
        case (w16) {
          frame False, Default {
            Concatenate Strings(s1, w15, ".") -> w17
          }
          frame True {
            w17 = s1
          }
        }
        next s1 = w17
      }
      s2 = $"Error In"  # shift register
      for {
        w18 = each element of ["/", "\\", "*", ":", "?", "\"", ">", "<", "|"]
        Search And Replace String(error in (no error)=s2, input string=s1, replace all (F)=TRUE, search string=w18) -> (error out=w20, number of replacements=w21, result string=w3)
        Is Greater Than 0(x=w21) -> w22
        append w22 to w19
        next s2 = w20
      }
      Or Array Elements(Boolean array=w19) -> (logical OR=w23)
      case (w23) {
        frame False, Default {
          w24 = ""
        }
        frame True {
          w25 = """You used one of these characters,
which cannot be used for naming files and folders:
 \ / * : ? " < > |
If you do not fix it, your files will NOT be saved.
"""
          w24 = w25
        }
      }
      Concatenate Strings(w9, w11, w13, w24, w7) -> w2
      Logical Or(w8, w10, w12, w23, w6) -> w4
      w1 = s2
    }
  }
  $"Error Label" <- w2
  $"Sample Prefix" <- w3
  $"Missing Error" <- w4
  $"Error Out" <- w1
