vi "Timeout Sequence.gvi"   [LabVIEW NXG 5.0.0]
inputs:
  "Error In": error
outputs:
  "Error Out": error
  "Current State Out": "Queue Instructions Control.gtype"
  "Current SubState Out": string
  "Stop App?": bool
types:
  "Queue Instructions Control.gtype" = enum{"Undefined State", "Initialize App", "Idle", "Light Calibration Irradiance", "Light Calibration Spectral Density", "Light Calibration Power Density", "Access TXT File", "Stop App"}
uses:
  Rainbow Measurement Setup::Main Functions::Instruction Queue::Current State::FGV Current State.gvi
  Rainbow Measurement Setup::Side Functions::Messages And Prompts::Initializing app prompt.gvi
diagram:
  # This is the sequence that executes every 500 ms to check
  # the current state of the application. It outputs the current
  # state and substate and also shows the Initialization prompt
  # when the application is initializing.
  # Finally it checks if the current state is Stop App and outputs
  # the result to stop the master loop.
  case ($"Error In") {
    frame Error, Default {
      w1 = $"Error In"
    }
    frame No Error {
      call "FGV Current State.gvi"(Current State Instructions="Read Current State and Substate", Error In=$"Error In") -> (Current State Out=w2, Current SubState Out=w3, Error Out=w4)
      $"Current SubState Out" <- w3
      Is Equal(x=w2, y="Initialize App") -> w5
      case (w5) {
        frame False, Default {
          w1 = w4
        }
        frame True {
          call "Initializing app prompt.gvi"(Error In=w4) -> (Error Out=w1)
        }
      }
      $"Current State Out" <- w2
      Is Equal(x=w2, y="Stop App") -> w6
      $"Stop App?" <- w6
    }
  }
  $"Error Out" <- w1
