vi "Timeout Read FGV Data Subroutine.gvi"   [LabVIEW NXG 5.0.0]
inputs:
  "Misc Data Mega Cluster In": "Misc Data Mega Cluster.gtype"
  "Error In": error
outputs:
  "Misc Data Mega Cluster Out": "Misc Data Mega Cluster.gtype"
  "Error Out": error
types:
  "Full Reference Cluster.gtype" = cluster{"Enum Reference Cluster": "Enum Control Reference Cluster.gtype", "Boolean Reference Cluster": "Boolean Control Reference Cluster.gtype", "Numeric Reference Cluster": "Numeric Control Reference Cluster.gtype", "Numeric Cluster Reference Cluster": "Numeric Cluster Reference Cluster.gtype", "Path Reference Cluster": "Path Reference Cluster.gtype", "Cluster Reference Cluster": "Cluster Reference Cluster.gtype", "XZ Stage Controls Reference Cluster": "XZ Stage Controls Reference Cluster.gtype"}
  "Cell Naming Cluster.gtype" = cluster{"Cell Label": string, "Sample Prefix": string, "Author Initials": string, "Current Date": string, "Batch Name": string}
  T1 = cluster{"X Coordinate (mm)": f64, "Z Coordinate (mm)": f64}
  T2 = cluster{"X Coordinate (mm)": f64, "Z Coordinate (mm)": f64, "Vertical Spacing (mm)": f64}
  "XZ All Position Cluster.gtype" = cluster{"Diffusor Coordinates": T1, "Photodetector Coordinates": T1, "Cell R.01 Coordinates": T2}
  T3 = cluster{"Thorlabs Motor Serial Number File Path": path, "Default Data Saving Location": path}
  "Misc Data Mega Cluster.gtype" = cluster{"Full Reference Cluster": "Full Reference Cluster.gtype", "Cell Naming Cluster": "Cell Naming Cluster.gtype", "All XZ Position Cluster": "XZ All Position Cluster.gtype", "All Paths": T3}
uses:
  Rainbow Measurement Setup::Main Functions::Rainbow Measurement::Cell Single Rainbow Measurement::SRM Live Parameters::SRM Sweep Live Reference Clustering.gvi
  Rainbow Measurement Setup::Main Functions::Rainbow Measurement::Cell Single Rainbow Measurement::SRM Live Parameters::SRM Sweep Live Parameters FGV.gvi
  Rainbow Measurement Setup::Side Functions::Timeout Subroutines::Update Graphs Control Change.gvi
  Rainbow Measurement Setup::Main Functions::Rainbow Measurement::Cell Multiple Rainbow Measurement::MRM Live Parameters::MRM Sweep Live Parameters FGV.gvi
  Rainbow Measurement Setup::Side Functions::Timeout Subroutines::Read FGV Data Changed Idle Control Check.gvi
  Rainbow Measurement Setup::Main Functions::Rainbow Measurement::Single Multiple Measurement Utilities::FGV Last Measurement Type.gvi
  Rainbow Measurement Setup::Main Functions::Rainbow Measurement::Light Power Calibration::Light Calibration Live Parameters FGV.gvi
diagram:
  # This SubVI Reads the data stored in the FGVs and outputs it so that
  # the graphs and everything can be populated, but it only does during
  # their respective subroutines so that it does not get overwhelmed
  case ($"Error In") {
    frame Error, Default {
      w1 = $"Error In"
      w2 = $"Misc Data Mega Cluster In"
    }
    frame No Error {
      s1 = uninitialised  # shift register
      s1.prev1 = uninitialised  # shift register
      s1.prev2 = uninitialised  # shift register
      s2 = $"Misc Data Mega Cluster In"  # shift register
      while {
        Property Node(instance in=s2) -> ("Full Reference Cluster"=w3, "Full Reference Cluster:Enum Reference Cluster:Current State Ref"=w4, instance out=w5)
        Property Node(instance in=w4, error in=$"Error In") -> ("Value"=w6, error out=w7)
        Is Equal(x=s1, y=s1.prev1) -> w8
        Is Equal(x=s1.prev1, y=s1.prev2) -> w9
        Logical And(w8, w9) -> w10
        Select(s=w10, t=w6, f=s1.prev2) -> w11
        case (w11) {
          frame "Rainbow Single Measurement" {
            call "SRM Sweep Live Reference Clustering.gvi"(Full Reference Cluster=w3) -> (SRM sweep live parameters FGV Cluster Out=w13)
            call "SRM Sweep Live Parameters FGV.gvi"(FGV Instructions="Read State", SRM sweep live parameters FGV Cluster In=w13, Error In=w7) -> (SRM Live Parameters=w14, IV Plot Out=w15, Error Out=w16)
            call "Update Graphs Control Change.gvi"(Misc Data Mega Cluster In=w5, Update Refined IV Plot?=TRUE, Error In=w16) -> (Misc Data Mega Cluster Out=w17, Error Out=w18)
            Property Node(instance in=w17) -> ("Full Reference Cluster:Cluster Reference Cluster:Sweep Live Parameters RSM"=w19, "Full Reference Cluster:Cluster Reference Cluster:IV Plot Out Ref"=w20, instance out=w12)
            Property Node(instance in=w19, "Value"=w14, error in=w18) -> (error out=w21)
            Property Node(instance in=w20, "Value"=w15, error in=w21) -> (error out=w1)
          }
          frame "Rainbow Multiple Measurement" {
            call "MRM Sweep Live Parameters FGV.gvi"(FGV Instructions="Read State", Misc Data Mega Cluster In=w5, Error In=w7) -> (IV Plot Out=w22, Error Out=w23)
            call "Update Graphs Control Change.gvi"(Misc Data Mega Cluster In=w5, Update Refined IV Plot?=TRUE, Error In=w23) -> (Misc Data Mega Cluster Out=w24, Error Out=w25)
            Property Node(instance in=w24) -> ("Full Reference Cluster:Cluster Reference Cluster:IV Plot Out Multiple Reference"=w26, instance out=w12)
            Property Node(instance in=w26, "Value"=w22, error in=w25) -> (error out=w1)
          }
          frame "Idle", Default {
            call "Read FGV Data Changed Idle Control Check.gvi"(Misc Data Mega Cluster In=w5, Error In=w7) -> (Misc Data Mega Cluster Out=w27, Update IV Plot?=w28, Update Refined IV Plot?=w29, Error Out=w30)
            call "Update Graphs Control Change.gvi"(Misc Data Mega Cluster In=w27, Update Refined IV Plot?=w29, Error In=w30) -> (Misc Data Mega Cluster Out=w31, Error Out=w32)
            case (w28) {
              frame False, Default {
                w1 = w32
                w12 = w31
              }
              frame True {
                call "FGV Last Measurement Type.gvi"(FGV Instructions="Read State", Error In=w32) -> (Last Measurement State Out=w33, Error Out=w34)
                case (w33) {
                  frame "Rainbow Single Measurement", Default {
                    Property Node(instance in=w31) -> ("Full Reference Cluster:Cluster Reference Cluster:IV Plot Out Ref"=w35, instance out=w12)
                    call "SRM Sweep Live Reference Clustering.gvi"(Full Reference Cluster=w3) -> (SRM sweep live parameters FGV Cluster Out=w36)
                    call "SRM Sweep Live Parameters FGV.gvi"(FGV Instructions="Read State", SRM sweep live parameters FGV Cluster In=w36, Error In=w34) -> (IV Plot Out=w37, Error Out=w38)
                    Property Node(instance in=w35, "Value"=w37, error in=w38) -> (error out=w1)
                  }
                  frame "Rainbow Multiple Measurement" {
                    Property Node(instance in=w31) -> ("Full Reference Cluster:Cluster Reference Cluster:IV Plot Out Multiple Reference"=w39, instance out=w12)
                    call "MRM Sweep Live Parameters FGV.gvi"(FGV Instructions="Read State", Misc Data Mega Cluster In=w31, Error In=w34) -> (IV Plot Out=w40, Error Out=w41)
                    Property Node(instance in=w39, "Value"=w40, error in=w41) -> (error out=w1)
                  }
                }
              }
            }
          }
          frame "Light Power Calibration" {
            Property Node(instance in=w5) -> ("Full Reference Cluster:Cluster Reference Cluster:Light Power Calibration"=w42, "Full Reference Cluster:Numeric Cluster Reference Cluster:Sweep Live Parameters LPC ref"=w43, instance out=w12)
            call "Light Calibration Live Parameters FGV.gvi"(Full Reference Cluster=w3, FGV Instructions="Read State", Error In=w7) -> (Light Calibration Parameters Out=w44, Light Power Calibration Graph Out=w45, Error Out=w46)
            Property Node(instance in=w42, "Value"=w45, error in=w46) -> (error out=w47)
            Property Node(instance in=w43, "Value"=w44, error in=w47) -> (error out=w1)
          }
        }
        next s1 = w6
        next s2 = w12
        stop if TRUE
      }
      w2 = s2
    }
  }
  $"Error Out" <- w1
  $"Misc Data Mega Cluster Out" <- w2
